# Grasshopper definition DRVaa.gh (Grasshopper 1.0.8)
# plug-ins: CORE.Toolbox.Grasshopper, Pufferfish, Urbano, Human, ANTflow.Components, MetaHopper, Telepathy

# ---- group: INTERFACE
affective_dimension = ValueList({"acoustic comfort": 6, "thermal comfort": 7, "somatic stress": 8, "social vitality": 9, "territorial safety": 10, "olfactory resonance": 11}, selected="territorial safety")
route_number = Slider(50, range=1..50)
street_selection = Slider(7, range=0..100)
affective_dimension_2 = RemoteSender(affective_dimension)
gemini_run = RemoteSender(Button())
point_cloud = RemoteSender(Toggle(False))
node_selection = RemoteSender(street_selection)
number_of_routes = RemoteSender(route_number)

# ----
x_mid_onscreen = RemoteSender("900")
x_left_onscreen = RemoteSender("500")
x_right_onscreen = RemoteSender("1350")
dam = DataDam(DataA=affective_dimension, BufferDelay=10000000, BufferMode=1)
panel = Panel("consolas")
panel_2 = Panel("poppins")

# ---- group: INPUT
path = FilePath("C:\Users\l03063058\Desktop\Github\DRVaa\Grasshopper\cityModels\SJO_match_large.osm")
panel_5 = Panel(path)

# ----
# URBANO 1
panel_6 = Panel(path)
texttoscreen = RenderTextToScreen(
    Text="DRVA/A",
    Location="50,100",
    Size=Slider(32, range=0..100),
    Color=ColourSwatch(SwatchColor=RGB(255, 255, 255)),
    m_scWithvp=False)
texttoscreen_2 = RenderTextToScreen(
    Text="San Juan de Ocotán, Zapopan, Jalisco México",
    Location="50,120",
    Size=Slider(12, range=0..100),
    Color=ColourSwatch(SwatchColor=RGB(255, 255, 255)),
    m_scWithvp=False)
x_left_onscreen_2 = RemoteReceiver(x_left_onscreen)
number_slider = Slider(18, range=0..100)
panel_7 = Panel("500,820,0")

# ---- group: CSV file with perception data for each street segment (through LLM or participatory design)
path_2 = FilePath("C:\Users\l03063058\Desktop\Github\DRVaa\street_segments_scored_360_rationale.csv")

# ----
concat = Concatenate(FragmentA=x_left_onscreen_2, FragmentB="820", JoinSeparator=", ")
swatch = ColourSwatch(SwatchColor=RGB(255, 255, 255))

# ---- group: green areas
importosm = ImportOSMFeatures(OSMPathOrURL=path, OSMFeatureType="place", Format="xml", ImportAltitude=False)  # -> Points, Metadata, UTMZone, TranslationVector
importosm_2 = ImportOSMFeatures(OSMPathOrURL=path, OSMFeatureType="leisure", Format="xml", ImportAltitude=False)  # -> Points, Metadata, UTMZone, TranslationVector
pline = PolyLine(Vertices=importosm.Points, Closed=invert(False))  # -> flatten(Polyline)
pline_2 = PolyLine(Vertices=importosm_2.Points, Closed=invert(False))  # -> flatten(Polyline)
srf = Surface(pline)
srf_2 = Surface(pline_2)
swatch_2 = ColourSwatch(SwatchColor=RGB(51, 120, 0))
move = Move(Geometry=srf, Motion="0,0,0.5")  # -> Geometry, Transform
move_2 = Move(Geometry=srf_2, Motion="0,0,0.5")  # -> Geometry, Transform
preview = CustomPreview(Geometry=move_2.Geometry, Material=ColourSwatch(SwatchColor=RGBA(156, 196, 0, 50)))

# ----
texttoscreen_3 = RenderTextToScreen(Text="INPUTS", Location=concat, Size=number_slider, Color=swatch, m_scWithvp=False)
crv = Curve([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])
Y = UnitY(Factor=Slider(1995, range=0..10000))
x_mid_onscreen_2 = RemoteReceiver(x_mid_onscreen)
panel_8 = Panel("900,820,200")
move_3 = Move(Geometry=crv, Motion=Y)  # -> Geometry, Transform
concat_2 = Concatenate(FragmentA=x_mid_onscreen_2, FragmentB="820", JoinSeparator=", ")
number_slider_2 = Slider(0.1, range=0..1)
panel_9 = Panel("320,1000")
texttoscreen_4 = RenderTextToScreen(Text="OUTPUTS", Location=concat_2, Size=number_slider, Color=swatch, m_scWithvp=False)
pt = Point(<point referenced from the Rhino model>)
pt_2 = Point(<point referenced from the Rhino model>)
swatch_3 = ColourSwatch(SwatchColor=RGB(255, 255, 255))
area = Area(Geometry=pline_2)  # -> Area, Centroid
crvtoscreen = RenderCurveToScreen(
    Curve=crv,
    Location="320,800",
    ScaleFactor=Slider(0.5, range=0..1),
    Color=swatch_3,
    Thickness=1,
    Depth=".99",
    Fixed=True,
    m_scWithvp=False)
previewlw = CustomPreviewLineweights(Geometry=move_3.Geometry, Shader=swatch_3, Absolute=False)
points = PointList(Points=area.Centroid)
swatch_4 = ColourSwatch(SwatchColor=RGBA(2, 124, 153, 177))
swatch_5 = ColourSwatch(SwatchColor=RGB(38, 137, 117))
swatch_6 = ColourSwatch(SwatchColor=RGB(98, 103, 104))

pt_3 = Point(Point(677.4438233, 2157.713532, 0))
pt_4 = Point(Point(727.555286, 1851.366707, 0))

argb = SplitARGB(Colour=swatch_6, IntegerChannels=True)  # -> Alpha, Red, Green, Blue

# ---- group: Origin vs Destination
pt_5 = Point(pt_3)
pt_6 = Point(pt_4)
dot = AnnotationDot(Location=pt_5, PrimaryText="Origin", TextHeight=Slider(12, range=0..100))  # -> AnnotationDot, Location, PrimaryText, SecondaryText, TextHeight, Font
dots = DotDisplay(Point=[pt_5, pt_6], Colour=ColourSwatch(SwatchColor=RGB(2, 205, 153)), Size=Slider(14, range=0..100))
dot_2 = AnnotationDot(AnnotationDot=dot.AnnotationDot, Location=pt_6, PrimaryText="Destination")  # -> AnnotationDot, Location, PrimaryText, SecondaryText, TextHeight, Font

# ----
rgb = ColourRGB(Alpha="153", Red=argb.Red, Green=argb.Green, Blue=argb.Blue)
number_of_routes_2 = RemoteReceiver(number_of_routes)
x_mid_onscreen_3 = RemoteReceiver(x_mid_onscreen)
x_mid_onscreen_4 = RemoteReceiver(x_mid_onscreen)
concat_3 = Concatenate(FragmentA=x_mid_onscreen_3, FragmentB="880", JoinSeparator=", ")
concat_4 = Concatenate(FragmentA=x_mid_onscreen_4, FragmentB="850", JoinSeparator=", ")
swatch_7 = ColourSwatch(SwatchColor=RGB(255, 0, 80))
affective_dimension_3 = RemoteReceiver(affective_dimension_2)
x_left_onscreen_3 = RemoteReceiver(x_left_onscreen)
x_left_onscreen_4 = RemoteReceiver(x_left_onscreen)
x_left_onscreen_5 = RemoteReceiver(x_left_onscreen)
x_mid_onscreen_5 = RemoteReceiver(x_mid_onscreen)
concat_5 = Concatenate(FragmentA=x_left_onscreen_3, FragmentB="850", JoinSeparator=", ")

panel_10 = Panel("500,850")
concat_6 = Concatenate(FragmentA="Number of routes to explore: ", FragmentB=number_of_routes_2)
texttoscreen_5 = RenderTextToScreen(Text=concat_6, Location=concat_5, Size=12, Color=ColourSwatch(SwatchColor=RGB(255, 255, 255)), m_scWithvp=False)

concat_7 = Concatenate(FragmentA=x_left_onscreen_4, FragmentB="940", JoinSeparator=", ")
concat_8 = Concatenate(FragmentA=x_left_onscreen_5, FragmentB="910", JoinSeparator=", ")

filter = StreamFilter(
    Gate=affective_dimension_3,
    Stream6="Acoustic comfort",
    Stream7="Thermal comfort",
    Stream8="Somatic stress",
    Stream9="Social vitality",
    Stream10="Territorial safety",
    Stream11="Olfactory resonance")
panel_12 = Panel("500,910")
swatch_8 = ColourSwatch(SwatchColor=RGB(255, 255, 255))
texttoscreen_6 = RenderTextToScreen(Text=filter, Location=concat_8, Size=Slider(30, range=0..100), Color=swatch_7, m_scWithvp=False)

concat_9 = Concatenate(FragmentA=x_mid_onscreen_5, FragmentB="910", JoinSeparator=", ")

# ---- group: attach to edges / distance threshold
number_slider_3 = Slider(5, range=0..100)

# ---- group: without scores
system_prompt = Panel("""You are an expert urban psychologist, phenomenologist, and spatial analyst specializing in affective urban mapping and multi-sensory pedestrian navigation. Your role is to interpret sequential street-level data—comprising across six affective dimensions alongside spatial descriptions/rationales—and synthesize them into an evocative, analytical narrative of how the overall space feels to a human walking through it.

The six core affective dimensions evaluated in the data are:
1. Acoustic Comfort: Perceived noise levels, acoustic isolation vs. traffic noise.
2. Thermal Comfort: Perceived shade, microclimate, solar exposure, and heat radiation.
3. Somatic Stress: Physical discomfort caused by narrow sidewalks, high traffic proximity, or visual/spatial clutter.
4. Social Vitality: Street life, pedestrian activity, openness, and civic energy.
5. Territorial Safety: Perceived defensible space, natural surveillance, lighting, and enclosure.
6. Olfactory Resonance: Perceived presence of pleasant natural scents vs. auto exhaust or urban decay.

Guiding Instructions for Synthesis:
- Treat the sequence of input data as a continuous spatial trajectory along a pedestrian route.
- Identify transitions, spikes, sanctuary zones (high comfort / low stress), and friction points (high stress / low comfort).
- Balance qualitative storytelling with observations, grounding psychological reflections in specific environmental cues from the descriptions (e.g., tree canopy coverage, building setbacks, traffic density).
- Structure your output with clear experiential sections that help urban designers and pedestrians understand the psychological atmosphere of the route.""")
user_prompt = Panel("""I have collected sequential street-level data from 360-degree panoramas along a specific urban route that corresponds to a specific atmosphere/dimension. Below is the list of sequential image descriptions with visual rationales corresponding to each segment along the path as well as the give dimension to focus the description on.

Synthesize this data into a very brief comprehensive Affective Route Summary (50 words) detailing how this space feels to a pedestrian walking through it according to the given affective dimension: """)
concat_10 = Concatenate(FragmentA=user_prompt, FragmentB=filter)

# ----
gemini_run_2 = RemoteReceiver(gemini_run)
path_3 = FilePath("C:\Users\l03063058\Desktop\Github\gemini_api.txt")
toggle = BooleanToggle(False)
panel_14 = Panel("qwen2.5vl")
# You are an extra ordinary chef expert in fusion mexican-american food, ready to take orders
panel_15 = Panel("qwen2.5:3b")
toggle_2 = BooleanToggle(True)
# I'd like a Ceviche Nacho Supreme
panel_16 = Panel("qwen3.5:4b")
file = ReadFile(File=path_3, PerLineParse=True)
x_mid_onscreen_6 = RemoteReceiver(x_mid_onscreen)
x_mid_onscreen_7 = RemoteReceiver(x_mid_onscreen)
concat_11 = Concatenate(FragmentA=x_mid_onscreen_6, FragmentB="940", JoinSeparator=", ")
concat_12 = Concatenate(FragmentA=x_mid_onscreen_7, FragmentB="970", JoinSeparator=", ")
x_right_onscreen_2 = RemoteReceiver(x_right_onscreen)

panel_17 = Panel("1350")
panel_18 = Panel("500")

panel_19 = Panel("1050")
panel_20 = Panel("700")

concat_13 = Concatenate(FragmentA="500", FragmentB="700", JoinSeparator=", ")
directory = Panel("C:\Users\l03063058\Desktop\Github\DRVaa\streetview_panoramas_360\")
point_cloud_2 = RemoteReceiver(point_cloud)
onoff = EnableDisableObject(Enabled=point_cloud_2, AllObjects_Object=cylinder)
x_right_onscreen_3 = RemoteReceiver(x_right_onscreen)
x_right_onscreen_4 = RemoteReceiver(x_right_onscreen)
concat_14 = Concatenate(FragmentA=x_right_onscreen_4, FragmentB="850", JoinSeparator=", ")
texttoscreen_7 = RenderTextToScreen(
    Text="Chromatic spectrum of 360 image (organized by HSV)",
    Location=concat_14,
    Size=12,
    Color=ColourSwatch(SwatchColor=RGB(255, 255, 9)),
    m_scWithvp=False)
x_right_onscreen_5 = RemoteReceiver(x_right_onscreen)
panel_21 = Panel("1300,670")
concat_15 = Concatenate(FragmentA=x_right_onscreen_5, FragmentB="670", JoinSeparator=", ")
texttoscreen_8 = RenderTextToScreen(
    Text="360 image at selected segment",
    Location=concat_15,
    Size=12,
    Color=ColourSwatch(SwatchColor=RGB(255, 255, 9)),
    m_scWithvp=False)

importosm_3 = ImportOSMFeatures(OSMPathOrURL=path, OSMFeatureType="building", Format="xml", ImportAltitude=False)  # -> Points, Metadata, UTMZone, TranslationVector
importosm_4 = ImportOSMFeatures(OSMPathOrURL=path, OSMFeatureType="street", Format="xml", ImportAltitude=False)  # -> Points, Metadata, UTMZone, TranslationVector
importosm_5 = ImportOSMFeatures(OSMPathOrURL=path, OSMFeatureType="amenity", Format="xml", ImportAltitude=False)  # -> Points, Metadata, UTMZone, TranslationVector
pline_3 = PolyLine(Vertices=importosm_4.Points, Closed=False)
pline_4 = PolyLine(Vertices=importosm_3.Points, Closed=invert(False))
amen = CreateAmenity(PointLocationOfAmenity=importosm_5.Points, Metadata=importosm_5.Metadata)
streetnet = CreateStreetNetwork(
    StreetCurves=flatten(pline_3),
    Metadata=flatten(importosm_4.Metadata),
    SplitStreetCurves=True,
    UTMZone=importosm_4.UTMZone,
    TranslationVector=importosm_4.TranslationVector)  # -> StreetNetwork, StreetSegmentCurves, UTMZone, TranslationVector

clean = CleanTree(RemoveNulls=True, RemoveInvalid=True, RemoveEmpty=invert(False), Tree=pline_4)

bldg = CreateBuilding(BuildingCurve=clean, Metadata=importosm_3.Metadata, AmenitiesInBuilding=amen)
model = BuildUrbanoModel(Buildings=flatten(bldg), StreetNetwork=streetnet.StreetNetwork, BuildToggle=True)  # -> UrbanoModel, BuildingCurves, Activities
inbldg = InspectBuilding(Building=bldg, UrbanoModel=model.UrbanoModel, DefaultHeight=10)  # -> Geometry, Metadata, Amenity, flatten(BuildingMesh)

crvtoscreen_2 = RenderCurveToScreen(
    Curve=streetnet.StreetSegmentCurves,
    Location="50,900",
    ScaleFactor=number_slider_2,
    Color=ColourSwatch(SwatchColor=RGB(255, 255, 255)),
    Thickness=1,
    Depth=".99",
    Fixed=True,
    m_scWithvp=False)

# ---- group: RESULTADOS / Huellas de edificios
crv_2 = Curve(inbldg.Geometry)

# ---- group: RESULTADOS / Volumetrías
geo = Geometry(inbldg.BuildingMesh)

# ---- group: Generate buildings
swatch_9 = ColourSwatch(SwatchColor=RGBA(2, 124, 153, 177))
swatch_10 = ColourSwatch(SwatchColor=RGBA(100, 103, 102, 159))
preview_2 = CustomPreview(Geometry=geo, Material=rgb)

# ---- group: RESULTADOS / Red de calles
crv_3 = Curve(streetnet.StreetSegmentCurves)

# ---- group: Generate streets
swatch_11 = ColourSwatch(SwatchColor=RGB(0, 74, 117))
previewlw_2 = CustomPreviewLineweights(Geometry=crv_3, Shader=swatch_6, Absolute=False)

# ----
splitstr = SplitStreetCurves(SplitStreetCurves=flatten(crv_3), IntersectionTolerance=1e-12)  # -> ProcessedStreetCurves, Metadata

# ---- group: Street names
lookup = LookupMetadata(MetadataGeometry=flatten(importosm_4.Metadata), SearchKey="name")
hframe = HorizontalFrame(Curve=reparameterize(splitstr.ProcessedStreetCurves), Parameter=Slider(0.5, range=0..1))
tag = TextTag3D(
    Location=hframe,
    Text=lookup,
    Size=Slider(4, range=0..10),
    Colour=ColourSwatch(SwatchColor=RGB(0, 0, 0)),
    Justification=7)

# ----
panel_22 = Panel(lookup)
lng = ListLength(List=splitstr.ProcessedStreetCurves)
number_of_segments = Panel(lng)

# ---- group: attach to edges / insert street segments
crv_4 = Curve(streetnet.StreetSegmentCurves)

# ----
# LLM Walkability Perception
panel_23 = Panel(path_2)
path_4 = FilePath("C:\Users\l03063058\Desktop\Github\DRVaa\SHPs\streets_scored_SJO_large\street_scored.shp")
panel_24 = Panel(path_4)

# ---- group: CSV to SHP v003
py3 = Python3Script(csv_file=path_2, shp_file_path=path_4)  # -> GeoDataFrame, shp_file
#   port csv_file: CSV file with perception data (machine or human) for each street segment. File should include columns named latitude and longitude so it can georeference each street segment and convert to SHP file.
#   port shp_file_path: Select file path where SHP file will be saved.
# ---------- py3: Python ----------
#! python3
#r: pandas, geopandas

import pandas as pd
import geopandas as gpd
from shapely.geometry import Point

# Read CSV file
df = pd.read_csv(csv_file)


# Make sure CSV file has columns for latitud and longitud
# if 'latitude' not in df.columns or 'longitude' not in df.columns:
    # raise ValueError("CSV file must have 'latitude' and 'longitude' columns")
    

# Create point geometry based on coordinates
geometry = [Point(xy) for xy in zip(df['longitude'], df['latitude'])]
gdf = gpd.GeoDataFrame(df, geometry=geometry)

# Establish reference system (CRS), WGS84 for example
gdf.set_crs(epsg=4326, inplace=True)

# Display dataframe
GeoDataFrame = gdf

# Save as Shapefile
gdf.to_file(shp_file_path)

shp_file = shp_file_path

# print(GeoDataFrame.crs)
# ---------- end py3 ----------

# ----
panel_25 = Panel(py3.GeoDataFrame)

# ---- group: SHP to GeoDataframe
py3_2 = Python3Script(SHP=py3.shp_file)  # -> GeoDataFrame
# ---------- py3_2: Python ----------
#! python3
#r: geopandas


#THIS IS NECESSARY TO LOAD PANDAS otherwise it bugs
import locale
locale.setlocale(locale.LC_ALL, 'en_US')

import geopandas as gpd

GeoDataFrame = gpd.read_file(SHP)
# ---------- end py3_2 ----------

# ---- group: Dataframe Details
py3_3 = Python3Script(dataFrame=py3_2)  # -> info, column_name, head_x10, tail_x10, shape, number_of_null_values
# ---------- py3_3: Python ----------
info = dataFrame.info

head_x10 = dataFrame.head(10)
tail_x10 = dataFrame.tail(10)
shape = dataFrame.shape

#Add up all null values
number_of_null_values = dataFrame.isnull().sum()



# columns = dataFrame.columns
# Get the columns as a list
column_name = dataFrame.columns.tolist()

# Output the list
# print(column_name)
# ---------- end py3_3 ----------

# ----
panel_26 = Panel(py3_3.column_name)

# ----
# Perception (9s)
bounding_box = Relay()

panel_27 = Panel(py3_3.head_x10)
importshp = ImportShapefileFeatures(
    ShapefilePath=py3.shp_file,
    Reproject=False,
    UTMZone=streetnet.UTMZone,
    TranslationVector=streetnet.TranslationVector,
    CroppingGeometry=bounding_box)  # -> simplify(flatten(Points)), Metadata, UTMZone, TranslationVector
demeta = DeconstructMetadata(Metadata=importshp.Metadata)  # -> Keys, Values
panel_29 = Panel(demeta.Values)
panel_30 = Panel(demeta.Keys)

panel_31 = Panel(importshp.Points)

# ----
# FILTERING
item = ListItem(List=py3_3.column_name, Index=affective_dimension_3, Wrap=True)
lookup_2 = LookupMetadata(MetadataGeometry=importshp.Metadata, SearchKey=item)
pt_7 = Point(flatten(importshp.Points))

bnd = Bounds(Numbers=lookup_2)
dedomain = DeconstructDomain(Domain=bnd)  # -> Start, End
panel_32 = Panel(dedomain.Start)
panel_33 = Panel(dedomain.End)

dots_2 = DotDisplay(Point=pt_7, Colour=ColourSwatch(SwatchColor=RGB(238, 95, 131)), Size=Slider(5, range=0..20))
dup_pts = CleanDuplicatePoints(Points=pt_7, Tolerance=0.01)  # -> Points, Indices, Status
dispatch = Dispatch(List=lookup_2, DispatchPattern=dup_pts.Status)  # -> ListA, ListB
panel_34 = Panel(dispatch.ListA)

points_2 = PointList(Points=pt_7, Size=Slider(6, range=0..10))

# ---- group: raw
tag_2 = TextTag(Location=pt_7, Text=lookup_2)

# ---- group: eliminated duplicates
tag_3 = TextTag(Location=flatten(dup_pts.Points), Text=dispatch.ListA, Colour=ColourSwatch(SwatchColor=RGB(0, 0, 0)))

# ---- group: attach to edges / Insert points
pt_8 = Point(dup_pts.Points)

# ----
num = Number(dispatch.ListA)

# ---- group: Select cylinder / Node selection
item_2 = ListItem(List=py3_3.column_name, Index=Slider(5, range=0..42), Wrap=True)
lookup_3 = LookupMetadata(MetadataGeometry=importshp.Metadata, SearchKey=item_2)
dispatch_2 = Dispatch(List=lookup_3, DispatchPattern=dup_pts.Status)  # -> ListA, ListB

# ---- group: Olfactory
number_slider_4 = Slider(11, range=0..42)  # disabled
item_3 = ListItem(List=py3_3.column_name, Index=number_slider_4, Wrap=True)  # disabled
lookup_4 = LookupMetadata(MetadataGeometry=importshp.Metadata, SearchKey=item_3)  # disabled
dispatch_3 = Dispatch(List=lookup_4, DispatchPattern=dup_pts.Status)  # -> ListA, ListB; disabled

# ---- group: Social
number_slider_5 = Slider(9, range=0..42)  # disabled
item_4 = ListItem(List=py3_3.column_name, Index=number_slider_5, Wrap=True)  # disabled
lookup_5 = LookupMetadata(MetadataGeometry=importshp.Metadata, SearchKey=item_4)  # disabled
dispatch_4 = Dispatch(List=lookup_5, DispatchPattern=dup_pts.Status)  # -> ListA, ListB; disabled

# ---- group: Safety
number_slider_6 = Slider(10, range=0..42)  # disabled
item_5 = ListItem(List=py3_3.column_name, Index=number_slider_6, Wrap=True)  # disabled
lookup_6 = LookupMetadata(MetadataGeometry=importshp.Metadata, SearchKey=item_5)  # disabled
dispatch_5 = Dispatch(List=lookup_6, DispatchPattern=dup_pts.Status)  # -> ListA, ListB; disabled

# ---- group: Thermal
number_slider_7 = Slider(7, range=0..42)  # disabled
item_6 = ListItem(List=py3_3.column_name, Index=number_slider_7, Wrap=True)  # disabled
lookup_7 = LookupMetadata(MetadataGeometry=importshp.Metadata, SearchKey=item_6)  # disabled
dispatch_6 = Dispatch(List=lookup_7, DispatchPattern=dup_pts.Status)  # -> ListA, ListB; disabled

# ---- group: Acoustic
number_slider_8 = Slider(6, range=0..42)  # disabled
item_7 = ListItem(List=py3_3.column_name, Index=number_slider_8, Wrap=True)  # disabled
lookup_8 = LookupMetadata(MetadataGeometry=importshp.Metadata, SearchKey=item_7)  # disabled
dispatch_7 = Dispatch(List=lookup_8, DispatchPattern=dup_pts.Status)  # -> ListA, ListB; disabled

# ---- group: Fastest route
number_slider_9 = Slider(0, range=0..10)
swatch_12 = ColourSwatch(SwatchColor=RGB(0, 255, 0))

# ---- group: New router gets more than one optimal route
n_shortest_routes = Python3Script(Lines=splitstr.ProcessedStreetCurves, StartPt=pt_5, EndPt=pt_6, Penalty="10.0", K=number_of_routes_2)  # -> out, Routes, RouteIndices; inputs Lines: list of Curve, StartPt: Point3d, EndPt: Point3d, Penalty: Double, K: Int32
#   port Lines: Lines to convert to network.
#   port StartPt: Origin point.
#   port EndPt: Destination point.
#   port Penalty: Edge penalization to control how drastically the routes are forced to diverge. This, at the same time, forces the algorithm to give distinctive, alternative routes. A good starting point is 10.0
#   port K: Number of routes to be generated.
#   port Routes: Generated n routes.
#   port RouteIndices: Indices for line segments within routes.
# ---------- n_shortest_routes: Python ----------
#! python 3
# r: networkx

import rhinoscriptsyntax as rs
import Rhino.Geometry as rg
import networkx as nx

# NEW: Import Grasshopper's native Data Tree modules
import Grasshopper
from Grasshopper.Kernel.Data import GH_Path
import System

def get_distinct_paths_with_indices(curves, start_pt, end_pt, k, penalty_factor):
    if isinstance(curves, rg.Curve):
        curves = [curves]
        
    G = nx.Graph()
    
    def pt_to_key(pt):
        return (round(pt.X, 3), round(pt.Y, 3), round(pt.Z, 3))
        
    edge_geometries = {}
    edge_indices = {} 
    
    print("1. Building graph...")
    for original_idx, crv in enumerate(curves):
        if not crv: continue
        
        segments_to_process = []
        if crv.IsPolyline():
            success, polyline = crv.TryGetPolyline()
            if success:
                for seg in polyline.GetSegments():
                    segments_to_process.append(rg.LineCurve(seg))
        else:
            segments_to_process.append(crv)
            
        for seg_crv in segments_to_process:
            p1 = seg_crv.PointAtStart
            p2 = seg_crv.PointAtEnd
            
            k1 = pt_to_key(p1)
            k2 = pt_to_key(p2)
            
            length = seg_crv.GetLength()
            
            G.add_edge(k1, k2, weight=length)
            
            edge_geometries[(k1, k2)] = seg_crv
            edge_geometries[(k2, k1)] = seg_crv 
            edge_indices[(k1, k2)] = original_idx
            edge_indices[(k2, k1)] = original_idx
            
    if len(G.nodes) == 0:
        print("Error: No valid lines were provided.")
        return [], []

    def find_closest_node(graph, target_pt):
        closest_node = None
        min_dist = float('inf')
        for node in graph.nodes:
            node_pt = rg.Point3d(node[0], node[1], node[2])
            dist = target_pt.DistanceTo(node_pt)
            if dist < min_dist:
                min_dist = dist
                closest_node = node
        return closest_node

    start_key = find_closest_node(G, start_pt)
    end_key = find_closest_node(G, end_pt)
    
    k_paths_curves = []
    k_paths_indices = [] 
    
    print("2. Calculating distinctly penalized paths...")
    for i in range(k):
        try:
            path = nx.shortest_path(G, source=start_key, target=end_key, weight='weight')
            
            path_curves = []
            raw_path_indices = []
            
            for j in range(len(path) - 1):
                node_a = path[j]
                node_b = path[j+1]
                
                path_curves.append(edge_geometries[(node_a, node_b)])
                raw_path_indices.append(edge_indices[(node_a, node_b)])
                
                current_weight = G[node_a][node_b]['weight']
                G[node_a][node_b]['weight'] = current_weight * penalty_factor
                
            joined_curves = rg.Curve.JoinCurves(path_curves)
            if joined_curves:
                k_paths_curves.append(joined_curves[0])
                
                clean_indices = []
                for idx in raw_path_indices:
                    if not clean_indices or clean_indices[-1] != idx:
                        clean_indices.append(idx)
                
                k_paths_indices.append(clean_indices)
                
        except nx.NetworkXNoPath:
            print(f"Stopped early at {i} routes: No more valid alternative paths exist.")
            break
        except Exception as e:
            print("An error occurred: " + str(e))
            break
            
    print(f"Success: Found {len(k_paths_curves)} distinct routes.")
    
    # NEW: Convert the nested Python list into a strict Grasshopper Data Tree
    gh_tree = Grasshopper.DataTree[System.Object]()
    for branch_index, indices_list in enumerate(k_paths_indices):
        path = GH_Path(branch_index)
        for index_val in indices_list:
            gh_tree.Add(index_val, path)
            
    return k_paths_curves, gh_tree

if Lines and StartPt and EndPt and K and Penalty:
    Routes, RouteIndices = get_distinct_paths_with_indices(Lines, StartPt, EndPt, K, Penalty)
# ---------- end n_shortest_routes ----------

# ---- group: Fastest route (continued)
branch = BranchByIndex(Tree=n_shortest_routes.RouteIndices, Branch=number_slider_9)
item_8 = ListItem(List=n_shortest_routes.Routes, Index=0, Wrap=True)
item_9 = ListItem(List=crv_3, Index=branch, Wrap=True)
len = Length(Curve=item_8)
path_distance = Panel(len)
previewlw_3 = CustomPreviewLineweights(Geometry=item_9, Shader=swatch_12, Thickness=Slider(3, range=0..10), Absolute=False)

# ----
lng_2 = ListLength(List=n_shortest_routes.Routes)
index = ItemIndex(List=n_shortest_routes.Routes, Item=n_shortest_routes.Routes)
gradient = Gradient(
    LowerLimit=0,
    UpperLimit=lng_2,
    Parameter=index,
    stops=[0: RGB(243, 57, 0), 0.1: RGB(236, 27, 60), 0.2: RGB(210, 0, 118), 0.3: RGB(103, 0, 120), 0.4: RGB(39, 72, 161), 0.5: RGB(1, 192, 229), 0.6: RGB(18, 178, 90), 0.7: RGB(79, 186, 8), 0.8: RGB(220, 237, 32), 0.9: RGB(247, 159, 20), 1: RGB(243, 57, 0)])
int = Integer(path_distance)
len_2 = Length(Curve=n_shortest_routes.Routes)
concat_16 = Concatenate(FragmentA="Shortest route: ", FragmentB=int, FragmentC="m")

panel_35 = Panel("900,850")
texttoscreen_9 = RenderTextToScreen(Text=concat_16, Location=concat_4, Size=12, Color=swatch_12, m_scWithvp=False)

panel_36 = Panel(len_2)
panel_37 = Panel(gradient)
previewlw_4 = CustomPreviewLineweights(Geometry=n_shortest_routes.Routes, Shader=gradient, Thickness="7", Absolute=False)

number_slider_10 = Slider(2, range=0..10)
crvtoscreen_3 = RenderCurveToScreen(
    Curve=item_9,
    Location="50,900",
    ScaleFactor=number_slider_2,
    Color=swatch_12,
    Thickness=number_slider_10,
    Depth="0.99",
    Fixed=True,
    m_scWithvp=False)

panel_38 = Panel("900,880")

swatch_13 = ColourSwatch(SwatchColor=RGB(255, 255, 255))
panel_39 = Panel("500,940")

panel_41 = Panel("900,910")

# ---- group: attach to edges
midpt = CurveMiddle(Curve=crv_4)
pull = PullPoint(Point=pt_8, Geometry=graft(midpt), ClosestOnly=True)  # -> ClosestPoint, Distance, Index
avr = Average(Input=num)
number_slider_11 = Slider(9, range=0..10)
panel_43 = Panel(avr)
smaller = SmallerThan(FirstNumber=pull.Distance, SecondNumber=number_slider_3)  # -> SmallerThan, OrEqualTo
dispatch_8 = Dispatch(List=pull.ClosestPoint, DispatchPattern=smaller.SmallerThan)  # -> ListA, ListB
dispatch_9 = Dispatch(List=dispatch.ListA, DispatchPattern=smaller.SmallerThan)  # -> ListA, ListB
pt_9 = Point(dispatch_8.ListA)
points_3 = PointList(Points=flatten(pt_9), Size=number_slider_11)
panel_44 = Panel(pt_9)

# ---- group: attach to edges / check index
points_4 = PointList(Points=flatten(midpt), Size=number_slider_11)

# ---- group: attach to edges / Output: reordered data
data = Data(dispatch_9.ListA)

# ---- group: Olfactory / Select cylinder
dispatch_10 = Dispatch(List=dispatch_3.ListA, DispatchPattern=smaller.SmallerThan)  # -> ListA, ListB; disabled
item_10 = ListItem(List=dispatch_10.ListA, Index=0, Wrap=True)  # disabled
panel_45 = Panel("0")  # disabled
nullrep = ReplaceNulls(Items=item_10, Replacements=panel_45)  # -> flatten(Items), Count; disabled
item_11 = ListItem(List=nullrep.Items, Index=n_shortest_routes.RouteIndices, Wrap=True)  # disabled

# ---- group: Social / Select cylinder
dispatch_11 = Dispatch(List=dispatch_4.ListA, DispatchPattern=smaller.SmallerThan)  # -> ListA, ListB; disabled
item_12 = ListItem(List=dispatch_11.ListA, Index=0, Wrap=True)  # disabled
panel_46 = Panel("0")  # disabled
nullrep_2 = ReplaceNulls(Items=item_12, Replacements=panel_46)  # -> flatten(Items), Count; disabled
item_13 = ListItem(List=nullrep_2.Items, Index=n_shortest_routes.RouteIndices, Wrap=True)  # disabled

# ---- group: Safety / Select cylinder
dispatch_12 = Dispatch(List=dispatch_5.ListA, DispatchPattern=smaller.SmallerThan)  # -> ListA, ListB; disabled
item_14 = ListItem(List=dispatch_12.ListA, Index=0, Wrap=True)  # disabled
panel_47 = Panel("0")  # disabled
nullrep_3 = ReplaceNulls(Items=item_14, Replacements=panel_47)  # -> flatten(Items), Count; disabled
item_15 = ListItem(List=nullrep_3.Items, Index=n_shortest_routes.RouteIndices, Wrap=True)  # disabled

# ---- group: Thermal / Select cylinder
dispatch_13 = Dispatch(List=dispatch_6.ListA, DispatchPattern=smaller.SmallerThan)  # -> ListA, ListB; disabled
item_16 = ListItem(List=dispatch_13.ListA, Index=0, Wrap=True)  # disabled
panel_48 = Panel("0")  # disabled
nullrep_4 = ReplaceNulls(Items=item_16, Replacements=panel_48)  # -> flatten(Items), Count; disabled
item_17 = ListItem(List=nullrep_4.Items, Index=n_shortest_routes.RouteIndices, Wrap=True)  # disabled

# ---- group: Acoustic / Select cylinder
dispatch_14 = Dispatch(List=dispatch_7.ListA, DispatchPattern=smaller.SmallerThan)  # -> ListA, ListB; disabled
item_18 = ListItem(List=dispatch_14.ListA, Index=0, Wrap=True)  # disabled
panel_49 = Panel("0")  # disabled
nullrep_5 = ReplaceNulls(Items=item_18, Replacements=panel_49)  # -> flatten(Items), Count; disabled
item_19 = ListItem(List=nullrep_5.Items, Index=n_shortest_routes.RouteIndices, Wrap=True)  # disabled

# ----
panel_50 = Panel(item_11)  # disabled
panel_51 = Panel(item_13)  # disabled
panel_52 = Panel(item_15)  # disabled
panel_53 = Panel(item_17)  # disabled
panel_54 = Panel(item_19)

# ---- group: Column Values 001
py3_4 = Python3Script(dataFrame=py3.GeoDataFrame, column_name="rationale")  # -> columnValues
# ---------- py3_4: Python ----------
columnValues = dataFrame[column_name].tolist()
# ---------- end py3_4 ----------

# ----
panel_55 = Panel(py3_4)
viewer = ParamViewer(py3_4)

# ---- group: Rationale
dispatch_15 = Dispatch(List=py3_4, DispatchPattern=dup_pts.Status)  # -> ListA, ListB

# ---- group: Rationale / Select cylinder
dispatch_16 = Dispatch(List=dispatch_15.ListA, DispatchPattern=smaller.SmallerThan)  # -> ListA, ListB
item_20 = ListItem(List=dispatch_16.ListA, Index=0, Wrap=True)
nullrep_6 = ReplaceNulls(Items=item_20, Replacements="0")  # -> flatten(Items), Count
item_21 = ListItem(List=nullrep_6.Items, Index=n_shortest_routes.RouteIndices, Wrap=True)

# ----
viewer_2 = ParamViewer(nullrep_6.Items)

# ---- group: attach to edges (continued)
item_22 = ListItem(List=data, Index=0, Wrap=True)
panel_56 = Panel(item_22)
bnd_2 = Bounds(Numbers=flatten(item_22))
nullrep_7 = ReplaceNulls(Items=item_22, Replacements="0")  # -> flatten(Items), Count
dedomain_2 = DeconstructDomain(Domain=bnd_2)  # -> Start, End

# ----
conditional_remap = Python3Script(selection=item, values=nullrep_7.Items, conditional="stress")  # -> remapped_values; inputs selection: String, values: list of Double, conditional: String
# ---------- conditional_remap: Python ----------
"""
Grasshopper Python Script: Conditional Remap for Somatic Stress
Inputs:
    values: List of floats (List Access)
    selection: String from Value List (Item Access)
    conditional: String search term (Item Access)
Outputs:
    remapped_values: Processed values
"""

def to_python_float(val):
    """Safely unwrap GH_Goo / .NET managed objects and convert to float."""
    if val is None:
        return None
    # Extract underlying C# value if wrapped in GH_Number or GH_ObjectWrapper
    if hasattr(val, "Value"):
        val = val.Value
    try:
        return float(val)
    except (ValueError, TypeError):
        return None

# Default initialization to prevent output binding errors
remapped_values = []

if values is not None and selection is not None:
    # Handle single scalar inputs gracefully
    if not isinstance(values, (list, tuple)):
        values = [values]

    # Unwrap string inputs safely
    cond_raw = conditional if 'conditional' in globals() and conditional is not None else ""
    cond_str = str(cond_raw.Value if hasattr(cond_raw, "Value") else cond_raw).lower()
    sel_raw = selection
    sel_str = str(sel_raw.Value if hasattr(sel_raw, "Value") else sel_raw).lower()

    # Check if condition is met
    is_true = cond_str in sel_str if cond_str else True

    if is_true:
        remapped = []
        for v in values:
            num = to_python_float(v)
            if num is not None and num > 0:
                remapped.append(100.0 - num)
            else:
                remapped.append(0.0)
        remapped_values = remapped
    else:
        # Return original values as Python floats
        remapped_values = [to_python_float(v) for v in values]
# ---------- end conditional_remap ----------

# ---- group: Check individual segments
item_23 = ListItem(List=conditional_remap, Index="126", Wrap=True)
item_24 = ListItem(List=crv_4, Index="126", Wrap=True)
panel_57 = Panel(item_24)
panel_58 = Panel(item_23)

# ---- group: attach to edges (continued)
gradient_2 = Gradient(
    LowerLimit=Slider(100, range=0..100),
    UpperLimit=Slider(0, range=0..100),
    Parameter=conditional_remap,
    stops=[0: RGB(27, 117, 166), 0.125: RGB(0, 163, 191), 0.25: RGB(0, 201, 188), 0.375: RGB(135, 237, 161), 0.5: RGB(224, 224, 45), 0.625: RGB(250, 208, 82), 0.75: RGB(250, 160, 50), 0.875: RGB(232, 111, 30), 1: RGB(191, 40, 23)])
col = Colour(gradient_2)
panel_59 = Panel(col)
previewlw_5 = CustomPreviewLineweights(Geometry=crv_4, Shader=col, Thickness=Slider(3, range=0..10), Absolute=False)

# ---- group: attach to edges / matched & filtered
tag_4 = TextTag(Location=midpt, Text=flatten(conditional_remap))

# ----
panel_60 = Panel(conditional_remap)

# ---- group: Select cylinder
dispatch_17 = Dispatch(List=dispatch_2.ListA, DispatchPattern=smaller.SmallerThan)  # -> ListA, ListB
item_25 = ListItem(List=dispatch_17.ListA, Index=0, Wrap=True)
nullrep_8 = ReplaceNulls(Items=item_25, Replacements="No image")  # -> flatten(Items), Count
node_selection_2 = RemoteReceiver(node_selection)
item_26 = ListItem(List=nullrep_8.Items, Index=n_shortest_routes.RouteIndices, Wrap=True)

# ----
concat_17 = Concatenate(FragmentA="Selected segment: ", FragmentB=node_selection_2)

# ---- group: perception scores
item_27 = ListItem(List=conditional_remap, Index=n_shortest_routes.RouteIndices, Wrap=True)
num_2 = Number(item_27)
avr_2 = Average(Input=num_2)  # -> flatten(ArithmeticMean)
listdexs = ListIndices(List=avr_2)
panel_62 = Panel(avr_2)
sort = SortList(Keys=avr_2, ValuesA=listdexs)  # -> reverse(Keys), reverse(ValuesA)
panel_63 = Panel(sort.ValuesA)
panel_64 = Panel(sort.Keys)

# ----
branch_2 = BranchByIndex(Tree=item_27, Branch=number_slider_9)
int_2 = Integer(branch_2)
avr_3 = Average(Input=int_2)
int_3 = Integer(avr_3)
concat_18 = Concatenate(FragmentA="Average affective score: ", FragmentB=int_3)

texttoscreen_10 = RenderTextToScreen(Text=concat_18, Location=concat_3, Size=12, Color=swatch_12, m_scWithvp=False)

panel_65 = Panel(item_27)

# ---- group: perception scores / selected affect route
item_28 = ListItem(List=sort.ValuesA, Index=0, Wrap=True)

# ---- group: New router gets more than one optimal route (continued)
item_29 = ListItem(List=n_shortest_routes.Routes, Index=item_28, Wrap=invert(True))

# ----
previewlw_6 = CustomPreviewLineweights(Geometry=item_29, Shader=swatch_7, Thickness="7", Absolute=False)
len_3 = Length(Curve=item_29)
path_distance_2 = Panel(len_3)

# ---- group: Color selected path and cylinder
item_30 = ListItem(List=gradient, Index=item_28, Wrap=True)
argb_2 = SplitARGB(Colour=item_30, IntegerChannels=True)  # -> Alpha, Red, Green, Blue
rgb_2 = ColourRGB(Alpha=Slider(124, range=0..255), Red=argb_2.Red, Green=argb_2.Green, Blue=argb_2.Blue)

# ----
int_4 = Integer(path_distance_2)
concat_19 = Concatenate(FragmentA="Sensorial route: ", FragmentB=int_4, FragmentC="m")
crvtoscreen_4 = RenderCurveToScreen(
    Curve=item_29,
    Location="50,900",
    ScaleFactor=number_slider_2,
    Color=swatch_7,
    Thickness=number_slider_10,
    Depth="0.99",
    Fixed=True,
    m_scWithvp=False)

texttoscreen_11 = RenderTextToScreen(Text=concat_19, Location=concat_9, Size=12, Color=swatch_7, m_scWithvp=False)

# ---- group: Select cylinder (continued)
branch_3 = BranchByIndex(Tree=item_26, Branch=item_28)
item_31 = ListItem(List=branch_3, Index=node_selection_2, Wrap=invert(True))

# ----
branch_4 = BranchByIndex(Tree=item_21, Branch=item_28)
panel_66 = Panel(branch_4)
data_trees_to_json = DataTreesToJSON(Keys_tree=simplify(item_28), Values_tree=simplify(branch_4))  # -> Status, JSONPath

# ---- group: perception scores (continued)
branch_5 = BranchByIndex(Tree=item_27, Branch=item_28)
int_5 = Integer(branch_5)
avr_4 = Average(Input=int_5)
int_6 = Integer(avr_4)
panel_67 = Panel(branch_5)
concat_20 = Concatenate(FragmentA="Average affective score: ", FragmentB=int_6)

# ---- group: Pulse curve
branch_6 = BranchByIndex(Tree=n_shortest_routes.RouteIndices, Branch=item_28)
dom = ConstructDomain(DomainStart=0, DomainEnd=Slider(50, range=0..100))
remap = RemapNumbers(Value=branch_5, Source="0 to 100", Target=dom)  # -> Mapped, Clipped
item_32 = ListItem(List=crv_4, Index=branch_6, Wrap=True)
Z = UnitZ(Factor=remap.Mapped)
midpt_2 = CurveMiddle(Curve=item_32)
move_4 = Move(Geometry=midpt_2, Motion=Z)  # -> Geometry, Transform
swatch_14 = ColourSwatch(SwatchColor=RGB(255, 255, 0))
pline_5 = PolyLine(Vertices=move_4.Geometry, Closed=False)
previewlw_7 = CustomPreviewLineweights(Geometry=pline_5, Shader=swatch_14, Thickness=Slider(1, range=0..10), Absolute=False)

# ----
texttoscreen_12 = RenderTextToScreen(Text=concat_17, Location=concat_7, Size=12, Color=swatch_14, m_scWithvp=False)

gemini = LLMGemini(
    Api=file,
    Model="gemini-3.8-flash",
    System_prompt=system_prompt,
    User_prompt=concat_10,
    Json_input=data_trees_to_json.JSONPath,
    Run=gemini_run_2)  # -> Status, Json_file, Response
ollama = Python3Script(
    model=panel_15,
    system_prompt=system_prompt,
    user_prompt=concat_10,
    json_input=data_trees_to_json.JSONPath,
    clear=Button(),
    run=Button())  # -> status, response; inputs model: String, system_prompt: String, user_prompt: String, json_input: String, clear: Boolean, run: Boolean
# ---------- ollama: Python ----------
# r: requests
import json
import requests
import threading
import Grasshopper as gh
import scriptcontext as sc

# Access built-in Grasshopper Environment properties directly
component = ghenv.Component
doc = component.OnPingDocument()
GUID = str(component.InstanceGuid)

# Generate unique sticky keys per component instance
KEY_HISTORY = f"ollama_history_{GUID}"
KEY_RESPONSE = f"ollama_response_{GUID}"
KEY_STATUS = f"ollama_status_{GUID}"
KEY_BUSY = f"ollama_busy_{GUID}"
KEY_LAST_INPUT = f"ollama_last_input_{GUID}"
KEY_LAST_RUN = f"ollama_last_run_{GUID}"

# Initialize persistent memory slots
if KEY_HISTORY not in sc.sticky:
    sc.sticky[KEY_HISTORY] = []
if KEY_RESPONSE not in sc.sticky:
    sc.sticky[KEY_RESPONSE] = ""
if KEY_STATUS not in sc.sticky:
    sc.sticky[KEY_STATUS] = "Ready."
if KEY_BUSY not in sc.sticky:
    sc.sticky[KEY_BUSY] = False
if KEY_LAST_INPUT not in sc.sticky:
    sc.sticky[KEY_LAST_INPUT] = None
if KEY_LAST_RUN not in sc.sticky:
    sc.sticky[KEY_LAST_RUN] = False

# Read inputs safely
model_name = globals().get('model', 'qwen2.5:3b')
sys_prompt = globals().get('system_prompt', '')
u_prompt = globals().get('user_prompt', '')
json_data = globals().get('json_input', '')
run_trigger = globals().get('run', False)      # Connect a Button OR a Boolean Toggle
clear_trigger = globals().get('clear', False)  # Connect a Button OR a Boolean Toggle

# Snapshot current text/data inputs
current_inputs = {
    'model': str(model_name).strip(),
    'sys': str(sys_prompt).strip(),
    'user': str(u_prompt).strip(),
    'json': str(json_data).strip()
}

# Handle Clear Memory & Output Request
if clear_trigger:
    sc.sticky[KEY_HISTORY] = []
    sc.sticky[KEY_RESPONSE] = ""
    sc.sticky[KEY_STATUS] = "Memory and output cleared."
    sc.sticky[KEY_BUSY] = False
    sc.sticky[KEY_LAST_INPUT] = None
    sc.sticky[KEY_LAST_RUN] = False

# Retrieve state tracking from previous solution cycle
last_inputs = sc.sticky.get(KEY_LAST_INPUT, None)
last_run = sc.sticky.get(KEY_LAST_RUN, False)

# Detect state changes
inputs_changed = (last_inputs is not None) and (current_inputs != last_inputs)
run_just_activated = bool(run_trigger) and not last_run  # Button pressed or Toggle flipped OFF -> ON

# Asynchronous Background Worker
def run_ollama_async(model, system_p, user_p, json_p, history_copy):
    try:
        combined_content = user_p.strip() if user_p else ""
        if json_p and json_p.strip():
            combined_content += f"\n\n### Input JSON Data:\n{json_p.strip()}"

        messages = []
        if system_p and system_p.strip():
            messages.append({"role": "system", "content": system_p.strip()})

        messages.extend(history_copy)
        messages.append({"role": "user", "content": combined_content})

        payload = {
            "model": model,
            "messages": messages,
            "stream": False
        }

        url = "http://localhost:11434/api/chat"
        res = requests.post(url, json=payload, timeout=120)

        if res.status_code == 200:
            res_data = res.json()
            assistant_reply = res_data.get("message", {}).get("content", "")

            # Store updated conversation history and output in persistent memory
            new_history = list(history_copy)
            new_history.append({"role": "user", "content": combined_content})
            new_history.append({"role": "assistant", "content": assistant_reply})

            sc.sticky[KEY_HISTORY] = new_history
            sc.sticky[KEY_RESPONSE] = assistant_reply
            sc.sticky[KEY_STATUS] = f"Success! Model: {model} | History depth: {len(new_history)} items."
        else:
            sc.sticky[KEY_STATUS] = f"Ollama API Error {res.status_code}: {res.text}"

    except Exception as e:
        sc.sticky[KEY_STATUS] = f"Execution Error: {str(e)}"
    finally:
        sc.sticky[KEY_BUSY] = False
        
        # Schedule solution update on main UI thread once complete
        if doc:
            def update_solution(d):
                component.ExpireSolution(False)
            doc.ScheduleSolution(5, gh.Kernel.GH_Document.GH_ScheduleDelegate(update_solution))

# Execution Logic:
# Must have active 'run' signal AND (Run input newly activated OR Text inputs changed)
has_content = bool(current_inputs['user'] or current_inputs['json'])
should_run = (
    bool(run_trigger) and 
    (run_just_activated or inputs_changed) and 
    has_content and 
    not sc.sticky[KEY_BUSY]
)

if should_run:
    sc.sticky[KEY_BUSY] = True
    sc.sticky[KEY_LAST_INPUT] = current_inputs  # Lock input state to prevent infinite refresh loops
    sc.sticky[KEY_STATUS] = "Processing request in background thread..."
    
    history_snapshot = list(sc.sticky[KEY_HISTORY])

    # Launch worker thread
    t = threading.Thread(
        target=run_ollama_async,
        args=(model_name, sys_prompt, u_prompt, json_data, history_snapshot)
    )
    t.daemon = True
    t.start()

# Remember run_trigger state for next solution cycle
sc.sticky[KEY_LAST_RUN] = bool(run_trigger)

# Assign output values from persistent memory
status = sc.sticky[KEY_STATUS]
response = sc.sticky[KEY_RESPONSE]
# ---------- end ollama ----------

# ---- group: Display perception score on selected node
item_33 = ListItem(List=branch_5, Index=node_selection_2, Wrap=True)
concat_21 = Concatenate(FragmentA="Affective score @ selected street: ", FragmentB=item_33)

# ----
panel_68 = Panel(gemini.Status)
slice_text_as_block = Python3Script(text=gemini.Response, max_chars=Slider(91, range=0..100))  # -> out_text; inputs text: String, max_chars: Int32
# ---------- slice_text_as_block: Python ----------
# Inputs: text (str), max_chars (int)
import textwrap

if text:
    # Wrap text into lines of max_chars length
    wrapped_lines = textwrap.wrap(text, width=max_chars)
    # Join them back together with a newline character
    out_text = "\n".join(wrapped_lines)
else:
    out_text = ""
# ---------- end slice_text_as_block ----------
panel_69 = Panel(ollama.response)
panel_70 = Panel(ollama.status)

# ---- group: Display perception score on selected node
panel_71 = Panel("900,970")
texttoscreen_13 = RenderTextToScreen(Text=concat_21, Location=concat_12, Size=12, Color=swatch_14, m_scWithvp=False)

# ---- group: perception scores
panel_72 = Panel("900,940")
texttoscreen_14 = RenderTextToScreen(Text=concat_20, Location=concat_11, Size=12, Color=swatch_7, m_scWithvp=False)

# ----
affective_route_summary = Panel(slice_text_as_block)
panel_73 = Panel(midpt_2)

# ---- group: node display
Z_2 = UnitZ(Factor=Slider(-10, range=-10..10))
move_5 = Move(Geometry=move_4.Geometry, Motion=Z_2)  # -> Geometry, Transform
listdexs_2 = ListIndices(List=move_5.Geometry)
concat_22 = Concatenate(FragmentA="segment", FragmentB=listdexs_2, JoinSeparator=" ")
tag_5 = TextTag(Location=move_5.Geometry, Text=concat_22, Colour=swatch_14)

# ---- group: Score display
Z_3 = UnitZ(Factor=Slider(10, range=0..100))
move_6 = Move(Geometry=move_4.Geometry, Motion=Z_3)  # -> Geometry, Transform
dots_3 = DotDisplay(Point=move_4.Geometry, Colour=swatch_14, Size=Slider(3, range=0..10))
tag_6 = TextTag(Location=move_6.Geometry, Text=branch_5, Colour=swatch_14)
tag_7 = TextTag3D(Location=move_4.Geometry, Text=branch_5, Size=Slider(23, range=0..100), Colour=swatch_14, Justification=7)

# ----
texttoscreen_15 = RenderTextToScreen(Text=slice_text_as_block, Location=concat_13, Size=12, Color=swatch_7, m_scWithvp=False)
concat_23 = Concatenate(FragmentA=directory, FragmentB=item_31)
path_5 = FilePath(concat_23)

# ---- group: Flat dot image sampling
number_slider_12 = Slider(100, range=1..200)
planesrf = PlaneSurface(Plane=PlaneXY(0, 0, 0), XSize="-40, 40", YSize=Domain(-10, 10))
division = Division(A=number_slider_12, B="4")
sdivide = DivideSurface(Surface=reparameterize(planesrf), UCount=number_slider_12, VCount=division)  # -> flatten(Points), Normals, flatten(Parameters)
filepath_for_image_sampler = Python3Script(file_path=path_5, sampler_name="sampler_flat")  # inputs file_path: String
# ---------- filepath_for_image_sampler: Python ----------
import Grasshopper as gh
import System.Reflection as reflection
import os

doc = ghenv.Component.OnPingDocument()

if file_path and os.path.exists(file_path):
    for obj in doc.Objects:
        if isinstance(obj, gh.Kernel.Special.GH_ImageSampler) and obj.NickName == sampler_name:
            if obj.ImageFilePath != file_path:
                # 1. Set new file path string
                obj.ImageFilePath = file_path
                
                # 2. Force reload of the internal bitmap memory cache using Reflection
                flags = reflection.BindingFlags.Instance | reflection.BindingFlags.NonPublic | reflection.BindingFlags.Public
                method = obj.GetType().GetMethod("LoadImage", flags) or obj.GetType().GetMethod("ReloadImage", flags)
                
                if method:
                    method.Invoke(obj, None)
                
                # 3. Re-evaluate downstream Grasshopper components
                obj.ExpireSolution(True)
            break
# ---------- end filepath_for_image_sampler ----------
sampler_flat = ImageSampler(
    sdivide.Parameters,
    FilePath="C:\Users\l03063058\Desktop\Github\DRVaa\streetview_panoramas_360\Vowt8CrnRM-B4PbvJiLU6g_360.jpg",
    Filter="Colour",
    Interpolate=False,
    Umax=1,
    Umin=0,
    Vmax=1,
    Vmin=0,
    Wrap=1)

# ----
panel_74 = Panel(path_5)
render_image_to_screen = Python3Script(file_path=path_5, screen_x=x_right_onscreen_3, screen_y="680", scale="0.2", enabled=Toggle(True))  # inputs file_path: String, screen_x: Int32, screen_y: String, scale: Double, enabled: Boolean
# ---------- render_image_to_screen: Python ----------
import Rhino
import System.Drawing as drawing
import scriptcontext as sc
import os

class ImageConduit(Rhino.Display.DisplayConduit):
    def __init__(self, path, x, y, scale_factor=1.0):
        super().__init__()
        self.x = int(x)
        self.y = int(y)
        self.display_bmp = None
        self.scaled_bmp = None
        self.sys_bmp = None
        
        if path and os.path.exists(path):
            try:
                # Load system bitmap
                self.sys_bmp = drawing.Bitmap(path)
                
                # Compute resampled dimensions
                sf = max(0.01, float(scale_factor))
                w = max(1, int(self.sys_bmp.Width * sf))
                h = max(1, int(self.sys_bmp.Height * sf))
                
                # Create scaled system bitmap
                self.scaled_bmp = drawing.Bitmap(self.sys_bmp, w, h)
                
                # Generate GPU-compatible DisplayBitmap
                self.display_bmp = Rhino.Display.DisplayBitmap(self.scaled_bmp)
            except Exception as ex:
                print("Error loading bitmap:", ex)

    def CalculateBoundingBox(self, e):
        super().CalculateBoundingBox(e)
        # Force pipeline execution even when 3D geometry is absent
        e.IncludeBoundingBox(Rhino.Geometry.BoundingBox(Rhino.Geometry.Point3d(-10, -10, -10), Rhino.Geometry.Point3d(10, 10, 10)))

    def DrawForeground(self, e):
        # Draw directly in screen pixel space (top-left origin = 0,0)
        if self.display_bmp:
            e.Display.DrawBitmap(self.display_bmp, self.x, self.y)

    def Dispose(self):
        if self.display_bmp:
            self.display_bmp.Dispose()
            self.display_bmp = None
        if self.scaled_bmp:
            self.scaled_bmp.Dispose()
            self.scaled_bmp = None
        if self.sys_bmp:
            self.sys_bmp.Dispose()
            self.sys_bmp = None

# --- CONDUIT MANAGEMENT ---
# Clear existing conduit instance from persistent sticky memory
if "image_conduit" in sc.sticky and sc.sticky["image_conduit"] is not None:
    old_conduit = sc.sticky["image_conduit"]
    old_conduit.Enabled = False
    try:
        old_conduit.Dispose()
    except Exception:
        pass
    sc.sticky["image_conduit"] = None

# Safely extract component inputs
run_enabled = globals().get('enabled', True)
path_val = globals().get('file_path', None)
x_val = globals().get('screen_x', 50)
y_val = globals().get('screen_y', 50)
scale_val = globals().get('scale', 1.0)

# Strip surrounding quotes if path was passed as a literal string
if path_val and isinstance(path_val, str):
    path_val = path_val.strip('\'"')

# Enable new conduit if file path exists
if run_enabled and path_val and os.path.exists(path_val):
    conduit = ImageConduit(path_val, x_val, y_val, scale_val)
    conduit.Enabled = True
    sc.sticky["image_conduit"] = conduit

# Force active viewport redraw
if Rhino.RhinoDoc.ActiveDoc:
    Rhino.RhinoDoc.ActiveDoc.Views.Redraw()
# ---------- end render_image_to_screen ----------

# ---- group: Flat dot image sampling
ahsv = SplitAHSV(Colour=sampler_flat)  # -> Alpha, Hue, Saturation, Value
sort_2 = SortList(Keys=ahsv.Hue, ValuesA=ahsv.Saturation, ValuesB=ahsv.Value)  # -> Keys, ValuesA, ValuesB
hsv = ColourHSV(Alpha=1, Hue=sort_2.Keys, Saturation=sort_2.ValuesA, Value=sort_2.ValuesB)
dots_4 = DotDisplay(Point=sdivide.Points, Colour=hsv, Size=Slider(0.4, range=0..1))
pttoscreen = RenderPointToScreen(
    Point=sdivide.Points,
    Location="1610,930",
    ScaleFactor=Slider(6.4, range=0..10),
    Color=hsv,
    Radius=Slider(2, range=0..10),
    Depth="1",
    Fixed=True,
    m_scWithvp=False)

# ---- group: Selected path division and cylinder
ln = Line(StartPoint=midpt_2, EndPoint=move_4.Geometry)
end = EndPoints(Curve=ln)  # -> Start, End
cir = Circle(Plane=end.End, Radius=Slider(70, range=0..100))
Z_4 = UnitZ(Factor=Slider(40, range=0..100))
extr = Extrude(Base=cir, Direction=Z_4)
item_34 = ListItem(List=extr, Index=node_selection_2, Wrap=True)
preview_3 = CustomPreview(Geometry=item_34, Material=ColourSwatch(SwatchColor=RGBA(255, 255, 255, 126)))

# ----
item_35 = ListItem(List=ln, Index=node_selection_2, Wrap=True)

# ---- group: Selected path division and cylinder (continued)
previewlw_8 = CustomPreviewLineweights(Geometry=item_35, Shader=swatch_14, Thickness="3", Absolute=False)

# ---- group: Dot image sampling
cylinder = Surface(reparameterize(item_34))  # disabled
number_slider_13 = Slider(200, range=1..200)
division_2 = Division(A=number_slider_13, B="10")
filepath_for_image_sampler_2 = Python3Script(file_path=path_5, sampler_name="sampler_cylinder")  # inputs file_path: String; same code as filepath_for_image_sampler
toggle_3 = GroupToggle(ToggleActive=True, ToggleVisible=False)  # disabled

# ----
transpose = TransposeSurface(Surface=cylinder)  # -> Surface, U, V

# ---- group: Dot image sampling (continued)
sdivide_2 = DivideSurface(Surface=reparameterize(transpose.Surface), UCount=number_slider_13, VCount=division_2)  # -> flatten(Points), Normals, flatten(Parameters)
sampler_cylinder = ImageSampler(
    sdivide_2.Parameters,
    FilePath="C:\Users\l03063058\Desktop\Github\DRVaa\streetview_panoramas_360\Vowt8CrnRM-B4PbvJiLU6g_360.jpg",
    Filter="Colour",
    Interpolate=False,
    Umax=1,
    Umin=0,
    Vmax=1,
    Vmin=0,
    Wrap=0)
argb_3 = SplitARGB(Colour=sampler_cylinder, IntegerChannels=True)  # -> Alpha, Red, Green, Blue
rgb_3 = ColourRGB(Alpha=Slider(100, range=1..255), Red=argb_3.Red, Green=argb_3.Green, Blue=argb_3.Blue)  # -> simplify(Colour)
dots_5 = DotDisplay(Point=sdivide_2.Points, Colour=rgb_3, Size="0.8")
