# Grasshopper definition analysis_v1.gh (Grasshopper 1.0.8)
# plug-ins: CORE.Toolbox.Grasshopper, Pufferfish, Urbano, Human, Telepathy

path = FilePath("C:\Users\l03063058\Desktop\Github\DRVaa\street_segments_scored_360_rationale.csv")

# ---- group: CSV file with perception data for each street segment (through LLM or participatory design)
path_2 = FilePath("C:\Users\l03063058\Desktop\Github\DRVaa\street_segments_scored_360_rationale.csv")

# ----
panel = Panel(path)
panel_2 = Panel("2787")
swatch = ColourSwatch(SwatchColor=RGBA(157, 196, 0, 102))
swatch_2 = ColourSwatch(SwatchColor=RGB(98, 103, 104))
x_left_onscreen = RemoteReceiver()
x_left_onscreen_2 = RemoteReceiver()
x_left_onscreen_3 = RemoteReceiver()
number_slider = Slider(10, range=0..10)
concat = Concatenate(FragmentA=x_left_onscreen, FragmentB="850", JoinSeparator=", ")

panel_3 = Panel("500,850")
concat_2 = Concatenate(FragmentA="Number of routes to explore: ")
panel_4 = Panel("consolas")
texttoscreen = RenderTextToScreen(Text=concat_2, Location=concat, Size=12, Color=ColourSwatch(SwatchColor=RGB(255, 255, 255)), m_scWithvp=False)

number_slider_2 = Slider(15, range=0..100)
concat_3 = Concatenate(FragmentA=x_left_onscreen_2, FragmentB="940", JoinSeparator=", ")

swatch_3 = ColourSwatch(SwatchColor=RGB(255, 255, 255))
panel_5 = Panel("500,940")
concat_4 = Concatenate(FragmentA="Selected node: ")
texttoscreen_2 = RenderTextToScreen(Text=concat_4, Location=concat_3, Size=12, Color=RGB(0, 0, 0), m_scWithvp=False)

swatch_4 = ColourSwatch(SwatchColor=RGB(0, 0, 0))
swatch_5 = ColourSwatch(SwatchColor=RGB(255, 0, 0))
concat_5 = Concatenate(FragmentA=x_left_onscreen_3, FragmentB="910", JoinSeparator=", ")
swatch_6 = ColourSwatch(SwatchColor=RGB(0, 255, 255))
swatch_7 = ColourSwatch(SwatchColor=RGB(0, 229, 255))
swatch_8 = ColourSwatch(SwatchColor=RGB(0, 64, 255))
swatch_9 = ColourSwatch(SwatchColor=RGB(13, 255, 0))
swatch_10 = ColourSwatch(SwatchColor=RGB(255, 0, 128))
swatch_11 = ColourSwatch(SwatchColor=RGB(191, 0, 255))

# ---- group: attach to edges / distance threshold
number_slider_3 = Slider(5, range=0..100)

# ----
panel_7 = Panel("""542

771
192
266
466

typical
1000
177""")
directory = Panel("C:\Users\l03063058\Desktop\Github\DRVaa\streetview_panoramas_360\")
number_slider_4 = Slider(3, range=0..10)

# ----
# 1. OSM
path_3 = FilePath("C:\Users\l03063058\Desktop\Github\DRVaa\Grasshopper\cityModels\SJO_match_large.osm")
importosm = ImportOSMFeatures(OSMPathOrURL=path_3, OSMFeatureType="street", Format="xml", ImportAltitude=False)  # -> Points, Metadata, UTMZone, TranslationVector
importosm_2 = ImportOSMFeatures(OSMPathOrURL=path_3, OSMFeatureType="amenity", Format="xml", ImportAltitude=False)  # -> Points, Metadata, UTMZone, TranslationVector
importosm_3 = ImportOSMFeatures(OSMPathOrURL=path_3, OSMFeatureType="building", Format="xml", ImportAltitude=False)  # -> Points, Metadata, UTMZone, TranslationVector
pline = PolyLine(Vertices=importosm.Points, Closed=False)
pline_2 = PolyLine(Vertices=importosm_3.Points, Closed=invert(False))
streetnet = CreateStreetNetwork(
    StreetCurves=flatten(pline),
    Metadata=flatten(importosm.Metadata),
    SplitStreetCurves=True,
    UTMZone=importosm.UTMZone,
    TranslationVector=importosm.TranslationVector)  # -> StreetNetwork, StreetSegmentCurves, UTMZone, TranslationVector
amen = CreateAmenity(PointLocationOfAmenity=importosm_2.Points, Metadata=importosm_2.Metadata)
demeta = DeconstructMetadata(Metadata=amen)  # -> Keys, Values

importosm_4 = ImportOSMFeatures(OSMPathOrURL=path_3, OSMFeatureType="leisure", Format="xml", ImportAltitude=False)  # -> Points, Metadata, UTMZone, TranslationVector
pline_3 = PolyLine(Vertices=importosm_4.Points, Closed=invert(False))  # -> flatten(Polyline)
pt = Point(importosm_2.Points)
clean = CleanTree(RemoveNulls=True, RemoveInvalid=True, RemoveEmpty=invert(False), Tree=pline_2)
srf = Surface(pline_3)
move = Move(Geometry=srf, Motion="0,0,0.5")  # -> Geometry, Transform

bldg = CreateBuilding(BuildingCurve=clean, Metadata=importosm_3.Metadata, AmenitiesInBuilding=amen)
model = BuildUrbanoModel(Buildings=flatten(bldg), StreetNetwork=streetnet.StreetNetwork, BuildToggle=True)  # -> UrbanoModel, BuildingCurves, Activities
inbldg = InspectBuilding(Building=bldg, UrbanoModel=model.UrbanoModel, DefaultHeight=10)  # -> Geometry, Metadata, Amenity, BuildingMesh
preview = CustomPreview(Geometry=inbldg.BuildingMesh, Material=swatch_2)
item = ListItem(List=flatten(inbldg.BuildingMesh), Index=Slider(1, range=0..1000), Wrap=True)

preview_2 = CustomPreview(Geometry=move.Geometry, Material=ColourSwatch(SwatchColor=RGB(51, 120, 0)))
previewlw = CustomPreviewLineweights(Geometry=streetnet.StreetSegmentCurves, Shader=swatch_2, Absolute=False)
crv = Curve(inbldg.Geometry)

# ---- group: Thermal Comfort
panel_8 = Panel("""leisure=park
leisure=garden
landuse=forest
landuse=grass
landuse=meadow
natural=tree
natural=tree_row
natural=wood
natural=scrub
natural=grassland
barrier=hedge
natural=water
amenity=fountain
amenity=drinking_water
waterway=waterfall
waterway=stream
waterway=canal
waterway=river
amenity=shelter
building=roof
highway=pedestrian
highway=footway
highway=living_street
leisure=plaza""")
osm_poi_extractor = Python3Script(osm_file=path_3, osm_tags=panel_8, UTM=importosm_2.UTMZone, Vec=importosm_2.TranslationVector, run=Toggle(True))  # -> status_msg, points, names, categories, tag_values, utm_coords, poi_metadata, category_colors; inputs osm_file: String, osm_tags: String, run: Boolean
# ---------- osm_poi_extractor: Python ----------
import json
import math
import os
import xml.etree.ElementTree as ET
import Rhino.Geometry as rg
import System.Drawing as drawing

# Alias SystemColor for drawing operations
SystemColor = drawing.Color

# ==============================================================================
# WGS84 UTM PROJECTION ENGINE
# ==============================================================================


def latlon_to_utm(lat, lon):
    """Converts Latitude and Longitude to exact WGS84 UTM Easting and Northing in meters."""
    a = 6378137.0
    f = 1 / 298.257223563
    b = a * (1 - f)
    e2 = (a**2 - b**2) / a**2
    e_prime2 = (a**2 - b**2) / b**2

    zone = int((lon + 180) / 6) + 1
    lon0 = (zone - 1) * 6 - 180 + 3

    lat_rad = math.radians(lat)
    lon_rad = math.radians(lon)
    lon0_rad = math.radians(lon0)

    N = a / math.sqrt(1 - e2 * math.sin(lat_rad) ** 2)
    T = math.tan(lat_rad) ** 2
    C = e_prime2 * math.cos(lat_rad) ** 2
    A = (lon_rad - lon0_rad) * math.cos(lat_rad)

    M = a * (
        (1 - e2 / 4 - 3 * e2**2 / 64 - 5 * e2**3 / 256) * lat_rad
        - (3 * e2 / 8 + 3 * e2**2 / 32 + 45 * e2**3 / 1024)
        * math.sin(2 * lat_rad)
        + (15 * e2**2 / 256 + 45 * e2**3 / 1024) * math.sin(4 * lat_rad)
        - (35 * e2**3 / 3072) * math.sin(6 * lat_rad)
    )

    k0 = 0.9996
    easting = k0 * N * (
        A
        + (1 - T + C) * A**3 / 6
        + (5 - 18 * T + T**2 + 72 * C - 58 * e_prime2) * A**5 / 120
    ) + 500000.0

    northing = k0 * (
        M
        + N
        * math.tan(lat_rad)
        * (
            A**2 / 2
            + (5 - T + 9 * C + 4 * C**2) * A**4 / 24
            + (61 - 58 * T + T**2 + 600 * C - 330 * e_prime2) * A**6 / 720
        )
    )
    if lat < 0:
        northing += 10000000.0

    return easting, northing, zone


# ==============================================================================
# HELPER FUNCTIONS
# ==============================================================================


def check_tag_match(tags_dict, query_input):
    """Smart tag matcher: supports Panels with single words like 'tree', key=val, dicts, or JSON."""
    if not tags_dict:
        return False, None, None

    if isinstance(query_input, dict):
        for k, v in query_input.items():
            if k in tags_dict:
                if (
                    v is True
                    or tags_dict[k] == v
                    or (isinstance(v, list) and tags_dict[k] in v)
                ):
                    return True, k, tags_dict[k]
        return False, None, None

    q_str = str(query_input).strip() if query_input else "amenity"

    try:
        parsed_json = json.loads(q_str)
        if isinstance(parsed_json, dict):
            return check_tag_match(tags_dict, parsed_json)
    except Exception:
        pass

    statements = q_str.replace("\n", ";").split(";")
    for stmt in statements:
        stmt = stmt.strip()
        if not stmt:
            continue

        if "=" in stmt:
            k, v = stmt.split("=", 1)
            k_clean, v_clean = k.strip().lower(), v.strip().lower()
            for tag_k, tag_v in tags_dict.items():
                if (
                    tag_k.lower() == k_clean
                    and str(tag_v).lower() == v_clean
                ):
                    return True, tag_k, tag_v
        else:
            q_lower = stmt.lower()
            for tag_k, tag_v in tags_dict.items():
                k_lower, v_lower = tag_k.lower(), str(tag_v).lower()
                if (
                    q_lower == k_lower
                    or q_lower == v_lower
                    or q_lower in v_lower
                ):
                    return True, tag_k, tag_v

    return False, None, None


def get_category_color(category_key, tag_value):
    """Returns color encoding for Grasshopper visual display."""
    val = str(tag_value).lower()
    cat = str(category_key).lower()

    if (
        cat == "amenity"
        and val in ["restaurant", "cafe", "fast_food", "food_court", "bar"]
    ) or val == "bakery":
        return SystemColor.FromArgb(255, 255, 87, 34)  # Deep Orange (Food)
    elif cat == "shop" or val in ["bank", "pharmacy", "supermarket"]:
        return SystemColor.FromArgb(255, 33, 150, 243)  # Blue (Commercial)
    elif (
        cat == "leisure"
        or val in ["park", "garden", "playground"]
        or cat == "natural"
        or val == "tree"
    ):
        return SystemColor.FromArgb(255, 76, 175, 80)  # Green (Vegetation)
    elif cat == "landuse" or val in ["industrial", "fuel", "railway"]:
        return SystemColor.FromArgb(255, 121, 85, 72)  # Brown/Industrial
    else:
        return SystemColor.FromArgb(255, 255, 193, 7)  # Amber (General)


# ==============================================================================
# MAIN EXECUTION
# ==============================================================================
out_points = []
out_names = []
out_categories = []
out_tag_values = []
out_utm_coords = []
out_metadata = []
out_colors = []
status = []

if not run:
    points = []
    names = []
    categories = []
    tag_values = []
    utm_coords = []
    poi_metadata = []
    category_colors = []
    status_msg = "Execution paused (run = False)."
else:
    file_path = str(osm_file).strip() if osm_file else ""
    if not os.path.exists(file_path):
        status_msg = f"ERROR: File not found at path: '{file_path}'"
        points, names, categories, tag_values, utm_coords, poi_metadata, category_colors = (
            [],
            [],
            [],
            [],
            [],
            [],
            [],
        )
    else:
        try:
            status.append(
                f"Reading OSM File: '{os.path.basename(file_path)}'..."
            )
            tree = ET.parse(file_path)
            root = tree.getroot()

            # 1. Parse Nodes & UTM Coordinates
            nodes_coords = {}
            nodes_utm = {}

            for node in root.findall("node"):
                node_id = node.get("id")
                lat = float(node.get("lat"))
                lon = float(node.get("lon"))
                nodes_coords[node_id] = (lat, lon)

                easting, northing, zone = latlon_to_utm(lat, lon)
                nodes_utm[node_id] = (easting, northing, zone)

            # 2. Resolve Urbano Reference Origin Vector
            ref_easting, ref_northing = None, None

            if Vec is not None:
                if hasattr(Vec, "X") and hasattr(Vec, "Y"):
                    vx, vy = Vec.X, Vec.Y
                elif isinstance(Vec, (list, tuple)) and len(Vec) >= 2:
                    vx, vy = float(Vec[0]), float(Vec[1])
                else:
                    clean = (
                        str(Vec)
                        .replace("(", "")
                        .replace(")", "")
                        .replace("[", "")
                        .replace("]", "")
                        .split(",")
                    )
                    vx, vy = float(clean[0]), float(clean[1])

                ref_easting = abs(vx)
                ref_northing = abs(vy)

                status.append(
                    f"Urbano Reference Origin Resolved: Easting={ref_easting:.2f}, Northing={ref_northing:.2f}"
                )

            if ref_easting is None or ref_northing is None:
                all_e = [u[0] for u in nodes_utm.values()]
                all_n = [u[1] for u in nodes_utm.values()]
                ref_easting = min(all_e)
                ref_northing = min(all_n)

            # 3. Extract POI Nodes
            for node in root.findall("node"):
                node_id = node.get("id")
                lat, lon = nodes_coords[node_id]
                easting, northing, zone = nodes_utm[node_id]

                tags = {
                    tag.get("k"): tag.get("v") for tag in node.findall("tag")
                }
                is_match, cat_key, cat_val = check_tag_match(tags, osm_tags)

                if is_match:
                    x = easting - ref_easting
                    y = northing - ref_northing
                    pt = rg.Point3d(x, y, 0.0)

                    poi_name = tags.get("name", f"Unnamed {cat_val.title()}")

                    # Formatted text block compatible with Urbano / GH Deconstruction
                    meta_text = (
                        f"Name = {poi_name}\n"
                        f"Category = {cat_key}\n"
                        f"TagValue = {cat_val}\n"
                        f"UTM_Easting = {easting:.2f}\n"
                        f"UTM_Northing = {northing:.2f}\n"
                        f"UTM_Zone = {zone}\n"
                        f"Latitude = {lat:.6f}\n"
                        f"Longitude = {lon:.6f}"
                    )

                    out_points.append(pt)
                    out_names.append(poi_name)
                    out_categories.append(cat_key)
                    out_tag_values.append(cat_val)
                    out_utm_coords.append(
                        f"{easting:.2f}, {northing:.2f} (Zone {zone})"
                    )
                    out_metadata.append(meta_text)
                    out_colors.append(get_category_color(cat_key, cat_val))

            # 4. Extract POI Ways (Buildings / Centroids)
            for way in root.findall("way"):
                way_id = way.get("id")
                tags = {
                    tag.get("k"): tag.get("v") for tag in way.findall("tag")
                }
                is_match, cat_key, cat_val = check_tag_match(tags, osm_tags)

                if is_match:
                    nd_refs = [
                        nd.get("ref")
                        for nd in way.findall("nd")
                        if nd.get("ref") in nodes_coords
                    ]
                    if nd_refs:
                        avg_lat = sum(
                            nodes_coords[nid][0] for nid in nd_refs
                        ) / len(nd_refs)
                        avg_lon = sum(
                            nodes_coords[nid][1] for nid in nd_refs
                        ) / len(nd_refs)

                        avg_easting, avg_northing, zone = latlon_to_utm(
                            avg_lat, avg_lon
                        )

                        x = avg_easting - ref_easting
                        y = avg_northing - ref_northing
                        pt = rg.Point3d(x, y, 0.0)

                        poi_name = tags.get(
                            "name", f"Unnamed {cat_val.title()}"
                        )

                        meta_text = (
                            f"Name = {poi_name}\n"
                            f"Category = {cat_key}\n"
                            f"TagValue = {cat_val}\n"
                            f"UTM_Easting = {avg_easting:.2f}\n"
                            f"UTM_Northing = {avg_northing:.2f}\n"
                            f"UTM_Zone = {zone}\n"
                            f"Latitude = {avg_lat:.6f}\n"
                            f"Longitude = {avg_lon:.6f}"
                        )

                        out_points.append(pt)
                        out_names.append(poi_name)
                        out_categories.append(cat_key)
                        out_tag_values.append(cat_val)
                        out_utm_coords.append(
                            f"{avg_easting:.2f}, {avg_northing:.2f} (Zone {zone})"
                        )
                        out_metadata.append(meta_text)
                        out_colors.append(get_category_color(cat_key, cat_val))

            status.append(
                f"Successfully extracted {len(out_points)} POIs aligned to Urbano."
            )

            # Assign Component Outputs
            points = out_points
            names = out_names
            categories = out_categories
            tag_values = out_tag_values
            utm_coords = out_utm_coords
            poi_metadata = out_metadata
            category_colors = out_colors
            status_msg = "\n".join(status)

        except Exception as e:
            status_msg = f"ERROR parsing OSM file: {str(e)}"
            points, names, categories, tag_values, utm_coords, poi_metadata, category_colors = (
                [],
                [],
                [],
                [],
                [],
                [],
                [],
            )
# ---------- end osm_poi_extractor ----------
pt_2 = Point(osm_poi_extractor.points)

# ---- group: Acoustic Comfort
panel_9 = Panel("""highway=motorway
highway=trunk
highway=primary
highway=secondary
highway=bus_stop
highway=construction
railway=rail
railway=level_crossing
railway=subway
railway=tram
aeroway=runway
aeroway=helipad
landuse=industrial
landuse=railway
landuse=construction
industrial=factory
industrial=oil
building=industrial
building=warehouse
amenity=fuel
amenity=bus_station
amenity=car_wash
amenity=nightclub
amenity=pub
amenity=bar
craft=car_repair
craft=metal_construction
craft=blacksmith
man_made=works
man_made=chimney
power=substation""")
osm_poi_extractor_2 = Python3Script(osm_file=path_3, osm_tags=panel_9, UTM=importosm_2.UTMZone, Vec=importosm_2.TranslationVector, run=Toggle(True))  # -> status_msg, points, names, categories, tag_values, utm_coords, poi_metadata, category_colors; inputs osm_file: String, osm_tags: String, run: Boolean; same code as osm_poi_extractor
pt_3 = Point(osm_poi_extractor_2.points)

# ---- group: Somatic Stress
panel_10 = Panel("""highway=motorway
highway=trunk
highway=primary
highway=secondary
highway=bus_stop
highway=construction
railway=rail
railway=level_crossing
railway=subway
landuse=industrial
landuse=railway
landuse=construction
industrial=factory
industrial=oil
building=industrial
building=warehouse
amenity=fuel
amenity=parking
amenity=bus_station
amenity=car_wash
power=line
power=substation
power=tower
man_made=works
man_made=chimney
man_made=pipeline
barrier=wall
barrier=fence""")
osm_poi_extractor_3 = Python3Script(osm_file=path_3, osm_tags=panel_10, UTM=importosm_2.UTMZone, Vec=importosm_2.TranslationVector, run=Toggle(True))  # -> status_msg, points, names, categories, tag_values, utm_coords, poi_metadata, category_colors; inputs osm_file: String, osm_tags: String, run: Boolean; same code as osm_poi_extractor
pt_4 = Point(osm_poi_extractor_3.points)

# ---- group: Social Vitality
panel_11 = Panel("""amenity=cafe
amenity=restaurant
amenity=bar
amenity=pub
amenity=fast_food
amenity=ice_cream
amenity=food_court
amenity=biergarten
amenity=marketplace
amenity=community_centre
amenity=arts_centre
amenity=theatre
amenity=cinema
amenity=library
amenity=place_of_worship
amenity=bank
amenity=post_office
amenity=pharmacy
amenity=fountain
amenity=bench
amenity=school
amenity=kindergarten
shop=convenience
shop=bakery
shop=supermarket
shop=greengrocer
shop=clothes
shop=books
shop=kiosk
shop=boutique
shop=mall
shop=department_store
tourism=museum
tourism=gallery
tourism=attraction
leisure=plaza
leisure=park
leisure=playground
leisure=sports_centre
leisure=fitness_station
leisure=pitch
highway=pedestrian
highway=living_street""")
osm_poi_extractor_4 = Python3Script(osm_file=path_3, osm_tags=panel_11, UTM=importosm_2.UTMZone, Vec=importosm_2.TranslationVector, run=Toggle(True))  # -> status_msg, points, names, categories, tag_values, utm_coords, poi_metadata, category_colors; inputs osm_file: String, osm_tags: String, run: Boolean; same code as osm_poi_extractor
pt_5 = Point(osm_poi_extractor_4.points)

# ---- group: Territorial Safety
panel_12 = Panel("""amenity=arts_centre
amenity=bank
amenity=bar
amenity=bench
amenity=bicycle_rental
amenity=biergarten
amenity=cafe
amenity=cinema
amenity=clinic
amenity=college
amenity=community_centre
amenity=events_venue
amenity=fast_food
amenity=fire_station
amenity=food_court
amenity=fountain
amenity=ice_cream
amenity=kindergarten
amenity=library
amenity=marketplace
amenity=pharmacy
amenity=place_of_worship
amenity=police
amenity=post_office
amenity=pub
amenity=restaurant
amenity=school
amenity=social_facility
amenity=theatre
amenity=townhall
amenity=university
highway=living_street
highway=pedestrian
leisure=dog_park
leisure=fitness_station
leisure=garden
leisure=park
leisure=pitch
leisure=playground
leisure=plaza
leisure=skatepark
leisure=sports_centre
leisure=stadium
shop=bakery
shop=books
shop=boutique
shop=butcher
shop=clothes
shop=convenience
shop=deli
shop=department_store
shop=greengrocer
shop=hairdresser
shop=kiosk
shop=laundry
shop=mall
shop=supermarket
shop=variety_store
tourism=attraction
tourism=gallery
tourism=museum
tourism=picnic_site""")
osm_poi_extractor_5 = Python3Script(osm_file=path_3, osm_tags=panel_12, UTM=importosm_2.UTMZone, Vec=importosm_2.TranslationVector, run=Toggle(True))  # -> status_msg, points, names, categories, tag_values, utm_coords, poi_metadata, category_colors; inputs osm_file: String, osm_tags: String, run: Boolean; same code as osm_poi_extractor
pt_6 = Point(osm_poi_extractor_5.points)

# ---- group: Olfactory Resonance
panel_13 = Panel("""shop=bakery
shop=florist
shop=coffee
shop=greengrocer
shop=pastry
shop=confectionery
shop=spices
shop=tea
shop=perfumery
amenity=cafe
amenity=restaurant
amenity=fast_food
amenity=ice_cream
amenity=food_court
amenity=marketplace
amenity=fountain
leisure=garden
leisure=park
landuse=flowerbed
natural=wood
natural=tree_row
natural=tree
waterway=stream
landuse=landfill
landuse=industrial
landuse=farmyard
man_made=wastewater_plant
man_made=works
man_made=chimney
amenity=waste_transfer_station
amenity=waste_disposal
amenity=recycling
amenity=slaughterhouse
amenity=fuel
amenity=toilets
waterway=drain
waterway=ditch
industrial=chemical
industrial=refinery
industrial=oil
industrial=leather
craft=tanner
building=industrial""")
osm_poi_extractor_6 = Python3Script(osm_file=path_3, osm_tags=panel_13, UTM=importosm_2.UTMZone, Vec=importosm_2.TranslationVector, run=Toggle(True))  # -> status_msg, points, names, categories, tag_values, utm_coords, poi_metadata, category_colors; inputs osm_file: String, osm_tags: String, run: Boolean; same code as osm_poi_extractor
pt_7 = Point(osm_poi_extractor_6.points)

# ----
dots = DotDisplay(Point=pt_2, Colour=swatch_4, Size=number_slider_2)
dots_2 = DotDisplay(Point=pt_7, Colour=swatch_4, Size=number_slider_2)
preview_3 = CustomPreview(Geometry=pt_3, Material=osm_poi_extractor_2.category_colors)
dots_3 = DotDisplay(Point=pt_3, Colour=swatch_4, Size=number_slider_2)
preview_4 = CustomPreview(Geometry=pt_6, Material=osm_poi_extractor_5.category_colors)
dots_4 = DotDisplay(Point=pt_6, Colour=swatch_4, Size=number_slider_2)
preview_5 = CustomPreview(Geometry=pt_7, Material=osm_poi_extractor_6.category_colors)
preview_6 = CustomPreview(Geometry=pt_2, Material=osm_poi_extractor.category_colors)
preview_7 = CustomPreview(Geometry=pt_4, Material=osm_poi_extractor_3.category_colors)
dots_5 = DotDisplay(Point=pt_4, Colour=swatch_4, Size=number_slider_2)
preview_8 = CustomPreview(Geometry=pt_5, Material=osm_poi_extractor_4.category_colors)
dots_6 = DotDisplay(Point=pt_5, Colour=swatch_4, Size=number_slider_2)

# ---- group: Number of features within 50m radius
pull = PullPoint(Point=flatten(pt_4), Geometry=graft(streetnet.StreetSegmentCurves), ClosestOnly=True)  # -> ClosestPoint, Distance, Index
smaller = SmallerThan(FirstNumber=pull.Distance, SecondNumber=Slider(50, range=0..100))  # -> SmallerThan, OrEqualTo
dispatch = Dispatch(List=pull.ClosestPoint, DispatchPattern=smaller.SmallerThan)  # -> ListA, ListB
lng = ListLength(List=dispatch.ListA)  # -> flatten(Length)
avr = Average(Input=lng)
roundd = RoundToDecimalPlace(NumberX=avr, DecimalPlace="2", RoundType=0)  # -> Rounded, Difference
panel_14 = Panel(roundd.Rounded)

pull_2 = PullPoint(Point=flatten(pt_3), Geometry=graft(streetnet.StreetSegmentCurves), ClosestOnly=True)  # -> ClosestPoint, Distance, Index
smaller_2 = SmallerThan(FirstNumber=pull_2.Distance, SecondNumber=Slider(50, range=0..100))  # -> SmallerThan, OrEqualTo
dispatch_2 = Dispatch(List=pull_2.ClosestPoint, DispatchPattern=smaller_2.SmallerThan)  # -> ListA, ListB
lng_2 = ListLength(List=dispatch_2.ListA)  # -> flatten(Length)
avr_2 = Average(Input=flatten(lng_2))
roundd_2 = RoundToDecimalPlace(NumberX=avr_2, DecimalPlace="2", RoundType=0)  # -> Rounded, Difference
panel_15 = Panel(roundd_2.Rounded)

pull_3 = PullPoint(Point=flatten(pt_2), Geometry=graft(streetnet.StreetSegmentCurves), ClosestOnly=True)  # -> ClosestPoint, Distance, Index
smaller_3 = SmallerThan(FirstNumber=pull_3.Distance, SecondNumber=Slider(50, range=0..100))  # -> SmallerThan, OrEqualTo
dispatch_3 = Dispatch(List=pull_3.ClosestPoint, DispatchPattern=smaller_3.SmallerThan)  # -> ListA, ListB
lng_3 = ListLength(List=dispatch_3.ListA)  # -> flatten(Length)
avr_3 = Average(Input=lng_3)
roundd_3 = RoundToDecimalPlace(NumberX=avr_3, DecimalPlace="2", RoundType=0)  # -> Rounded, Difference
panel_16 = Panel(roundd_3.Rounded)

pull_4 = PullPoint(Point=flatten(pt_5), Geometry=graft(streetnet.StreetSegmentCurves), ClosestOnly=True)  # -> ClosestPoint, Distance, Index
smaller_4 = SmallerThan(FirstNumber=pull_4.Distance, SecondNumber=Slider(50, range=0..100))  # -> SmallerThan, OrEqualTo
dispatch_4 = Dispatch(List=pull_4.ClosestPoint, DispatchPattern=smaller_4.SmallerThan)  # -> ListA, ListB
lng_4 = ListLength(List=dispatch_4.ListA)  # -> flatten(Length)
avr_4 = Average(Input=lng_4)
roundd_4 = RoundToDecimalPlace(NumberX=avr_4, DecimalPlace="2", RoundType=0)  # -> Rounded, Difference
panel_17 = Panel(roundd_4.Rounded)

pull_5 = PullPoint(Point=flatten(pt_6), Geometry=graft(streetnet.StreetSegmentCurves), ClosestOnly=True)  # -> ClosestPoint, Distance, Index
smaller_5 = SmallerThan(FirstNumber=pull_5.Distance, SecondNumber=Slider(50, range=0..100))  # -> SmallerThan, OrEqualTo
dispatch_5 = Dispatch(List=pull_5.ClosestPoint, DispatchPattern=smaller_5.SmallerThan)  # -> ListA, ListB
lng_5 = ListLength(List=dispatch_5.ListA)  # -> flatten(Length)
avr_5 = Average(Input=lng_5)
roundd_5 = RoundToDecimalPlace(NumberX=avr_5, DecimalPlace="2", RoundType=0)  # -> Rounded, Difference
panel_18 = Panel(roundd_5.Rounded)

pull_6 = PullPoint(Point=flatten(pt_7), Geometry=graft(streetnet.StreetSegmentCurves), ClosestOnly=True)  # -> ClosestPoint, Distance, Index
smaller_6 = SmallerThan(FirstNumber=pull_6.Distance, SecondNumber=Slider(50, range=0..100))  # -> SmallerThan, OrEqualTo
dispatch_6 = Dispatch(List=pull_6.ClosestPoint, DispatchPattern=smaller_6.SmallerThan)  # -> ListA, ListB
lng_6 = ListLength(List=dispatch_6.ListA)  # -> flatten(Length)
avr_6 = Average(Input=lng_6)
roundd_6 = RoundToDecimalPlace(NumberX=avr_6, DecimalPlace="2", RoundType=0)  # -> Rounded, Difference
panel_19 = Panel(roundd_6.Rounded)

# ----
panel_20 = Panel(lng_2)

# ---- group: attach to edges / insert street segments
crv_2 = Curve(streetnet.StreetSegmentCurves)

# ----
panel_21 = Panel(lng_5)
midpt = CurveMiddle(Curve=crv_2)
midpt_2 = CurveMiddle(Curve=crv_2)
midpt_3 = CurveMiddle(Curve=crv_2)
midpt_4 = CurveMiddle(Curve=crv_2)
midpt_5 = CurveMiddle(Curve=crv_2)
midpt_6 = CurveMiddle(Curve=crv_2)
midpt_7 = CurveMiddle(Curve=streetnet.StreetSegmentCurves)
item_2 = ListItem(List=streetnet.StreetSegmentCurves, Index="466", Wrap=True)
points = PointList(Points=midpt_7, Size=Slider(10, range=0..10))

# ----
# LLM Walkability Perception
panel_22 = Panel(path_2)
path_4 = FilePath("C:\Users\l03063058\Desktop\Github\DRVaa\SHPs\streets_scored_SJO_large\street_scored.shp")
panel_23 = Panel(path_4)

# ---- group: CSV to SHP v003
py3 = Python3Script(csv_file=path_2, shp_file_path=path_4)  # -> GeoDataFrame, shp_file
#   port csv_file: CSV file with perception data (machine or human) for each street segment. File should include columns named latitude and longitude so it can georeference each street segment and convert to SHP file.
#   port shp_file_path: Select file path where SHP file will be saved.
# ---------- py3: Python ----------
#! python3
#r: pandas, geopandas

import pandas as pd
import geopandas as gpd
from shapely.geometry import Point

# Read CSV file
df = pd.read_csv(csv_file)


# Make sure CSV file has columns for latitud and longitud
# if 'latitude' not in df.columns or 'longitude' not in df.columns:
    # raise ValueError("CSV file must have 'latitude' and 'longitude' columns")
    

# Create point geometry based on coordinates
geometry = [Point(xy) for xy in zip(df['longitude'], df['latitude'])]
gdf = gpd.GeoDataFrame(df, geometry=geometry)

# Establish reference system (CRS), WGS84 for example
gdf.set_crs(epsg=4326, inplace=True)

# Display dataframe
GeoDataFrame = gdf

# Save as Shapefile
gdf.to_file(shp_file_path)

shp_file = shp_file_path

# print(GeoDataFrame.crs)
# ---------- end py3 ----------

# ----
panel_24 = Panel(py3.GeoDataFrame)

# ---- group: SHP to GeoDataframe
py3_2 = Python3Script(SHP=py3.shp_file)  # -> GeoDataFrame
# ---------- py3_2: Python ----------
#! python3
#r: geopandas


#THIS IS NECESSARY TO LOAD PANDAS otherwise it bugs
import locale
locale.setlocale(locale.LC_ALL, 'en_US')

import geopandas as gpd

GeoDataFrame = gpd.read_file(SHP)
# ---------- end py3_2 ----------

# ---- group: Dataframe Details
py3_3 = Python3Script(dataFrame=py3_2)  # -> info, column_name, head_x10, tail_x10, shape, number_of_null_values
# ---------- py3_3: Python ----------
info = dataFrame.info

head_x10 = dataFrame.head(10)
tail_x10 = dataFrame.tail(10)
shape = dataFrame.shape

#Add up all null values
number_of_null_values = dataFrame.isnull().sum()



# columns = dataFrame.columns
# Get the columns as a list
column_name = dataFrame.columns.tolist()

# Output the list
# print(column_name)
# ---------- end py3_3 ----------

# ----
panel_25 = Panel(py3_3.column_name)

perception_list = ValueList({"acoustic comfort": 6, "thermal comfort": 7, "somatic stress": 8, "social vitality": 9, "territorial safety": 10, "olfactory resonance": 11}, selected="somatic stress")
item_3 = ListItem(List=py3_3.column_name, Index=perception_list, Wrap=True)

filter = StreamFilter(
    Gate=perception_list,
    Stream6="Acoustic comfort",
    Stream7="Thermal comfort",
    Stream8="Somatic stress",
    Stream9="Social vitality",
    Stream10="Territorial safety",
    Stream11="Olfactory resonance")
panel_26 = Panel("500,910")
swatch_12 = ColourSwatch(SwatchColor=RGB(255, 255, 255))
texttoscreen_3 = RenderTextToScreen(Text=filter, Location=concat_5, Size=Slider(30, range=0..100), Color=RGB(0, 0, 0), m_scWithvp=False)

# ----
# Perception (9s)
bounding_box = Relay()

panel_28 = Panel(py3_3.head_x10)
importshp = ImportShapefileFeatures(
    ShapefilePath=py3.shp_file,
    Reproject=False,
    UTMZone=importosm_2.UTMZone,
    TranslationVector=importosm_2.TranslationVector,
    CroppingGeometry=bounding_box)  # -> simplify(flatten(Points)), Metadata, UTMZone, TranslationVector
demeta_2 = DeconstructMetadata(Metadata=importshp.Metadata)  # -> Keys, Values
panel_30 = Panel(demeta_2.Values)
panel_31 = Panel(demeta_2.Keys)

panel_32 = Panel(importshp.Points)

# ----
# FILTERING
lookup = LookupMetadata(MetadataGeometry=importshp.Metadata, SearchKey=item_3)
pt_8 = Point(flatten(importshp.Points))

bnd = Bounds(Numbers=lookup)
dedomain = DeconstructDomain(Domain=bnd)  # -> Start, End
panel_33 = Panel(dedomain.Start)
panel_34 = Panel(dedomain.End)

dots_7 = DotDisplay(Point=pt_8, Colour=ColourSwatch(SwatchColor=RGB(238, 95, 131)), Size=Slider(5, range=0..20))
dup_pts = CleanDuplicatePoints(Points=pt_8, Tolerance=0.01)  # -> Points, Indices, Status
dispatch_7 = Dispatch(List=lookup, DispatchPattern=dup_pts.Status)  # -> ListA, ListB
panel_35 = Panel(dispatch_7.ListA)

points_2 = PointList(Points=pt_8, Size=Slider(6, range=0..10))

# ---- group: raw
tag = TextTag(Location=pt_8, Text=lookup)

# ---- group: eliminated duplicates
tag_2 = TextTag(Location=flatten(dup_pts.Points), Text=dispatch_7.ListA, Colour=ColourSwatch(SwatchColor=RGB(0, 0, 0)))

# ---- group: attach to edges / Insert points
pt_9 = Point(dup_pts.Points)

# ----
num = Number(dispatch_7.ListA)

# ---- group: Olfactory
item_4 = ListItem(List=py3_3.column_name, Index=Slider(11, range=0..42), Wrap=True)
lookup_2 = LookupMetadata(MetadataGeometry=importshp.Metadata, SearchKey=item_4)
dispatch_8 = Dispatch(List=lookup_2, DispatchPattern=dup_pts.Status)  # -> ListA, ListB

# ---- group: Social
item_5 = ListItem(List=py3_3.column_name, Index=Slider(9, range=0..42), Wrap=True)
lookup_3 = LookupMetadata(MetadataGeometry=importshp.Metadata, SearchKey=item_5)
dispatch_9 = Dispatch(List=lookup_3, DispatchPattern=dup_pts.Status)  # -> ListA, ListB

# ---- group: Safety
item_6 = ListItem(List=py3_3.column_name, Index=Slider(10, range=0..42), Wrap=True)
lookup_4 = LookupMetadata(MetadataGeometry=importshp.Metadata, SearchKey=item_6)
dispatch_10 = Dispatch(List=lookup_4, DispatchPattern=dup_pts.Status)  # -> ListA, ListB

# ---- group: Thermal
item_7 = ListItem(List=py3_3.column_name, Index=Slider(7, range=0..42), Wrap=True)
lookup_5 = LookupMetadata(MetadataGeometry=importshp.Metadata, SearchKey=item_7)
dispatch_11 = Dispatch(List=lookup_5, DispatchPattern=dup_pts.Status)  # -> ListA, ListB

# ---- group: Acoustic
item_8 = ListItem(List=py3_3.column_name, Index=Slider(6, range=0..42), Wrap=True)
lookup_6 = LookupMetadata(MetadataGeometry=importshp.Metadata, SearchKey=item_8)
dispatch_12 = Dispatch(List=lookup_6, DispatchPattern=dup_pts.Status)  # -> ListA, ListB

# ---- group: Olfactory
item_9 = ListItem(List=py3_3.column_name, Index=Slider(5, range=0..42), Wrap=True)
lookup_7 = LookupMetadata(MetadataGeometry=importshp.Metadata, SearchKey=item_9)
dispatch_13 = Dispatch(List=lookup_7, DispatchPattern=dup_pts.Status)  # -> ListA, ListB

# ---- group: attach to edges
midpt_8 = CurveMiddle(Curve=crv_2)
pull_7 = PullPoint(Point=pt_9, Geometry=graft(midpt_8), ClosestOnly=True)  # -> ClosestPoint, Distance, Index
avr_7 = Average(Input=num)
number_slider_5 = Slider(9, range=0..10)
panel_37 = Panel(avr_7)
smaller_7 = SmallerThan(FirstNumber=pull_7.Distance, SecondNumber=number_slider_3)  # -> SmallerThan, OrEqualTo
dispatch_14 = Dispatch(List=dispatch_7.ListA, DispatchPattern=smaller_7.SmallerThan)  # -> ListA, ListB
dispatch_15 = Dispatch(List=pull_7.ClosestPoint, DispatchPattern=smaller_7.SmallerThan)  # -> ListA, ListB
pt_10 = Point(dispatch_15.ListA)
points_3 = PointList(Points=flatten(pt_10), Size=number_slider_5)
panel_38 = Panel(pt_10)

# ---- group: attach to edges / check index
points_4 = PointList(Points=flatten(midpt_8), Size=number_slider_5)

# ---- group: attach to edges / Output: reordered data
data = Data(dispatch_14.ListA)

# ---- group: Olfactory
dispatch_16 = Dispatch(List=dispatch_8.ListA, DispatchPattern=smaller_7.SmallerThan)  # -> ListA, ListB
item_10 = ListItem(List=dispatch_16.ListA, Index=0, Wrap=True)
nullrep = ReplaceNulls(Items=item_10, Replacements="0")  # -> flatten(Items), Count

# ---- group: Social
dispatch_17 = Dispatch(List=dispatch_9.ListA, DispatchPattern=smaller_7.SmallerThan)  # -> ListA, ListB
item_11 = ListItem(List=dispatch_17.ListA, Index=0, Wrap=True)
nullrep_2 = ReplaceNulls(Items=item_11, Replacements="0")  # -> flatten(Items), Count

# ---- group: Safety
dispatch_18 = Dispatch(List=dispatch_10.ListA, DispatchPattern=smaller_7.SmallerThan)  # -> ListA, ListB
item_12 = ListItem(List=dispatch_18.ListA, Index=0, Wrap=True)
nullrep_3 = ReplaceNulls(Items=item_12, Replacements="0")  # -> flatten(Items), Count

# ---- group: Thermal
dispatch_19 = Dispatch(List=dispatch_11.ListA, DispatchPattern=smaller_7.SmallerThan)  # -> ListA, ListB
item_13 = ListItem(List=dispatch_19.ListA, Index=0, Wrap=True)
nullrep_4 = ReplaceNulls(Items=item_13, Replacements="0")  # -> flatten(Items), Count

# ---- group: Acoustic
dispatch_20 = Dispatch(List=dispatch_12.ListA, DispatchPattern=smaller_7.SmallerThan)  # -> ListA, ListB
item_14 = ListItem(List=dispatch_20.ListA, Index=0, Wrap=True)
nullrep_5 = ReplaceNulls(Items=item_14, Replacements="0")  # -> flatten(Items), Count

# ---- group: Olfactory
dispatch_21 = Dispatch(List=dispatch_13.ListA, DispatchPattern=smaller_7.SmallerThan)  # -> ListA, ListB
item_15 = ListItem(List=dispatch_21.ListA, Index=0, Wrap=True)
nullrep_6 = ReplaceNulls(Items=item_15, Replacements="0")  # -> flatten(Items), Count

# ---- group: Acoustic
int = Integer(nullrep_5.Items)

# ----
int_2 = Integer(nullrep_3.Items)
int_3 = Integer(nullrep.Items)
int_4 = Integer(nullrep_2.Items)
int_5 = Integer(nullrep_4.Items)
item_16 = ListItem(List=nullrep_6.Items, Index="466", Wrap=True)
item_17 = ListItem(List=int_5, Index="466", Wrap=True)
item_18 = ListItem(List=int_2, Index="466", Wrap=True)
item_19 = ListItem(List=int_3, Index="466", Wrap=True)
item_20 = ListItem(List=int, Index="466", Wrap=True)
item_21 = ListItem(List=int_4, Index="466", Wrap=True)
concat_6 = Concatenate(FragmentA="acoustic", FragmentB=item_20, JoinSeparator="= ")
concat_7 = Concatenate(FragmentA="social", FragmentB=item_21, JoinSeparator="= ")
concat_8 = Concatenate(FragmentA="safety", FragmentB=item_18, JoinSeparator="= ")
concat_9 = Concatenate(FragmentA="thermal", FragmentB=item_17, JoinSeparator="= ")
concat_10 = Concatenate(FragmentA="olfactory", FragmentB=item_19, JoinSeparator="= ")
concat_11 = Concatenate(FragmentA=directory, FragmentB=item_16)
gradient = Gradient(
    LowerLimit=Slider(100, range=0..100),
    UpperLimit=Slider(0, range=0..100),
    Parameter=int,
    stops=[0: RGB(255, 0, 255), 0.498: RGB(255, 215, 0), 1: RGB(0, 255, 255)])
gradient_2 = Gradient(
    LowerLimit=Slider(100, range=0..100),
    UpperLimit=Slider(0, range=0..100),
    Parameter=int_5,
    stops=[0: RGB(255, 0, 255), 0.498: RGB(255, 215, 0), 1: RGB(0, 255, 255)])
gradient_3 = Gradient(
    LowerLimit=Slider(100, range=0..100),
    UpperLimit=Slider(0, range=0..100),
    Parameter=int_4,
    stops=[0: RGB(255, 0, 255), 0.498: RGB(255, 215, 0), 1: RGB(0, 255, 255)])
gradient_4 = Gradient(
    LowerLimit=Slider(100, range=0..100),
    UpperLimit=Slider(0, range=0..100),
    Parameter=int_2,
    stops=[0: RGB(255, 0, 255), 0.498: RGB(255, 215, 0), 1: RGB(0, 255, 255)])
gradient_5 = Gradient(
    LowerLimit=Slider(100, range=0..100),
    UpperLimit=Slider(0, range=0..100),
    Parameter=int_3,
    stops=[0: RGB(255, 0, 255), 0.498: RGB(255, 215, 0), 1: RGB(0, 255, 255)])
path_5 = FilePath(concat_11)
image_resource = ImageResource(path_5)
panel_39 = Panel(item_16)
col = Colour(gradient)
col_2 = Colour(gradient_2)
col_3 = Colour(gradient_3)
col_4 = Colour(gradient_4)
col_5 = Colour(gradient_5)
tag_3 = TextTag(Location=midpt_2, Text=int)
tag_4 = TextTag(Location=midpt_3, Text=int_5)
previewlw_2 = CustomPreviewLineweights(Geometry=crv_2, Shader=col, Thickness=number_slider_4, Absolute=False)
previewlw_3 = CustomPreviewLineweights(Geometry=crv_2, Shader=col_2, Thickness=number_slider_4, Absolute=False)
tag_5 = TextTag(Location=midpt_4, Text=int_4)
tag_6 = TextTag(Location=midpt_5, Text=int_2)
tag_7 = TextTag(Location=midpt_6, Text=int_3)
previewlw_4 = CustomPreviewLineweights(Geometry=crv_2, Shader=col_3, Thickness=number_slider_4, Absolute=False)
previewlw_5 = CustomPreviewLineweights(Geometry=crv_2, Shader=col_4, Thickness=number_slider_4, Absolute=False)
previewlw_6 = CustomPreviewLineweights(Geometry=crv_2, Shader=col_5, Thickness=number_slider_4, Absolute=False)

# ---- group: social vitality
py3_4 = Python3Script(POI_ave=lng_2, scores=int_4)  # -> out, pearson_r, pearson_p, spearman_rho, spearman_p, is_significant, summary_msg; inputs POI_ave: list, scores: list
#   port POI_ave: local 50m POI counts across all segments.
# ---------- py3_4: Python ----------
# Grasshopper Python 3 Script (Rhino 8)
# Inputs: POI_ave (List Access), scores (List Access)

import math

def clean_and_pair_lists(raw_x, raw_y):
    """Pairs POI_ave and scores, stripping out any null/None items together."""
    clean_x = []
    clean_y = []
    
    if not raw_x or not raw_y:
        return clean_x, clean_y

    for vx, vy in zip(raw_x, raw_y):
        if vx is None or vy is None:
            continue
        try:
            fx = float(vx)
            fy = float(vy)
            clean_x.append(fx)
            clean_y.append(fy)
        except (ValueError, TypeError):
            continue

    return clean_x, clean_y

def get_ranks(vec):
    """Calculates ranks for Spearman correlation handling ties."""
    sorted_vec = sorted(enumerate(vec), key=lambda x: x[1])
    ranks = [0] * len(vec)
    i = 0
    while i < len(vec):
        j = i
        while j < len(vec) - 1 and sorted_vec[j][1] == sorted_vec[j+1][1]:
            j += 1
        rank = (i + j + 2) / 2.0
        for k in range(i, j + 1):
            ranks[sorted_vec[k][0]] = rank
        i = j + 1
    return ranks

def calc_pearson(x_list, y_list):
    n = len(x_list)
    if n == 0:
        return 0.0
    mean_x = sum(x_list) / n
    mean_y = sum(y_list) / n
    
    num = sum((x - mean_x) * (y - mean_y) for x, y in zip(x_list, y_list))
    den_x = sum((x - mean_x) ** 2 for x in x_list)
    den_y = sum((y - mean_y) ** 2 for y in y_list)
    
    if den_x == 0 or den_y == 0:
        return 0.0
    return num / math.sqrt(den_x * den_y)

def approx_p_value(r, n):
    """Calculates two-tailed p-value from t-distribution."""
    if abs(r) >= 1.0 or n <= 2:
        return 0.0
    t = abs(r) * math.sqrt((n - 2) / (1 - r ** 2))
    p = 2 * (1 - 0.5 * (1 + math.erf(t / math.sqrt(2))))
    return max(p, 0.0)

# 1. Read input parameters (support POI_ave & scores OR fallback X & Y)
raw_x = POI_ave if 'POI_ave' in globals() and POI_ave is not None else (X if 'X' in globals() else [])
raw_y = scores if 'scores' in globals() and scores is not None else (Y if 'Y' in globals() else [])

# 2. Clean and align paired data
x_data, y_data = clean_and_pair_lists(raw_x, raw_y)

# 3. Compute statistics if sample size > 2
if len(x_data) <= 2:
    pearson_r = 0.0
    pearson_p = 1.0
    spearman_rho = 0.0
    spearman_p = 1.0
    is_significant = False
    
    summary_msg = f"""========================================
DATA CHECK WARNING:
========================================
Received raw items:
  • POI_ave count : {len(raw_x)}
  • scores count  : {len(raw_y)}
Valid paired numeric samples: {len(x_data)}

Action required:
1. Right-click 'POI_ave' -> Select 'Flatten' & 'List Access'
2. Right-click 'scores'  -> Select 'Flatten' & 'List Access'
========================================"""

else:
    n = len(x_data)

    # Pearson Correlation
    pearson_r = calc_pearson(x_data, y_data)
    pearson_p = approx_p_value(pearson_r, n)

    # Spearman Rank Correlation
    rank_x = get_ranks(x_data)
    rank_y = get_ranks(y_data)
    spearman_rho = calc_pearson(rank_x, rank_y)
    spearman_p = approx_p_value(spearman_rho, n)

    is_significant = bool(spearman_p < 0.05)

    summary_msg = f"""========================================
STATISTICAL VALIDATION RESULTS
========================================
Valid Segments (N): {n}

PEARSON CORRELATION (Linear):
  • r-value  : {pearson_r:+.4f}
  • p-value  : {pearson_p:.4e}

SPEARMAN CORRELATION (Rank-Order):
  • rho-value: {spearman_rho:+.4f}
  • p-value  : {spearman_p:.4e}

SIGNIFICANCE ASSESSMENT:
  • Statistically Significant (p < 0.05): {is_significant}
========================================
"""
# ---------- end py3_4 ----------
panel_40 = Panel(py3_4.summary_msg)

# ---- group: olfactory resonance
py3_5 = Python3Script(POI_ave=lng_2, scores=int_3)  # -> out, pearson_r, pearson_p, spearman_rho, spearman_p, is_significant, summary_msg; inputs POI_ave: list, scores: list; same code as py3_4
panel_41 = Panel(py3_5.summary_msg)

# ---- group: territorial safety
py3_6 = Python3Script(POI_ave=lng_2, scores=int_2)  # -> out, pearson_r, pearson_p, spearman_rho, spearman_p, is_significant, summary_msg; inputs POI_ave: list, scores: list; same code as py3_4
panel_42 = Panel(py3_6.summary_msg)

# ---- group: thermal comfort
py3_7 = Python3Script(POI_ave=lng_2, scores=int_5)  # -> out, pearson_r, pearson_p, spearman_rho, spearman_p, is_significant, summary_msg; inputs POI_ave: list, scores: list; same code as py3_4
panel_43 = Panel(py3_7.summary_msg)

# ---- group: acoustic comfort
py3_8 = Python3Script(POI_ave=lng_2, scores=nullrep_5.Items)  # -> out, pearson_r, pearson_p, spearman_rho, spearman_p, is_significant, summary_msg; inputs POI_ave: list, scores: list; same code as py3_4
panel_44 = Panel(py3_8.summary_msg)

# ---- group: Column Values 001
py3_9 = Python3Script(dataFrame=py3.GeoDataFrame, column_name="rationale")  # -> columnValues
# ---------- py3_9: Python ----------
columnValues = dataFrame[column_name].tolist()
# ---------- end py3_9 ----------

# ----
panel_45 = Panel(py3_9)
viewer = ParamViewer(py3_9)

# ---- group: Rationale
dispatch_22 = Dispatch(List=py3_9, DispatchPattern=dup_pts.Status)  # -> ListA, ListB

# ---- group: Rationale / Select cylinder
dispatch_23 = Dispatch(List=dispatch_22.ListA, DispatchPattern=smaller_7.SmallerThan)  # -> ListA, ListB
item_22 = ListItem(List=dispatch_23.ListA, Index=0, Wrap=True)
nullrep_7 = ReplaceNulls(Items=item_22, Replacements="0")  # -> flatten(Items), Count
item_23 = ListItem(List=nullrep_7.Items, Index="466", Wrap=True)

# ----
panel_46 = Panel(item_23)

# ---- group: attach to edges (continued)
item_24 = ListItem(List=data, Index=0, Wrap=True)
panel_47 = Panel(item_24)
nullrep_8 = ReplaceNulls(Items=item_24, Replacements="0")  # -> flatten(Items), Count

# ----
conditional_remap = Python3Script(selection=item_3, values=nullrep_8.Items, conditional="stress")  # -> remapped_values; inputs selection: String, values: list of Double, conditional: String
# ---------- conditional_remap: Python ----------
"""
Grasshopper Python Script: Conditional Remap for Somatic Stress
Inputs:
    values: List of floats (List Access)
    selection: String from Value List (Item Access)
    conditional: String search term (Item Access)
Outputs:
    remapped_values: Processed values
"""

def to_python_float(val):
    """Safely unwrap GH_Goo / .NET managed objects and convert to float."""
    if val is None:
        return None
    # Extract underlying C# value if wrapped in GH_Number or GH_ObjectWrapper
    if hasattr(val, "Value"):
        val = val.Value
    try:
        return float(val)
    except (ValueError, TypeError):
        return None

# Default initialization to prevent output binding errors
remapped_values = []

if values is not None and selection is not None:
    # Handle single scalar inputs gracefully
    if not isinstance(values, (list, tuple)):
        values = [values]

    # Unwrap string inputs safely
    cond_raw = conditional if 'conditional' in globals() and conditional is not None else ""
    cond_str = str(cond_raw.Value if hasattr(cond_raw, "Value") else cond_raw).lower()
    sel_raw = selection
    sel_str = str(sel_raw.Value if hasattr(sel_raw, "Value") else sel_raw).lower()

    # Check if condition is met
    is_true = cond_str in sel_str if cond_str else True

    if is_true:
        remapped = []
        for v in values:
            num = to_python_float(v)
            if num is not None and num > 0:
                remapped.append(100.0 - num)
            else:
                remapped.append(0.0)
        remapped_values = remapped
    else:
        # Return original values as Python floats
        remapped_values = [to_python_float(v) for v in values]
# ---------- end conditional_remap ----------

# ---- group: Check individual segments
item_25 = ListItem(List=conditional_remap, Index="126", Wrap=True)
item_26 = ListItem(List=crv_2, Index="126", Wrap=True)
panel_48 = Panel(item_26)
panel_49 = Panel(item_25)

# ---- group: attach to edges (continued)
gradient_6 = Gradient(
    LowerLimit=Slider(100, range=0..100),
    UpperLimit=Slider(0, range=0..100),
    Parameter=conditional_remap,
    stops=[0: RGB(255, 0, 255), 0.498: RGB(255, 69, 0), 1: RGB(0, 255, 255)])
col_6 = Colour(gradient_6)
previewlw_7 = CustomPreviewLineweights(Geometry=crv_2, Shader=col_6, Thickness=number_slider_4, Absolute=False)

# ---- group: attach to edges / matched & filtered
tag_8 = TextTag(Location=midpt_8, Text=flatten(conditional_remap))

# ----
tag_9 = TextTag(Location=midpt, Text=conditional_remap)
panel_50 = Panel(conditional_remap)
item_27 = ListItem(List=conditional_remap, Index="466", Wrap=True)
concat_12 = Concatenate(FragmentA="stress", FragmentB=item_27, JoinSeparator="= ")
merge = Merge(Data1=concat_6, Data2=concat_9, Data3=concat_12, Data4=concat_7, Data5=concat_8, Data6=concat_10)  # -> flatten(Result)
scores = Panel(merge)

# ---- group: somatic stress
py3_10 = Python3Script(POI_ave=lng_2, scores=conditional_remap)  # -> out, pearson_r, pearson_p, spearman_rho, spearman_p, is_significant, summary_msg; inputs POI_ave: list, scores: list; same code as py3_4
panel_51 = Panel(py3_10.summary_msg)
