# Grasshopper definition atmosphericScore-amenities.gh (Grasshopper 1.0.8)
# plug-ins: Urbano, Human

# ---- group: LA-Downtown
path = FilePath("C:\Users\l03063058\Desktop\Github\DRVaa\Grasshopper\cityModels\SJO_match_large.osm")  # disabled

# ---- group: DLA01
path_2 = FilePath("C:\Users\l03063058\Downloads\map.osm")  # disabled

# ----
cluster = Cluster(url=path_2)  # -> building, street_network, street_segment_curves; disabled
model = BuildUrbanoModel(Buildings=flatten(cluster.building), StreetNetwork=cluster.street_network, BuildToggle=True)  # -> UrbanoModel, BuildingCurves, Activities; disabled
inbldg = InspectBuilding(Building=model.BuildingCurves, DefaultHeight=10)  # -> Geometry, Metadata, Amenity, graft(BuildingMesh); disabled
geo = Geometry(inbldg.Geometry)  # disabled
panel = Panel("name")  # disabled
demeta = DeconstructMetadata(Metadata=inbldg.Metadata)  # -> Keys, Values; disabled
# 3. Metadata
cset = CreateSet(List=flatten(demeta.Keys))  # -> Set, Map; disabled
tsort = SortText(Keys=cset.Set, Culture=127)  # -> Keys, Values; disabled
area = Area(Geometry=inbldg.Geometry)  # -> Area, graft(Centroid); disabled
panel_2 = Panel(tsort.Keys)  # disabled
tmatch = MatchText(Text=demeta.Keys, Pattern=panel, Case=invert(True))  # disabled
pt = Point(area.Centroid)  # disabled
number_slider = Slider(2024, range=1800..2024)  # disabled
dispatch = Dispatch(List=demeta.Values, DispatchPattern=tmatch)  # -> ListA, ListB; disabled
swatch = ColourSwatch(SwatchColor=RGB(25, 255, 255))  # disabled
panel_3 = Panel("black")  # disabled
panel_4 = Panel(dispatch.ListA)  # disabled
panel_5 = Panel(demeta.Values)  # disabled
tag = TextTag(Location=area.Centroid, Text=dispatch.ListA, Colour=swatch)  # disabled
smaller = SmallerThan(FirstNumber=dispatch.ListA, SecondNumber=number_slider)  # -> SmallerThan, OrEqualTo; disabled
larger = LargerThan(FirstNumber=dispatch.ListA, SecondNumber=number_slider)  # -> LargerThan, OrEqualTo; disabled
number_slider_2 = Slider(263, range=0..1000)  # disabled
dispatch_2 = Dispatch(List=inbldg.BuildingMesh, DispatchPattern=smaller.SmallerThan)  # -> ListA, ListB; disabled
number_slider_3 = Slider(100, range=0..100)  # disabled
panel_6 = Panel("200,200,0")  # disabled
fonts = FontTable()  # disabled
swatch_2 = ColourSwatch(SwatchColor=RGB(183, 21, 60))  # disabled
panel_7 = Panel("consolas")  # disabled
mesh = Mesh(dispatch_2.ListA)  # disabled
swatch_3 = ColourSwatch(SwatchColor=RGB(255, 0, 119))  # disabled
preview = CustomPreview(Geometry=mesh, Material=swatch_3)  # disabled
texttoscreen = RenderTextToScreen(Text=number_slider, Location=panel_6, Size=number_slider_3, Color=swatch_2, Font=panel_7, m_scWithvp=False)  # disabled
item = ListItem(List=fonts, Index=number_slider_2, Wrap=True)  # disabled
panel_8 = Panel(fonts)  # disabled

panel_9 = Panel("2787")
urbano_model = Relay()
activities = Relay()

panel_10 = Panel(activities)
item_2 = ListItem(List=activities, Index=Slider(12, range=0..100), Wrap=True)

panel_11 = Panel("fast_food")
panel_12 = Panel("library")
panel_13 = Panel("restaurant")

panel_14 = Panel("""tree
railway""")
panel_15 = Panel("""amenity=cafe
amenity=restaurant
amenity=bar
amenity=pub
amenity=fast_food
amenity=ice_cream
amenity=food_court
amenity=biergarten
amenity=marketplace
amenity=community_centre
amenity=arts_centre
amenity=theatre
amenity=cinema
amenity=library
amenity=place_of_worship
amenity=bank
amenity=post_office
amenity=pharmacy
amenity=fountain
amenity=bench
amenity=school
amenity=kindergarten
shop=convenience
shop=bakery
shop=supermarket
shop=greengrocer
shop=clothes
shop=books
shop=kiosk
shop=boutique
shop=mall
shop=department_store
tourism=museum
tourism=gallery
tourism=attraction
leisure=plaza
leisure=park
leisure=playground
leisure=sports_centre
leisure=fitness_station
leisure=pitch
highway=pedestrian
highway=living_street""")

# ----
# 1. OSM
path_3 = FilePath("C:\Users\l03063058\Desktop\Github\DRVaa\Grasshopper\cityModels\SJO_match_large.osm")
importosm = ImportOSMFeatures(OSMPathOrURL=path_3, OSMFeatureType="street", Format="xml", ImportAltitude=False)  # -> Points, Metadata, UTMZone, TranslationVector
importosm_2 = ImportOSMFeatures(OSMPathOrURL=path_3, OSMFeatureType="amenity", Format="xml", ImportAltitude=False)  # -> Points, Metadata, UTMZone, TranslationVector
importosm_3 = ImportOSMFeatures(OSMPathOrURL=path_3, OSMFeatureType="building", Format="xml", ImportAltitude=False)  # -> Points, Metadata, UTMZone, TranslationVector
pline = PolyLine(Vertices=importosm.Points, Closed=False)
pline_2 = PolyLine(Vertices=importosm_3.Points, Closed=invert(False))
streetnet = CreateStreetNetwork(
    StreetCurves=flatten(pline),
    Metadata=flatten(importosm.Metadata),
    SplitStreetCurves=False,
    UTMZone=importosm.UTMZone,
    TranslationVector=importosm.TranslationVector)  # -> StreetNetwork, StreetSegmentCurves, UTMZone, TranslationVector
amen = CreateAmenity(PointLocationOfAmenity=importosm_2.Points, Metadata=importosm_2.Metadata)
lookup = LookupMetadata(MetadataGeometry=importosm_2.Metadata, SearchKey="amenity")
demeta_2 = DeconstructMetadata(Metadata=amen)  # -> Keys, Values
panel_16 = Panel(lookup)
panel_17 = Panel(demeta_2.Keys)
panel_18 = Panel(demeta_2.Values)

importosm_4 = ImportOSMFeatures(OSMPathOrURL=path_3, OSMFeatureType="amenity", Format="xml", ImportAltitude=False)  # -> Points, Metadata, UTMZone, TranslationVector
pline_3 = PolyLine(Vertices=importosm_4.Points, Closed=invert(False))
lookup_2 = LookupMetadata(MetadataGeometry=importosm_4.Metadata)
demeta_3 = DeconstructMetadata(Metadata=importosm_4.Metadata)  # -> Keys, Values
panel_19 = Panel(demeta_3.Keys)
pt_2 = Point(importosm_2.Points)
clean = CleanTree(RemoveNulls=True, RemoveInvalid=True, RemoveEmpty=invert(False), Tree=pline_2)
panel_20 = Panel(demeta_3.Values)

bldg = CreateBuilding(BuildingCurve=clean, Metadata=importosm_3.Metadata, AmenitiesInBuilding=amen)
model_2 = BuildUrbanoModel(Buildings=flatten(bldg), StreetNetwork=streetnet.StreetNetwork, BuildToggle=True)  # -> UrbanoModel, BuildingCurves, Activities
inbldg_2 = InspectBuilding(Building=bldg, UrbanoModel=model_2.UrbanoModel, DefaultHeight=10)  # -> Geometry, Metadata, Amenity, BuildingMesh
panel_21 = Panel(model_2.Activities)
findamen = FindAmenities(UrbanoModel=model_2.UrbanoModel, Activity="pharmacy")
panel_22 = Panel(findamen)
panel_23 = Panel(inbldg_2.Amenity)
preview_2 = CustomPreview(
    Geometry=inbldg_2.BuildingMesh,
    Material={diffuse=RGB(221, 160, 221), emission=RGB(66, 48, 66), shine=0.5, specular=RGB(255, 255, 255), transparency=0})
item_3 = ListItem(List=flatten(inbldg_2.BuildingMesh), Index=Slider(1, range=0..1000), Wrap=True)

crv = Curve(inbldg_2.Geometry)
osm_poi_extractor = Python3Script(osm_file=path_3, osm_tags=panel_15, UTM=importosm_2.UTMZone, Vec=importosm_2.TranslationVector, run=Toggle(True))  # -> status_msg, points, names, categories, tag_values, utm_coords, poi_metadata, category_colors; inputs osm_file: String, osm_tags: String, run: Boolean
# ---------- osm_poi_extractor: Python ----------
import json
import math
import os
import xml.etree.ElementTree as ET
import Rhino.Geometry as rg
import System.Drawing as drawing

# Alias SystemColor for drawing operations
SystemColor = drawing.Color

# ==============================================================================
# WGS84 UTM PROJECTION ENGINE
# ==============================================================================


def latlon_to_utm(lat, lon):
    """Converts Latitude and Longitude to exact WGS84 UTM Easting and Northing in meters."""
    a = 6378137.0
    f = 1 / 298.257223563
    b = a * (1 - f)
    e2 = (a**2 - b**2) / a**2
    e_prime2 = (a**2 - b**2) / b**2

    zone = int((lon + 180) / 6) + 1
    lon0 = (zone - 1) * 6 - 180 + 3

    lat_rad = math.radians(lat)
    lon_rad = math.radians(lon)
    lon0_rad = math.radians(lon0)

    N = a / math.sqrt(1 - e2 * math.sin(lat_rad) ** 2)
    T = math.tan(lat_rad) ** 2
    C = e_prime2 * math.cos(lat_rad) ** 2
    A = (lon_rad - lon0_rad) * math.cos(lat_rad)

    M = a * (
        (1 - e2 / 4 - 3 * e2**2 / 64 - 5 * e2**3 / 256) * lat_rad
        - (3 * e2 / 8 + 3 * e2**2 / 32 + 45 * e2**3 / 1024)
        * math.sin(2 * lat_rad)
        + (15 * e2**2 / 256 + 45 * e2**3 / 1024) * math.sin(4 * lat_rad)
        - (35 * e2**3 / 3072) * math.sin(6 * lat_rad)
    )

    k0 = 0.9996
    easting = k0 * N * (
        A
        + (1 - T + C) * A**3 / 6
        + (5 - 18 * T + T**2 + 72 * C - 58 * e_prime2) * A**5 / 120
    ) + 500000.0

    northing = k0 * (
        M
        + N
        * math.tan(lat_rad)
        * (
            A**2 / 2
            + (5 - T + 9 * C + 4 * C**2) * A**4 / 24
            + (61 - 58 * T + T**2 + 600 * C - 330 * e_prime2) * A**6 / 720
        )
    )
    if lat < 0:
        northing += 10000000.0

    return easting, northing, zone


# ==============================================================================
# HELPER FUNCTIONS
# ==============================================================================


def check_tag_match(tags_dict, query_input):
    """Smart tag matcher: supports Panels with single words like 'tree', key=val, dicts, or JSON."""
    if not tags_dict:
        return False, None, None

    if isinstance(query_input, dict):
        for k, v in query_input.items():
            if k in tags_dict:
                if (
                    v is True
                    or tags_dict[k] == v
                    or (isinstance(v, list) and tags_dict[k] in v)
                ):
                    return True, k, tags_dict[k]
        return False, None, None

    q_str = str(query_input).strip() if query_input else "amenity"

    try:
        parsed_json = json.loads(q_str)
        if isinstance(parsed_json, dict):
            return check_tag_match(tags_dict, parsed_json)
    except Exception:
        pass

    statements = q_str.replace("\n", ";").split(";")
    for stmt in statements:
        stmt = stmt.strip()
        if not stmt:
            continue

        if "=" in stmt:
            k, v = stmt.split("=", 1)
            k_clean, v_clean = k.strip().lower(), v.strip().lower()
            for tag_k, tag_v in tags_dict.items():
                if (
                    tag_k.lower() == k_clean
                    and str(tag_v).lower() == v_clean
                ):
                    return True, tag_k, tag_v
        else:
            q_lower = stmt.lower()
            for tag_k, tag_v in tags_dict.items():
                k_lower, v_lower = tag_k.lower(), str(tag_v).lower()
                if (
                    q_lower == k_lower
                    or q_lower == v_lower
                    or q_lower in v_lower
                ):
                    return True, tag_k, tag_v

    return False, None, None


def get_category_color(category_key, tag_value):
    """Returns color encoding for Grasshopper visual display."""
    val = str(tag_value).lower()
    cat = str(category_key).lower()

    if (
        cat == "amenity"
        and val in ["restaurant", "cafe", "fast_food", "food_court", "bar"]
    ) or val == "bakery":
        return SystemColor.FromArgb(255, 255, 87, 34)  # Deep Orange (Food)
    elif cat == "shop" or val in ["bank", "pharmacy", "supermarket"]:
        return SystemColor.FromArgb(255, 33, 150, 243)  # Blue (Commercial)
    elif (
        cat == "leisure"
        or val in ["park", "garden", "playground"]
        or cat == "natural"
        or val == "tree"
    ):
        return SystemColor.FromArgb(255, 76, 175, 80)  # Green (Vegetation)
    elif cat == "landuse" or val in ["industrial", "fuel", "railway"]:
        return SystemColor.FromArgb(255, 121, 85, 72)  # Brown/Industrial
    else:
        return SystemColor.FromArgb(255, 255, 193, 7)  # Amber (General)


# ==============================================================================
# MAIN EXECUTION
# ==============================================================================
out_points = []
out_names = []
out_categories = []
out_tag_values = []
out_utm_coords = []
out_metadata = []
out_colors = []
status = []

if not run:
    points = []
    names = []
    categories = []
    tag_values = []
    utm_coords = []
    poi_metadata = []
    category_colors = []
    status_msg = "Execution paused (run = False)."
else:
    file_path = str(osm_file).strip() if osm_file else ""
    if not os.path.exists(file_path):
        status_msg = f"ERROR: File not found at path: '{file_path}'"
        points, names, categories, tag_values, utm_coords, poi_metadata, category_colors = (
            [],
            [],
            [],
            [],
            [],
            [],
            [],
        )
    else:
        try:
            status.append(
                f"Reading OSM File: '{os.path.basename(file_path)}'..."
            )
            tree = ET.parse(file_path)
            root = tree.getroot()

            # 1. Parse Nodes & UTM Coordinates
            nodes_coords = {}
            nodes_utm = {}

            for node in root.findall("node"):
                node_id = node.get("id")
                lat = float(node.get("lat"))
                lon = float(node.get("lon"))
                nodes_coords[node_id] = (lat, lon)

                easting, northing, zone = latlon_to_utm(lat, lon)
                nodes_utm[node_id] = (easting, northing, zone)

            # 2. Resolve Urbano Reference Origin Vector
            ref_easting, ref_northing = None, None

            if Vec is not None:
                if hasattr(Vec, "X") and hasattr(Vec, "Y"):
                    vx, vy = Vec.X, Vec.Y
                elif isinstance(Vec, (list, tuple)) and len(Vec) >= 2:
                    vx, vy = float(Vec[0]), float(Vec[1])
                else:
                    clean = (
                        str(Vec)
                        .replace("(", "")
                        .replace(")", "")
                        .replace("[", "")
                        .replace("]", "")
                        .split(",")
                    )
                    vx, vy = float(clean[0]), float(clean[1])

                ref_easting = abs(vx)
                ref_northing = abs(vy)

                status.append(
                    f"Urbano Reference Origin Resolved: Easting={ref_easting:.2f}, Northing={ref_northing:.2f}"
                )

            if ref_easting is None or ref_northing is None:
                all_e = [u[0] for u in nodes_utm.values()]
                all_n = [u[1] for u in nodes_utm.values()]
                ref_easting = min(all_e)
                ref_northing = min(all_n)

            # 3. Extract POI Nodes
            for node in root.findall("node"):
                node_id = node.get("id")
                lat, lon = nodes_coords[node_id]
                easting, northing, zone = nodes_utm[node_id]

                tags = {
                    tag.get("k"): tag.get("v") for tag in node.findall("tag")
                }
                is_match, cat_key, cat_val = check_tag_match(tags, osm_tags)

                if is_match:
                    x = easting - ref_easting
                    y = northing - ref_northing
                    pt = rg.Point3d(x, y, 0.0)

                    poi_name = tags.get("name", f"Unnamed {cat_val.title()}")

                    # Formatted text block compatible with Urbano / GH Deconstruction
                    meta_text = (
                        f"Name = {poi_name}\n"
                        f"Category = {cat_key}\n"
                        f"TagValue = {cat_val}\n"
                        f"UTM_Easting = {easting:.2f}\n"
                        f"UTM_Northing = {northing:.2f}\n"
                        f"UTM_Zone = {zone}\n"
                        f"Latitude = {lat:.6f}\n"
                        f"Longitude = {lon:.6f}"
                    )

                    out_points.append(pt)
                    out_names.append(poi_name)
                    out_categories.append(cat_key)
                    out_tag_values.append(cat_val)
                    out_utm_coords.append(
                        f"{easting:.2f}, {northing:.2f} (Zone {zone})"
                    )
                    out_metadata.append(meta_text)
                    out_colors.append(get_category_color(cat_key, cat_val))

            # 4. Extract POI Ways (Buildings / Centroids)
            for way in root.findall("way"):
                way_id = way.get("id")
                tags = {
                    tag.get("k"): tag.get("v") for tag in way.findall("tag")
                }
                is_match, cat_key, cat_val = check_tag_match(tags, osm_tags)

                if is_match:
                    nd_refs = [
                        nd.get("ref")
                        for nd in way.findall("nd")
                        if nd.get("ref") in nodes_coords
                    ]
                    if nd_refs:
                        avg_lat = sum(
                            nodes_coords[nid][0] for nid in nd_refs
                        ) / len(nd_refs)
                        avg_lon = sum(
                            nodes_coords[nid][1] for nid in nd_refs
                        ) / len(nd_refs)

                        avg_easting, avg_northing, zone = latlon_to_utm(
                            avg_lat, avg_lon
                        )

                        x = avg_easting - ref_easting
                        y = avg_northing - ref_northing
                        pt = rg.Point3d(x, y, 0.0)

                        poi_name = tags.get(
                            "name", f"Unnamed {cat_val.title()}"
                        )

                        meta_text = (
                            f"Name = {poi_name}\n"
                            f"Category = {cat_key}\n"
                            f"TagValue = {cat_val}\n"
                            f"UTM_Easting = {avg_easting:.2f}\n"
                            f"UTM_Northing = {avg_northing:.2f}\n"
                            f"UTM_Zone = {zone}\n"
                            f"Latitude = {avg_lat:.6f}\n"
                            f"Longitude = {avg_lon:.6f}"
                        )

                        out_points.append(pt)
                        out_names.append(poi_name)
                        out_categories.append(cat_key)
                        out_tag_values.append(cat_val)
                        out_utm_coords.append(
                            f"{avg_easting:.2f}, {avg_northing:.2f} (Zone {zone})"
                        )
                        out_metadata.append(meta_text)
                        out_colors.append(get_category_color(cat_key, cat_val))

            status.append(
                f"Successfully extracted {len(out_points)} POIs aligned to Urbano."
            )

            # Assign Component Outputs
            points = out_points
            names = out_names
            categories = out_categories
            tag_values = out_tag_values
            utm_coords = out_utm_coords
            poi_metadata = out_metadata
            category_colors = out_colors
            status_msg = "\n".join(status)

        except Exception as e:
            status_msg = f"ERROR parsing OSM file: {str(e)}"
            points, names, categories, tag_values, utm_coords, poi_metadata, category_colors = (
                [],
                [],
                [],
                [],
                [],
                [],
                [],
            )
# ---------- end osm_poi_extractor ----------
panel_24 = Panel(osm_poi_extractor.status_msg)
demeta_4 = DeconstructMetadata(Metadata=osm_poi_extractor.category_colors)  # -> Keys, Values
pt_3 = Point(osm_poi_extractor.points)
viewer = ParamViewer(osm_poi_extractor.points)
panel_25 = Panel(pt_3)
panel_26 = Panel(osm_poi_extractor.categories)

# ----
# 2. Usos
panel_27 = Panel(path)  # disabled
cluster_2 = Cluster(url=path)  # -> building, street_network, street_segment_curves; disabled
model_3 = BuildUrbanoModel(Buildings=flatten(cluster_2.building), StreetNetwork=cluster_2.street_network, BuildToggle=True)  # -> UrbanoModel, BuildingCurves, Activities; disabled
panel_28 = Panel(activities)
txt = Text(panel_10)
lng = ListLength(List=txt)
random = Random(Range=Domain(0, 1), Number=lng, Seed=2)
gradient = Gradient(
    LowerLimit=0,
    UpperLimit=1,
    Parameter=random,
    stops=[0: RGB(243, 57, 0), 0.1: RGB(236, 27, 60), 0.2: RGB(210, 0, 118), 0.3: RGB(103, 0, 120), 0.4: RGB(39, 72, 161), 0.5: RGB(1, 192, 229), 0.6: RGB(18, 178, 90), 0.7: RGB(79, 186, 8), 0.8: RGB(220, 237, 32), 0.9: RGB(247, 159, 20), 1: RGB(243, 57, 0)])
col = Colour(simplify(graft(gradient)))

# ---- group: Inspect Amenities
findamen_2 = FindAmenities(UrbanoModel=urbano_model, Activity=txt)
inamen = InspectAmenity(Amenity=findamen_2)  # -> Name, Activities, Host, Metadata

# ----
panel_29 = Panel(inamen.Metadata)

# ---- group: Inspect Buildings
inbldg_3 = InspectBuilding(Building=inamen.Host, DefaultHeight=10)  # -> Geometry, Metadata, Amenity, simplify(BuildingMesh)

# ----
srf = Surface(inbldg_3.Geometry)

preview_3 = CustomPreview(Geometry=inbldg_3.BuildingMesh, Material=col)

# ==== cluster Cluster
url = ClusterInput()
# URL / File Path
url_2 = Text(url)

# ---- group: Import Geometries
import_osm_features = ImportOSMFeatures(OSMPathOrURL=url_2, OSMFeatureType="street", Format="xml", ImportAltitude=False)  # -> Points, Metadata, UTMZone, TranslationVector
import_osm_features_2 = ImportOSMFeatures(OSMPathOrURL=url_2, OSMFeatureType="building", Format="xml", ImportAltitude=False)  # -> Points, Metadata, UTMZone, TranslationVector
import_osm_features_3 = ImportOSMFeatures(OSMPathOrURL=url_2, OSMFeatureType="amenity", Format="xml", ImportAltitude=False)  # -> Points, Metadata, UTMZone, TranslationVector

# ---- group: Add Amenity Capacity
lookup_metadata = LookupMetadata(MetadataGeometry=import_osm_features_3.Metadata, SearchKey="amenity")
amenity_capacity = AmenityCapacity(
    Activity=lookup_metadata,
    Area=-1,
    LogisticsAreaProportion=0.2,
    AmenityCapacityData="""post_office, 5, 15
bank, 5, 15
cinema, 1, 248
theatre, 1, 215
arts_centre, 3, 20
department_store, 1, 78
supermarket_store, 2, 32
convenience_store, 1, 39
hardware_store, 1, 50
pharmacy, 1, 42
restaurant, 2, 35
fast_food, 1, 36
cafe, 1, 50
bar, 1, 47
pub, 1, 47
clothes_store, 2, 21
books_store, 1, 26
beauty_store, 1, 27
shoes_store, 1, 38""")
merge_metadata = MergeMetadata(Metadata=amenity_capacity, Metadata_2=import_osm_features_3.Metadata)

# ---- group: Build Basic Model
polyline = PolyLine(Vertices=import_osm_features_2.Points, Closed=False)
polyline_2 = PolyLine(Vertices=import_osm_features.Points, Closed=False)
create_amenity = CreateAmenity(PointLocationOfAmenity=import_osm_features_3.Points, Metadata=merge_metadata)
create_street_network = CreateStreetNetwork(
    StreetCurves=flatten(polyline_2),
    Metadata=flatten(import_osm_features.Metadata),
    SplitStreetCurves=True,
    UTMZone=import_osm_features.UTMZone,
    TranslationVector=import_osm_features.TranslationVector)  # -> StreetNetwork, StreetSegmentCurves, UTMZone, TranslationVector
arrange_amenities_by_building = ArrangeAmenitiesByBuilding(Amenities=flatten(create_amenity), Buildings=flatten(polyline))  # -> AmenitiesByBuilding, Buildings
create_building = CreateBuilding(
    BuildingCurve=arrange_amenities_by_building.Buildings,
    Metadata=import_osm_features_2.Metadata,
    AmenitiesInBuilding=arrange_amenities_by_building.AmenitiesByBuilding)

# ----
street_network = ClusterOutput(create_street_network.StreetNetwork)
street_segment_curves = ClusterOutput(create_street_network.StreetSegmentCurves)
building = ClusterOutput(create_building)
