# Grasshopper definition AI_summary.gh (Grasshopper 1.0.8)
# plug-ins: CORE.Toolbox.Grasshopper, Urbano, Human, ANTflow.Components, MetaHopper

# ---- group: INPUT
path = FilePath("C:\Users\l03063058\Desktop\Github\DRVaa\Grasshopper\cityModels\SJO_match_large.osm")
panel = Panel(path)

# ----
# URBANO 1
panel_2 = Panel(path)

# ---- group: CSV file with perception data for each street segment (through LLM or participatory design)
path_2 = FilePath("C:\Users\l03063058\Desktop\Github\DRVaa\street_segments_scored_360_rationale.csv")

# ----
panel_3 = Panel(path_2)

importosm = ImportOSMFeatures(OSMPathOrURL=path, OSMFeatureType="building", Format="xml", ImportAltitude=False)  # -> Points, Metadata, UTMZone, TranslationVector
importosm_2 = ImportOSMFeatures(OSMPathOrURL=path, OSMFeatureType="street", Format="xml", ImportAltitude=False)  # -> Points, Metadata, UTMZone, TranslationVector
importosm_3 = ImportOSMFeatures(OSMPathOrURL=path, OSMFeatureType="amenity", Format="xml", ImportAltitude=False)  # -> Points, Metadata, UTMZone, TranslationVector
pline = PolyLine(Vertices=importosm.Points, Closed=False)
pline_2 = PolyLine(Vertices=importosm_2.Points, Closed=False)
amen = CreateAmenity(PointLocationOfAmenity=importosm_3.Points, Metadata=importosm_3.Metadata)
streetnet = CreateStreetNetwork(
    StreetCurves=flatten(pline_2),
    Metadata=flatten(importosm_2.Metadata),
    SplitStreetCurves=True,
    UTMZone=importosm_2.UTMZone,
    TranslationVector=importosm_2.TranslationVector)  # -> StreetNetwork, StreetSegmentCurves, UTMZone, TranslationVector
bldg = CreateBuilding(BuildingCurve=pline, Metadata=importosm.Metadata, AmenitiesInBuilding=amen)
model = BuildUrbanoModel(Buildings=flatten(bldg), StreetNetwork=streetnet.StreetNetwork, BuildToggle=False)  # -> UrbanoModel, BuildingCurves, Activities
inbldg = InspectBuilding(Building=bldg, UrbanoModel=model.UrbanoModel, DefaultHeight=10)  # -> Geometry, Metadata, Amenity, flatten(BuildingMesh)

path_3 = FilePath("C:\Users\l03063058\Desktop\Github\DRVaa\SHPs\streets_scored_SJO_large\street_scored.shp")
panel_4 = Panel(path_3)

# ---- group: CSV to SHP v003
py3 = Python3Script(csv_file=path_2, shp_file_path=path_3)  # -> GeoDataFrame, shp_file
#   port csv_file: CSV file with perception data (machine or human) for each street segment. File should include columns named latitude and longitude so it can georeference each street segment and convert to SHP file.
#   port shp_file_path: Select file path where SHP file will be saved.
# ---------- py3: Python ----------
#! python3
#r: pandas, geopandas

import pandas as pd
import geopandas as gpd
from shapely.geometry import Point

# Read CSV file
df = pd.read_csv(csv_file)


# Make sure CSV file has columns for latitud and longitud
# if 'latitude' not in df.columns or 'longitude' not in df.columns:
    # raise ValueError("CSV file must have 'latitude' and 'longitude' columns")
    

# Create point geometry based on coordinates
geometry = [Point(xy) for xy in zip(df['longitude'], df['latitude'])]
gdf = gpd.GeoDataFrame(df, geometry=geometry)

# Establish reference system (CRS), WGS84 for example
gdf.set_crs(epsg=4326, inplace=True)

# Display dataframe
GeoDataFrame = gdf

# Save as Shapefile
gdf.to_file(shp_file_path)

shp_file = shp_file_path

# print(GeoDataFrame.crs)
# ---------- end py3 ----------

# ----
panel_5 = Panel(py3.GeoDataFrame)
explode = Explode(Curve=streetnet.StreetSegmentCurves, Recursive=True)  # -> Segments, Vertices

# ---- group: SHP to GeoDataframe
py3_2 = Python3Script(SHP=py3.shp_file)  # -> GeoDataFrame
# ---------- py3_2: Python ----------
#! python3
#r: geopandas


#THIS IS NECESSARY TO LOAD PANDAS otherwise it bugs
import locale
locale.setlocale(locale.LC_ALL, 'en_US')

import geopandas as gpd

GeoDataFrame = gpd.read_file(SHP)
# ---------- end py3_2 ----------

# ---- group: RESULTADOS / Huellas de edificios
crv = Curve(inbldg.Geometry)

# ---- group: RESULTADOS / Volumetrías
geo = Geometry(inbldg.BuildingMesh)

# ---- group: RESULTADOS / Red de calles
crv_2 = Curve(streetnet.StreetSegmentCurves)

# ---- group: Dataframe Details
py3_3 = Python3Script(dataFrame=py3_2)  # -> info, column_name, head_x10, tail_x10, shape, number_of_null_values
# ---------- py3_3: Python ----------
info = dataFrame.info

head_x10 = dataFrame.head(10)
tail_x10 = dataFrame.tail(10)
shape = dataFrame.shape

#Add up all null values
number_of_null_values = dataFrame.isnull().sum()



# columns = dataFrame.columns
# Get the columns as a list
column_name = dataFrame.columns.tolist()

# Output the list
# print(column_name)
# ---------- end py3_3 ----------

# ----
panel_6 = Panel(py3_3.column_name)  # disabled

list = ValueList({"segment ID": 0, "latitude": 1, "longitude": 2, "street": 3, "image ID": 4, "image file": 5, "acoustic comfort": 6, "thermal comfort": 7, "somatic stress": 8, "social vitality": 9, "territorial safety": 10, "olfactory resonance": 11, "rationale": 12}, selected="social vitality")
item = ListItem(List=py3_3.column_name, Index=list, Wrap=True)

dom = ConstructDomain(DomainStart=Slider(30, range=0..100), DomainEnd=Slider(54, range=0..100))
series = Series(Start=dom, Step=1, Count=10)
# System prompt: You are an expert urban psychologist, phenomenologist, and spatial analyst specializing in affective urban mapping and multi-sensory pedestrian navigation. Your role is to interpret sequential street-level data—comprising integer scores (0–100) across six affective dimensions alongside spatial descriptions/rationales—and synthesize them into an evocative, analytical narrative of how the overall space feels to a human walking through it.
# 
# The six core affective dimensions evaluated in the data are:
# 1. Acoustic Comfort: Perceived noise levels, acoustic isolation vs. traffic noise.
# 2. Thermal Comfort: Perceived shade, microclimate, solar exposure, and heat radiation.
# 3. Somatic Stress: Physical discomfort caused by narrow sidewalks, high traffic proximity, or visual/spatial clutter.
# 4. Social Vitality: Street life, pedestrian activity, openness, and civic energy.
# 5. Territorial Safety: Perceived defensible space, natural surveillance, lighting, and enclosure.
# 6. Olfactory Resonance: Perceived presence of pleasant natural scents vs. auto exhaust or urban decay.
# 
# Guiding Instructions for Synthesis:
# - Treat the sequence of input data as a continuous spatial trajectory along a pedestrian route.
# - Do not merely average the numbers; identify transitions, spikes, sanctuary zones (high comfort / low stress), and friction points (high stress / low comfort).
# - Balance qualitative storytelling with data-backed observations, grounding psychological reflections in specific environmental cues from the descriptions (e.g., tree canopy coverage, building setbacks, traffic density).
# - Structure your output with clear experiential sections that help urban designers and pedestrians understand the psychological atmosphere of the route.
item_2 = ListItem(List=py3_3.column_name, Index=Slider(10, range=0..42), Wrap=True)  # disabled
number_slider = Slider(6, range=0..10)  # disabled

# ---- group: without scores
system_prompt = Panel("""You are an expert urban psychologist, phenomenologist, and spatial analyst specializing in affective urban mapping and multi-sensory pedestrian navigation. Your role is to interpret sequential street-level data—comprising across six affective dimensions alongside spatial descriptions/rationales—and synthesize them into an evocative, analytical narrative of how the overall space feels to a human walking through it.

The six core affective dimensions evaluated in the data are:
1. Acoustic Comfort: Perceived noise levels, acoustic isolation vs. traffic noise.
2. Thermal Comfort: Perceived shade, microclimate, solar exposure, and heat radiation.
3. Somatic Stress: Physical discomfort caused by narrow sidewalks, high traffic proximity, or visual/spatial clutter.
4. Social Vitality: Street life, pedestrian activity, openness, and civic energy.
5. Territorial Safety: Perceived defensible space, natural surveillance, lighting, and enclosure.
6. Olfactory Resonance: Perceived presence of pleasant natural scents vs. auto exhaust or urban decay.

Guiding Instructions for Synthesis:
- Treat the sequence of input data as a continuous spatial trajectory along a pedestrian route.
- Identify transitions, spikes, sanctuary zones (high comfort / low stress), and friction points (high stress / low comfort).
- Balance qualitative storytelling with observations, grounding psychological reflections in specific environmental cues from the descriptions (e.g., tree canopy coverage, building setbacks, traffic density).
- Structure your output with clear experiential sections that help urban designers and pedestrians understand the psychological atmosphere of the route.""")
user_prompt = Panel("""I have collected sequential street-level data from 360-degree panoramas along a specific urban route that corresponds to a specific atmosphere/dimension. Below is the list of sequential image descriptions with visual rationales corresponding to each segment along the path as well as the give dimension to focus the description on.

Synthesize this data into a very brief comprehensive Affective Route Summary (50 words) detailing how this space feels to a pedestrian walking through it according to the given affective dimension: """)
concat = Concatenate(FragmentA=user_prompt, FragmentB=item)

# ----
path_4 = FilePath("C:\Users\l03063058\Desktop\Github\gemini_api.txt")
toggle = BooleanToggle(True)
panel_7 = Panel("qwen2.5vl")
# You are an extra ordinary chef expert in fusion mexican-american food, ready to take orders
panel_8 = Panel("qwen2.5:3b")
toggle_2 = BooleanToggle(True)
# I'd like a Ceviche Nacho Supreme
panel_9 = Panel("qwen3.5:4b")
file = ReadFile(File=path_4, PerLineParse=True)

# ---- group: attach to edges / insert street segments
crv_3 = Curve(streetnet.StreetSegmentCurves)  # disabled

# ---- group: attach to edges / distance threshold
number_slider_2 = Slider(5, range=0..100)  # disabled

# ----
# Perception (9s)
bounding_box = Relay()
swatch = ColourSwatch(SwatchColor=RGB(238, 95, 131))  # disabled
toggle_3 = GroupToggle(ToggleActive=True, ToggleVisible=False)  # disabled

# ----
# LLM Walkability Perception
panel_10 = Panel(py3_3.head_x10)
importshp = ImportShapefileFeatures(
    ShapefilePath=py3.shp_file,
    Reproject=False,
    UTMZone=importosm_2.UTMZone,
    TranslationVector=importosm_2.TranslationVector,
    CroppingGeometry=bounding_box)  # -> simplify(flatten(Points)), Metadata, UTMZone, TranslationVector
demeta = DeconstructMetadata(Metadata=importshp.Metadata)  # -> Keys, Values
panel_11 = Panel(py3_3.column_name)
panel_12 = Panel(demeta.Values)
panel_13 = Panel(demeta.Keys)

panel_14 = Panel(importshp.Points)
lookup = LookupMetadata(MetadataGeometry=importshp.Metadata, SearchKey=item_2)  # disabled

# ----
# FILTERING
lookup_2 = LookupMetadata(MetadataGeometry=importshp.Metadata, SearchKey=item)  # disabled
number_slider_3 = Slider(5, range=0..20)  # disabled
pt = Point(flatten(importshp.Points))  # disabled
swatch_2 = ColourSwatch(SwatchColor=RGB(0, 0, 0))  # disabled

bnd = Bounds(Numbers=lookup_2)  # disabled
dedomain = DeconstructDomain(Domain=bnd)  # -> Start, End; disabled
panel_15 = Panel(dedomain.Start)  # disabled
panel_16 = Panel(dedomain.End)  # disabled

dots = DotDisplay(Point=pt, Colour=swatch, Size=number_slider_3)  # disabled
dup_pts = CleanDuplicatePoints(Points=pt, Tolerance=0.01)  # -> Points, Indices, Status; disabled
dispatch = Dispatch(List=lookup_2, DispatchPattern=dup_pts.Status)  # -> ListA, ListB; disabled
panel_17 = Panel(dispatch.ListA)  # disabled

points = PointList(Points=pt, Size=number_slider)  # disabled

# ---- group: raw
tag = TextTag(Location=pt, Text=lookup_2)  # disabled

# ---- group: eliminated duplicates
tag_2 = TextTag(Location=flatten(dup_pts.Points), Text=dispatch.ListA, Colour=swatch_2)  # disabled

# ----
item_3 = ListItem(List=dispatch.ListA, Index=0, Wrap=True)  # disabled
panel_18 = Panel(item_3)  # disabled

# ---- group: attach to edges / Insert points
pt_2 = Point(dup_pts.Points)  # disabled

# ----
num = Number(dispatch.ListA)  # disabled

# ---- group: Column Values 001
py3_4 = Python3Script(dataFrame=py3.GeoDataFrame, column_name="rationale")  # -> columnValues
# ---------- py3_4: Python ----------
columnValues = dataFrame[column_name].tolist()
# ---------- end py3_4 ----------

# ----
panel_19 = Panel(py3_4)
# User prompt: I have collected sequential street-level data from 360-degree panoramas along a specific urban route. Below is the list of sequential image descriptions, affective scores (0–100), and visual rationales corresponding to each segment along the path.
# 
# Synthesize this data into a very brief comprehensive Affective Route Summary (about 50 words) detailing how this space feels to a pedestrian walking through it.
viewer = ParamViewer(py3_4)

item_4 = ListItem(List=py3_4, Index=series, Wrap=True)  # -> simplify(Item)
data_trees_to_json = DataTreesToJSON(Keys_tree=simplify("route 1"), Values_tree=simplify(item_4))  # -> Status, JSONPath
gemini = LLMGemini(
    Api=file,
    Model="gemini-3.8-flash",
    System_prompt=system_prompt,
    User_prompt=concat,
    Json_input=data_trees_to_json.JSONPath,
    Run=Button())  # -> Status, Json_file, Response
ollama = Python3Script(
    model=panel_8,
    system_prompt=system_prompt,
    user_prompt=concat,
    json_input=data_trees_to_json.JSONPath,
    clear=Button(),
    run=Button())  # -> status, response; inputs model: String, system_prompt: String, user_prompt: String, json_input: String, clear: Boolean, run: Boolean
# ---------- ollama: Python ----------
# r: requests
import json
import requests
import threading
import Grasshopper as gh
import scriptcontext as sc

# Access built-in Grasshopper Environment properties directly
component = ghenv.Component
doc = component.OnPingDocument()
GUID = str(component.InstanceGuid)

# Generate unique sticky keys per component instance
KEY_HISTORY = f"ollama_history_{GUID}"
KEY_RESPONSE = f"ollama_response_{GUID}"
KEY_STATUS = f"ollama_status_{GUID}"
KEY_BUSY = f"ollama_busy_{GUID}"
KEY_LAST_INPUT = f"ollama_last_input_{GUID}"
KEY_LAST_RUN = f"ollama_last_run_{GUID}"

# Initialize persistent memory slots
if KEY_HISTORY not in sc.sticky:
    sc.sticky[KEY_HISTORY] = []
if KEY_RESPONSE not in sc.sticky:
    sc.sticky[KEY_RESPONSE] = ""
if KEY_STATUS not in sc.sticky:
    sc.sticky[KEY_STATUS] = "Ready."
if KEY_BUSY not in sc.sticky:
    sc.sticky[KEY_BUSY] = False
if KEY_LAST_INPUT not in sc.sticky:
    sc.sticky[KEY_LAST_INPUT] = None
if KEY_LAST_RUN not in sc.sticky:
    sc.sticky[KEY_LAST_RUN] = False

# Read inputs safely
model_name = globals().get('model', 'qwen2.5:3b')
sys_prompt = globals().get('system_prompt', '')
u_prompt = globals().get('user_prompt', '')
json_data = globals().get('json_input', '')
run_trigger = globals().get('run', False)      # Connect a Button OR a Boolean Toggle
clear_trigger = globals().get('clear', False)  # Connect a Button OR a Boolean Toggle

# Snapshot current text/data inputs
current_inputs = {
    'model': str(model_name).strip(),
    'sys': str(sys_prompt).strip(),
    'user': str(u_prompt).strip(),
    'json': str(json_data).strip()
}

# Handle Clear Memory & Output Request
if clear_trigger:
    sc.sticky[KEY_HISTORY] = []
    sc.sticky[KEY_RESPONSE] = ""
    sc.sticky[KEY_STATUS] = "Memory and output cleared."
    sc.sticky[KEY_BUSY] = False
    sc.sticky[KEY_LAST_INPUT] = None
    sc.sticky[KEY_LAST_RUN] = False

# Retrieve state tracking from previous solution cycle
last_inputs = sc.sticky.get(KEY_LAST_INPUT, None)
last_run = sc.sticky.get(KEY_LAST_RUN, False)

# Detect state changes
inputs_changed = (last_inputs is not None) and (current_inputs != last_inputs)
run_just_activated = bool(run_trigger) and not last_run  # Button pressed or Toggle flipped OFF -> ON

# Asynchronous Background Worker
def run_ollama_async(model, system_p, user_p, json_p, history_copy):
    try:
        combined_content = user_p.strip() if user_p else ""
        if json_p and json_p.strip():
            combined_content += f"\n\n### Input JSON Data:\n{json_p.strip()}"

        messages = []
        if system_p and system_p.strip():
            messages.append({"role": "system", "content": system_p.strip()})

        messages.extend(history_copy)
        messages.append({"role": "user", "content": combined_content})

        payload = {
            "model": model,
            "messages": messages,
            "stream": False
        }

        url = "http://localhost:11434/api/chat"
        res = requests.post(url, json=payload, timeout=120)

        if res.status_code == 200:
            res_data = res.json()
            assistant_reply = res_data.get("message", {}).get("content", "")

            # Store updated conversation history and output in persistent memory
            new_history = list(history_copy)
            new_history.append({"role": "user", "content": combined_content})
            new_history.append({"role": "assistant", "content": assistant_reply})

            sc.sticky[KEY_HISTORY] = new_history
            sc.sticky[KEY_RESPONSE] = assistant_reply
            sc.sticky[KEY_STATUS] = f"Success! Model: {model} | History depth: {len(new_history)} items."
        else:
            sc.sticky[KEY_STATUS] = f"Ollama API Error {res.status_code}: {res.text}"

    except Exception as e:
        sc.sticky[KEY_STATUS] = f"Execution Error: {str(e)}"
    finally:
        sc.sticky[KEY_BUSY] = False
        
        # Schedule solution update on main UI thread once complete
        if doc:
            def update_solution(d):
                component.ExpireSolution(False)
            doc.ScheduleSolution(5, gh.Kernel.GH_Document.GH_ScheduleDelegate(update_solution))

# Execution Logic:
# Must have active 'run' signal AND (Run input newly activated OR Text inputs changed)
has_content = bool(current_inputs['user'] or current_inputs['json'])
should_run = (
    bool(run_trigger) and 
    (run_just_activated or inputs_changed) and 
    has_content and 
    not sc.sticky[KEY_BUSY]
)

if should_run:
    sc.sticky[KEY_BUSY] = True
    sc.sticky[KEY_LAST_INPUT] = current_inputs  # Lock input state to prevent infinite refresh loops
    sc.sticky[KEY_STATUS] = "Processing request in background thread..."
    
    history_snapshot = list(sc.sticky[KEY_HISTORY])

    # Launch worker thread
    t = threading.Thread(
        target=run_ollama_async,
        args=(model_name, sys_prompt, u_prompt, json_data, history_snapshot)
    )
    t.daemon = True
    t.start()

# Remember run_trigger state for next solution cycle
sc.sticky[KEY_LAST_RUN] = bool(run_trigger)

# Assign output values from persistent memory
status = sc.sticky[KEY_STATUS]
response = sc.sticky[KEY_RESPONSE]
# ---------- end ollama ----------
panel_20 = Panel(gemini.Status)
# The pedestrian feels consistently secure and protected throughout most of the walk, anchored by clear sightlines, defensive fencing, streetlights, and immaculate residential maintenance. Physical threats and crime cues are virtually absent, though perceived safety dips to moderate at the industrial terminus where active traffic and machinery introduce environmental hazards.
affective_route_summary = Panel(gemini.Response)
panel_21 = Panel(ollama.response)
panel_22 = Panel(ollama.status)

# ---- group: attach to edges
midpt = CurveMiddle(Curve=crv_3)  # disabled
pull = PullPoint(Point=pt_2, Geometry=graft(midpt), ClosestOnly=True)  # -> ClosestPoint, Distance, Index; disabled
avr = Average(Input=num)  # disabled
number_slider_4 = Slider(9, range=0..10)  # disabled
panel_24 = Panel(avr)  # disabled
smaller = SmallerThan(FirstNumber=pull.Distance, SecondNumber=number_slider_2)  # -> SmallerThan, OrEqualTo; disabled
dispatch_2 = Dispatch(List=pull.ClosestPoint, DispatchPattern=smaller.SmallerThan)  # -> ListA, ListB; disabled
dispatch_3 = Dispatch(List=dispatch.ListA, DispatchPattern=smaller.SmallerThan)  # -> ListA, ListB; disabled
pt_3 = Point(dispatch_2.ListA)  # disabled
points_2 = PointList(Points=flatten(pt_3), Size=number_slider_4)  # disabled
panel_25 = Panel(pt_3)  # disabled
number_slider_5 = Slider(0, range=0..100)  # disabled
number_slider_6 = Slider(100, range=0..100)  # disabled
panel_26 = Panel("0")  # disabled
number_slider_7 = Slider(3, range=0..10)  # disabled

# ---- group: attach to edges / check index
points_3 = PointList(Points=flatten(midpt), Size=number_slider_4)  # disabled

# ---- group: attach to edges / Output: reordered data
data = Data(dispatch_3.ListA)  # disabled

# ---- group: attach to edges (continued)
item_5 = ListItem(List=data, Index=0, Wrap=True)  # disabled
item_6 = ListItem(List=data, Index=0, Wrap=True)  # disabled
panel_27 = Panel(item_5)  # disabled
bnd_2 = Bounds(Numbers=flatten(item_5))  # disabled
nullrep = ReplaceNulls(Items=item_5, Replacements=panel_26)  # -> flatten(Items), Count; disabled
dedomain_2 = DeconstructDomain(Domain=bnd_2)  # -> Start, End; disabled
gradient = Gradient(
    LowerLimit=number_slider_6,
    UpperLimit=number_slider_5,
    Parameter=nullrep.Items,
    stops=[0: RGB(27, 117, 166), 0.125: RGB(0, 163, 191), 0.25: RGB(0, 201, 188), 0.375: RGB(135, 237, 161), 0.5: RGB(224, 224, 45), 0.625: RGB(250, 208, 82), 0.75: RGB(250, 160, 50), 0.875: RGB(232, 111, 30), 1: RGB(191, 40, 23)])  # disabled
panel_28 = Panel(nullrep.Items)  # disabled
col = Colour(gradient)  # disabled
panel_29 = Panel(col)  # disabled
previewlw = CustomPreviewLineweights(Geometry=crv_3, Shader=col, Thickness=number_slider_7, Absolute=False)  # disabled

# ---- group: Check individual segments
panel_30 = Panel("126")  # disabled
item_7 = ListItem(List=nullrep.Items, Index=panel_30, Wrap=True)  # disabled
item_8 = ListItem(List=crv_3, Index=panel_30, Wrap=True)  # disabled
panel_31 = Panel(item_8)  # disabled
panel_32 = Panel(item_7)  # disabled

# ---- group: attach to edges / matched & filtered
tag_3 = TextTag(Location=midpt, Text=flatten(nullrep.Items))  # disabled
