# Grasshopper definition dataframes_reading.gh (Grasshopper 1.0.8)
# plug-ins: CORE.Toolbox.Grasshopper, Urbano, Human, MetaHopper

# ---- group: INPUT
path = FilePath("C:\Users\l03063058\Desktop\Github\DRVaa\Grasshopper\cityModels\SJO_match_large.osm")
panel = Panel(path)

# ----
# URBANO 1
panel_2 = Panel(path)

# ---- group: CSV file with perception data for each street segment (through LLM or participatory design)
path_2 = FilePath("C:\Users\l03063058\Desktop\Github\DRVaa\street_segments_scored_360_rationale.csv")

# ----
panel_3 = Panel(path_2)

importosm = ImportOSMFeatures(OSMPathOrURL=path, OSMFeatureType="building", Format="xml", ImportAltitude=False)  # -> Points, Metadata, UTMZone, TranslationVector
importosm_2 = ImportOSMFeatures(OSMPathOrURL=path, OSMFeatureType="street", Format="xml", ImportAltitude=False)  # -> Points, Metadata, UTMZone, TranslationVector
importosm_3 = ImportOSMFeatures(OSMPathOrURL=path, OSMFeatureType="amenity", Format="xml", ImportAltitude=False)  # -> Points, Metadata, UTMZone, TranslationVector
pline = PolyLine(Vertices=importosm.Points, Closed=False)
pline_2 = PolyLine(Vertices=importosm_2.Points, Closed=False)
amen = CreateAmenity(PointLocationOfAmenity=importosm_3.Points, Metadata=importosm_3.Metadata)
streetnet = CreateStreetNetwork(
    StreetCurves=flatten(pline_2),
    Metadata=flatten(importosm_2.Metadata),
    SplitStreetCurves=True,
    UTMZone=importosm_2.UTMZone,
    TranslationVector=importosm_2.TranslationVector)  # -> StreetNetwork, StreetSegmentCurves, UTMZone, TranslationVector
bldg = CreateBuilding(BuildingCurve=pline, Metadata=importosm.Metadata, AmenitiesInBuilding=amen)
model = BuildUrbanoModel(Buildings=flatten(bldg), StreetNetwork=streetnet.StreetNetwork, BuildToggle=False)  # -> UrbanoModel, BuildingCurves, Activities
inbldg = InspectBuilding(Building=bldg, UrbanoModel=model.UrbanoModel, DefaultHeight=10)  # -> Geometry, Metadata, Amenity, flatten(BuildingMesh)

path_3 = FilePath("C:\Users\l03063058\Desktop\Github\DRVaa\SHPs\streets_scored_SJO_large\street_scored.shp")
panel_4 = Panel(path_3)

# ---- group: CSV to SHP v003
py3 = Python3Script(csv_file=path_2, shp_file_path=path_3)  # -> GeoDataFrame, shp_file
#   port csv_file: CSV file with perception data (machine or human) for each street segment. File should include columns named latitude and longitude so it can georeference each street segment and convert to SHP file.
#   port shp_file_path: Select file path where SHP file will be saved.
# ---------- py3: Python ----------
#! python3
#r: pandas, geopandas

import pandas as pd
import geopandas as gpd
from shapely.geometry import Point

# Read CSV file
df = pd.read_csv(csv_file)


# Make sure CSV file has columns for latitud and longitud
# if 'latitude' not in df.columns or 'longitude' not in df.columns:
    # raise ValueError("CSV file must have 'latitude' and 'longitude' columns")
    

# Create point geometry based on coordinates
geometry = [Point(xy) for xy in zip(df['longitude'], df['latitude'])]
gdf = gpd.GeoDataFrame(df, geometry=geometry)

# Establish reference system (CRS), WGS84 for example
gdf.set_crs(epsg=4326, inplace=True)

# Display dataframe
GeoDataFrame = gdf

# Save as Shapefile
gdf.to_file(shp_file_path)

shp_file = shp_file_path

# print(GeoDataFrame.crs)
# ---------- end py3 ----------

# ----
panel_5 = Panel(py3.GeoDataFrame)
explode = Explode(Curve=streetnet.StreetSegmentCurves, Recursive=True)  # -> Segments, Vertices

# ---- group: SHP to GeoDataframe
py3_2 = Python3Script(SHP=py3.shp_file)  # -> GeoDataFrame
# ---------- py3_2: Python ----------
#! python3
#r: geopandas


#THIS IS NECESSARY TO LOAD PANDAS otherwise it bugs
import locale
locale.setlocale(locale.LC_ALL, 'en_US')

import geopandas as gpd

GeoDataFrame = gpd.read_file(SHP)
# ---------- end py3_2 ----------

# ---- group: RESULTADOS / Huellas de edificios
crv = Curve(inbldg.Geometry)

# ---- group: RESULTADOS / Volumetrías
geo = Geometry(inbldg.BuildingMesh)

# ---- group: RESULTADOS / Red de calles
crv_2 = Curve(streetnet.StreetSegmentCurves)

# ---- group: Dataframe Details
py3_3 = Python3Script(dataFrame=py3_2)  # -> info, column_name, head_x10, tail_x10, shape, number_of_null_values
# ---------- py3_3: Python ----------
info = dataFrame.info

head_x10 = dataFrame.head(10)
tail_x10 = dataFrame.tail(10)
shape = dataFrame.shape

#Add up all null values
number_of_null_values = dataFrame.isnull().sum()



# columns = dataFrame.columns
# Get the columns as a list
column_name = dataFrame.columns.tolist()

# Output the list
# print(column_name)
# ---------- end py3_3 ----------

# ----
panel_6 = Panel(py3_3.column_name)

list = ValueList({"segment ID": 0, "latitude": 1, "longitude": 2, "street": 3, "image ID": 4, "image file": 5, "acoustic comfort": 6, "thermal comfort": 7, "somatic stress": 8, "social vitality": 9, "territorial safety": 10, "olfactory resonance": 11, "rationale": 12}, selected="acoustic comfort")
item = ListItem(List=py3_3.column_name, Index=list, Wrap=True)

item_2 = ListItem(List=py3_3.column_name, Index=Slider(10, range=0..42), Wrap=True)

# ---- group: attach to edges / insert street segments
crv_3 = Curve(streetnet.StreetSegmentCurves)

# ---- group: attach to edges / distance threshold
number_slider = Slider(5, range=0..100)

# ----
# Perception (9s)
bounding_box = Relay()
toggle = GroupToggle(ToggleActive=True, ToggleVisible=False)  # disabled

# ----
# LLM Walkability Perception
panel_7 = Panel(py3_3.head_x10)
importshp = ImportShapefileFeatures(
    ShapefilePath=py3.shp_file,
    Reproject=False,
    UTMZone=importosm_2.UTMZone,
    TranslationVector=importosm_2.TranslationVector,
    CroppingGeometry=bounding_box)  # -> simplify(flatten(Points)), Metadata, UTMZone, TranslationVector
demeta = DeconstructMetadata(Metadata=importshp.Metadata)  # -> Keys, Values
panel_9 = Panel(demeta.Values)
panel_10 = Panel(demeta.Keys)

panel_11 = Panel(importshp.Points)

# ----
# FILTERING
lookup = LookupMetadata(MetadataGeometry=importshp.Metadata, SearchKey=item)
pt = Point(flatten(importshp.Points))

lookup_2 = LookupMetadata(MetadataGeometry=importshp.Metadata, SearchKey=item_2)
bnd = Bounds(Numbers=lookup)
dedomain = DeconstructDomain(Domain=bnd)  # -> Start, End
panel_12 = Panel(dedomain.Start)
panel_13 = Panel(dedomain.End)

dots = DotDisplay(Point=pt, Colour=ColourSwatch(SwatchColor=RGB(238, 95, 131)), Size=Slider(5, range=0..20))
dup_pts = CleanDuplicatePoints(Points=pt, Tolerance=0.01)  # -> Points, Indices, Status
dispatch = Dispatch(List=lookup, DispatchPattern=dup_pts.Status)  # -> ListA, ListB
panel_14 = Panel(dispatch.ListA)

points = PointList(Points=pt, Size=Slider(6, range=0..10))

# ---- group: raw
tag = TextTag(Location=pt, Text=lookup)

# ---- group: eliminated duplicates
tag_2 = TextTag(Location=flatten(dup_pts.Points), Text=dispatch.ListA, Colour=ColourSwatch(SwatchColor=RGB(0, 0, 0)))

# ----
item_3 = ListItem(List=dispatch.ListA, Index=0, Wrap=True)
panel_15 = Panel(item_3)

# ---- group: attach to edges / Insert points
pt_2 = Point(dup_pts.Points)

# ----
num = Number(dispatch.ListA)

# ---- group: Column Values 001
py3_4 = Python3Script(dataFrame=py3.GeoDataFrame, column_name="rationale")  # -> columnValues
# ---------- py3_4: Python ----------
columnValues = dataFrame[column_name].tolist()
# ---------- end py3_4 ----------

# ----
viewer = ParamViewer(py3_4)
panel_16 = Panel(py3_4)

item_4 = ListItem(List=py3_4, Index=0, Wrap=True)
panel_17 = Panel(item_4)

# ---- group: attach to edges
midpt = CurveMiddle(Curve=crv_3)
pull = PullPoint(Point=pt_2, Geometry=graft(midpt), ClosestOnly=True)  # -> ClosestPoint, Distance, Index
avr = Average(Input=num)
number_slider_2 = Slider(9, range=0..10)
panel_19 = Panel(avr)
smaller = SmallerThan(FirstNumber=pull.Distance, SecondNumber=number_slider)  # -> SmallerThan, OrEqualTo
dispatch_2 = Dispatch(List=pull.ClosestPoint, DispatchPattern=smaller.SmallerThan)  # -> ListA, ListB
dispatch_3 = Dispatch(List=dispatch.ListA, DispatchPattern=smaller.SmallerThan)  # -> ListA, ListB
pt_3 = Point(dispatch_2.ListA)
points_2 = PointList(Points=flatten(pt_3), Size=number_slider_2)
panel_20 = Panel(pt_3)

# ---- group: attach to edges / check index
points_3 = PointList(Points=flatten(midpt), Size=number_slider_2)

# ---- group: attach to edges / Output: reordered data
data = Data(dispatch_3.ListA)

# ---- group: attach to edges (continued)
item_5 = ListItem(List=data, Index=0, Wrap=True)
item_6 = ListItem(List=data, Index=0, Wrap=True)
panel_21 = Panel(item_5)
bnd_2 = Bounds(Numbers=flatten(item_5))
nullrep = ReplaceNulls(Items=item_5, Replacements="0")  # -> flatten(Items), Count
dedomain_2 = DeconstructDomain(Domain=bnd_2)  # -> Start, End
gradient = Gradient(
    LowerLimit=Slider(100, range=0..100),
    UpperLimit=Slider(0, range=0..100),
    Parameter=nullrep.Items,
    stops=[0: RGB(27, 117, 166), 0.125: RGB(0, 163, 191), 0.25: RGB(0, 201, 188), 0.375: RGB(135, 237, 161), 0.5: RGB(224, 224, 45), 0.625: RGB(250, 208, 82), 0.75: RGB(250, 160, 50), 0.875: RGB(232, 111, 30), 1: RGB(191, 40, 23)])
panel_22 = Panel(nullrep.Items)
col = Colour(gradient)
panel_23 = Panel(col)
previewlw = CustomPreviewLineweights(Geometry=crv_3, Shader=col, Thickness=Slider(3, range=0..10), Absolute=False)

# ---- group: Check individual segments
item_7 = ListItem(List=nullrep.Items, Index="126", Wrap=True)
item_8 = ListItem(List=crv_3, Index="126", Wrap=True)
panel_24 = Panel(item_8)
panel_25 = Panel(item_7)

# ---- group: attach to edges / matched & filtered
tag_3 = TextTag(Location=midpt, Text=flatten(nullrep.Items))
