# Grasshopper definition dotSampling.gh (Grasshopper 1.0.8)
# plug-ins: Human

panel = Panel("-40, 40")  # disabled
planesrf = PlaneSurface(Plane=PlaneXY(0, 0, 0), XSize=panel, YSize=Domain(-10, 10))  # disabled
cylinder = Surface()  # disabled
number_slider = Slider(100, range=1..200)  # disabled
number_slider_2 = Slider(200, range=0..1000)
srf = Surface(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)
panel_2 = Panel("4")  # disabled
division = Division(A=number_slider, B=panel_2)  # disabled
transpose = TransposeSurface(Surface=srf)  # -> Surface, U, V
sdivide = DivideSurface(Surface=reparameterize(planesrf), UCount=number_slider, VCount=division)  # -> flatten(Points), Normals, flatten(Parameters); disabled
panel_3 = Panel("sampler_flat")  # disabled
division_2 = Division(A=number_slider_2, B="10")
filepath_for_image_sampler = Python3Script(sampler_name=panel_3)  # inputs file_path: String; disabled
# ---------- filepath_for_image_sampler: Python ----------
import Grasshopper as gh
import System.Reflection as reflection
import os

doc = ghenv.Component.OnPingDocument()

if file_path and os.path.exists(file_path):
    for obj in doc.Objects:
        if isinstance(obj, gh.Kernel.Special.GH_ImageSampler) and obj.NickName == sampler_name:
            if obj.ImageFilePath != file_path:
                # 1. Set new file path string
                obj.ImageFilePath = file_path
                
                # 2. Force reload of the internal bitmap memory cache using Reflection
                flags = reflection.BindingFlags.Instance | reflection.BindingFlags.NonPublic | reflection.BindingFlags.Public
                method = obj.GetType().GetMethod("LoadImage", flags) or obj.GetType().GetMethod("ReloadImage", flags)
                
                if method:
                    method.Invoke(obj, None)
                
                # 3. Re-evaluate downstream Grasshopper components
                obj.ExpireSolution(True)
            break
# ---------- end filepath_for_image_sampler ----------
sampler_flat = ImageSampler(
    sdivide.Parameters,
    FilePath="C:\Users\l03063058\Desktop\Github\DRVaa\streetview_panoramas_360\hr6ffBJBlJlaTNJs9jjpfA_360.jpg",
    Filter="Colour",
    Interpolate=False,
    Umax=1,
    Umin=0,
    Vmax=1,
    Vmin=0,
    Wrap=1)  # disabled
sdivide_2 = DivideSurface(Surface=reparameterize(transpose.Surface), UCount=number_slider_2, VCount=division_2)  # -> flatten(Points), Normals, flatten(Parameters)
filepath_for_image_sampler_2 = Python3Script(sampler_name="sampler_cylinder")  # inputs file_path: String; same code as filepath_for_image_sampler
sampler_cylinder = ImageSampler(
    sdivide_2.Parameters,
    FilePath="C:\Users\l03063058\Desktop\Github\DRVaa\streetview_panoramas_360\hr6ffBJBlJlaTNJs9jjpfA_360.jpg",
    Filter="Colour",
    Interpolate=False,
    Umax=1,
    Umin=0,
    Vmax=1,
    Vmin=0,
    Wrap=1)

ahsv = SplitAHSV(Colour=sampler_flat)  # -> Alpha, Hue, Saturation, Value; disabled
sort = SortList(Keys=ahsv.Hue, ValuesA=ahsv.Saturation, ValuesB=ahsv.Value)  # -> Keys, ValuesA, ValuesB; disabled
number_slider_3 = Slider(6.4, range=0..10)  # disabled
number_slider_4 = Slider(0.4, range=0..1)  # disabled
number_slider_5 = Slider(2, range=0..10)  # disabled
hsv = ColourHSV(Alpha=1, Hue=sort.Keys, Saturation=sort.ValuesA, Value=sort.ValuesB)  # disabled
panel_4 = Panel("1555,750")  # disabled
dots = DotDisplay(Point=sdivide.Points, Colour=hsv, Size=number_slider_4)  # disabled
pttoscreen = RenderPointToScreen(
    Point=sdivide.Points,
    Location=panel_4,
    ScaleFactor=number_slider_3,
    Color=hsv,
    Radius=number_slider_5,
    Depth=0.95,
    Fixed=True,
    m_scWithvp=False)  # disabled

argb = SplitARGB(Colour=sampler_cylinder, IntegerChannels=True)  # -> Alpha, Red, Green, Blue
rgb = ColourRGB(Alpha=Slider(100, range=1..255), Red=argb.Red, Green=argb.Green, Blue=argb.Blue)  # -> simplify(Colour)
dots_2 = DotDisplay(Point=sdivide_2.Points, Colour=rgb, Size=Slider(0.4, range=0..1))
