# Grasshopper definition xRouter.gh (Grasshopper 1.0.8)
# plug-ins: CORE.Toolbox.Grasshopper, Urbano

path = FilePath("C:\Users\l03063058\Desktop\tec_lo.osm")
importosm = ImportOSMFeatures(OSMPathOrURL=path, OSMFeatureType="building", Format="xml", ImportAltitude=False)  # -> Points, Metadata, UTMZone, TranslationVector
importosm_2 = ImportOSMFeatures(OSMPathOrURL=path, OSMFeatureType="amenity", Format="xml", ImportAltitude=False)  # -> Points, Metadata, UTMZone, TranslationVector
importosm_3 = ImportOSMFeatures(OSMPathOrURL=path, OSMFeatureType="street", Format="xml", ImportAltitude=False)  # -> Points, Metadata, UTMZone, TranslationVector
pline = PolyLine(Vertices=importosm.Points, Closed=invert(False))
pline_2 = PolyLine(Vertices=importosm_3.Points, Closed=False)
bldg = CreateBuilding(BuildingCurve=pline, Metadata=importosm.Metadata)
streetnet = CreateStreetNetwork(
    StreetCurves=flatten(pline_2),
    Metadata=flatten(importosm_3.Metadata),
    SplitStreetCurves=True,
    UTMZone=importosm_3.UTMZone,
    TranslationVector=importosm_3.TranslationVector)  # -> StreetNetwork, StreetSegmentCurves, UTMZone, TranslationVector
model = BuildUrbanoModel(Buildings=flatten(bldg), StreetNetwork=streetnet.StreetNetwork, BuildToggle=True)  # -> UrbanoModel, BuildingCurves, Activities
midpt = CurveMiddle(Curve=streetnet.StreetSegmentCurves)  # disabled
index = ItemIndex(List=streetnet.StreetSegmentCurves, Item=streetnet.StreetSegmentCurves)  # disabled
tag = TextTag(Location=midpt, Text=index)  # disabled

# ---- group: origin
pt = Point(Point(2486.27064, 2269.662603, 0))

# ---- group: destination
pt_2 = Point(Point(5034.232252, 2606.704757, 0))

# ---- group: Original Urbano router
router = Router(RouterUrbanoModelOrStreetNetwork=model.UrbanoModel, Origin=pt, Destination=pt_2, TravelMode="car", TimeLimit=-1)  # -> Trip, Route, Time, Distance; disabled
crv = Curve(router.Route)  # disabled

# ---- group: New router gets more than one optimal route
n_shortest_routes = Python3Script(Lines=streetnet.StreetSegmentCurves, StartPt=pt, EndPt=pt_2, Penalty="10.0", K=Slider(5, range=1..20))  # -> out, Routes, RouteIndices; inputs Lines: list of Curve, StartPt: Point3d, EndPt: Point3d, Penalty: Double, K: Int32
#   port Lines: Lines to convert to network.
#   port StartPt: Origin point.
#   port EndPt: Destination point.
#   port Penalty: Edge penalization to control how drastically the routes are forced to diverge. This, at the same time, forces the algorithm to give distinctive, alternative routes. A good starting point is 10.0
#   port Routes: Generated n routes.
#   port RouteIndices: Indices for line segments within routes.
# ---------- n_shortest_routes: Python ----------
#! python 3
# r: networkx

import rhinoscriptsyntax as rs
import Rhino.Geometry as rg
import networkx as nx

# NEW: Import Grasshopper's native Data Tree modules
import Grasshopper
from Grasshopper.Kernel.Data import GH_Path
import System

def get_distinct_paths_with_indices(curves, start_pt, end_pt, k, penalty_factor):
    if isinstance(curves, rg.Curve):
        curves = [curves]
        
    G = nx.Graph()
    
    def pt_to_key(pt):
        return (round(pt.X, 3), round(pt.Y, 3), round(pt.Z, 3))
        
    edge_geometries = {}
    edge_indices = {} 
    
    print("1. Building graph...")
    for original_idx, crv in enumerate(curves):
        if not crv: continue
        
        segments_to_process = []
        if crv.IsPolyline():
            success, polyline = crv.TryGetPolyline()
            if success:
                for seg in polyline.GetSegments():
                    segments_to_process.append(rg.LineCurve(seg))
        else:
            segments_to_process.append(crv)
            
        for seg_crv in segments_to_process:
            p1 = seg_crv.PointAtStart
            p2 = seg_crv.PointAtEnd
            
            k1 = pt_to_key(p1)
            k2 = pt_to_key(p2)
            
            length = seg_crv.GetLength()
            
            G.add_edge(k1, k2, weight=length)
            
            edge_geometries[(k1, k2)] = seg_crv
            edge_geometries[(k2, k1)] = seg_crv 
            edge_indices[(k1, k2)] = original_idx
            edge_indices[(k2, k1)] = original_idx
            
    if len(G.nodes) == 0:
        print("Error: No valid lines were provided.")
        return [], []

    def find_closest_node(graph, target_pt):
        closest_node = None
        min_dist = float('inf')
        for node in graph.nodes:
            node_pt = rg.Point3d(node[0], node[1], node[2])
            dist = target_pt.DistanceTo(node_pt)
            if dist < min_dist:
                min_dist = dist
                closest_node = node
        return closest_node

    start_key = find_closest_node(G, start_pt)
    end_key = find_closest_node(G, end_pt)
    
    k_paths_curves = []
    k_paths_indices = [] 
    
    print("2. Calculating distinctly penalized paths...")
    for i in range(k):
        try:
            path = nx.shortest_path(G, source=start_key, target=end_key, weight='weight')
            
            path_curves = []
            raw_path_indices = []
            
            for j in range(len(path) - 1):
                node_a = path[j]
                node_b = path[j+1]
                
                path_curves.append(edge_geometries[(node_a, node_b)])
                raw_path_indices.append(edge_indices[(node_a, node_b)])
                
                current_weight = G[node_a][node_b]['weight']
                G[node_a][node_b]['weight'] = current_weight * penalty_factor
                
            joined_curves = rg.Curve.JoinCurves(path_curves)
            if joined_curves:
                k_paths_curves.append(joined_curves[0])
                
                clean_indices = []
                for idx in raw_path_indices:
                    if not clean_indices or clean_indices[-1] != idx:
                        clean_indices.append(idx)
                
                k_paths_indices.append(clean_indices)
                
        except nx.NetworkXNoPath:
            print(f"Stopped early at {i} routes: No more valid alternative paths exist.")
            break
        except Exception as e:
            print("An error occurred: " + str(e))
            break
            
    print(f"Success: Found {len(k_paths_curves)} distinct routes.")
    
    # NEW: Convert the nested Python list into a strict Grasshopper Data Tree
    gh_tree = Grasshopper.DataTree[System.Object]()
    for branch_index, indices_list in enumerate(k_paths_indices):
        path = GH_Path(branch_index)
        for index_val in indices_list:
            gh_tree.Add(index_val, path)
            
    return k_paths_curves, gh_tree

if Lines and StartPt and EndPt and K and Penalty:
    Routes, RouteIndices = get_distinct_paths_with_indices(Lines, StartPt, EndPt, K, Penalty)
# ---------- end n_shortest_routes ----------
item = ListItem(List=n_shortest_routes.Routes, Index=Slider(1, range=0..4), Wrap=invert(True))
panel = Panel(n_shortest_routes.RouteIndices)

# ---- group: select one branch
branch = BranchByIndex(Tree=n_shortest_routes.RouteIndices, Branch=Slider(0, range=0..4))
item_2 = ListItem(List=streetnet.StreetSegmentCurves, Index=branch, Wrap=True)
midpt_2 = CurveMiddle(Curve=item_2)
tag_2 = TextTag(Location=midpt_2, Text=branch)

# ----
viewer = ParamViewer(n_shortest_routes.RouteIndices)

# ---- group: select one branch
item_3 = ListItem(List=streetnet.StreetSegmentCurves, Index=n_shortest_routes.RouteIndices, Wrap=True)
midpt_3 = CurveMiddle(Curve=item_3)
tag_3 = TextTag(Location=midpt_3, Text=n_shortest_routes.RouteIndices)

# ----
explode = Explode(Curve=item, Recursive=True)  # -> Segments, Vertices
midpt_4 = CurveMiddle(Curve=explode.Segments)
