# Grasshopper definition xRouter01.gh (Grasshopper 1.0.8)
# plug-ins: CORE.Toolbox.Grasshopper, Urbano2, Urbano, Human, MetaHopper

geographic_boundary = GeographicBoundary(Left="-118.261245", Top="34.053051", Right="-118.244401", Bottom="34.044979")  # -> Boundary, CoordinateReference
path = FilePath("C:\Users\l03063058\OneDrive - Instituto Tecnologico y de Estudios Superiores de Monterrey\TEC stuff\RESEARCH\10_experienceRouter\04_tool\01_DRVaa\Grasshopper\")
panel = Panel(geographic_boundary.Boundary)
create_project_setting = CreateProjectSetting(
    Directory=path,
    Boundary=geographic_boundary.Boundary,
    Granularity="Block",
    DataLayers="osm",
    CoordinateReference=geographic_boundary.CoordinateReference)
osm_feature_query = OsmFeatureQuery(OsmFeatureQuery=["building=*", "building:part=*", "building:parts=*"])  # disabled
osm_feature_query_2 = OsmFeatureQuery(OsmFeatureQuery=["highway=motorway", "highway=trunk", "highway=primary", "highway=secondary", "highway=tertiary", "highway=unclassified", "highway=residential", "highway=service", "highway=motorway_link", "highway=trunk_link", "highway=primary_link", "highway=secondary_link", "highway=motorway_junction", "highway=yes", "highway=road", "highway=living street", "highway=footway", "highway=pedestrian", "highway=path", "highway=bridleway", "highway=cycleway", "highway=raceway", "highway=steps"])  # disabled
# Click this button to
# start generating your own
# project setting string
toggle = BooleanToggle(False)
osm_feature_query_3 = OsmFeatureQuery(OsmFeatureQuery=["building=*", "building:part=*", "building:parts=*"])  # disabled
osm_feature_query_4 = OsmFeatureQuery(OsmFeatureQuery=["highway=motorway", "highway=trunk", "highway=primary", "highway=secondary", "highway=tertiary", "highway=unclassified", "highway=residential", "highway=service", "highway=motorway_link", "highway=trunk_link", "highway=primary_link", "highway=secondary_link", "highway=motorway_junction", "highway=yes", "highway=road", "highway=living street", "highway=footway", "highway=pedestrian", "highway=path", "highway=bridleway", "highway=cycleway", "highway=raceway", "highway=steps"])  # disabled
path_2 = FilePath("C:\Users\l03063058\Desktop\tec_lo.osm")  # disabled
panel_2 = Panel(create_project_setting)
route_biases = RouteBiases()  # -> RouteBias, Point, CoordinateReference; disabled
import_buildings = ImportBuildings(DataSource="osm", Terrain=False)  # -> _2DFootprints, _3DMeshes
workflow_template = WorkflowTemplate()  # -> Directories, Templates, ExampleProjectSetting, ExampleOSMFilePath, ExampleShapefilePath, ExampleGeojsonPath
path_3 = FilePath("C:\Users\l03063058\OneDrive - Instituto Tecnologico y de Estudios Superiores de Monterrey\TEC stuff\RESEARCH\10_experienceRouter\04_tool\01_DRVaa\Grasshopper\mapLA.osm")  # disabled
project_setting = ProjectSetting(Run=toggle, ProjectSettingCache="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")
project_setting_2 = ProjectSetting(Json=create_project_setting, Run=Toggle(True))
import_osm_file = ImportOSMFile(OsmFilePath=path_3, OsmFeatures=osm_feature_query, Terrain=False, Run=True)  # -> Polylines, Polygons, Points, CoordinateReference, Boundary; disabled
importosm = ImportOSMFeatures(OSMPathOrURL=path_2, OSMFeatureType="building", Format="xml", ImportAltitude=False)  # -> Points, Metadata, UTMZone, TranslationVector; disabled
importosm_2 = ImportOSMFeatures(OSMPathOrURL=path_2, OSMFeatureType="amenity", Format="xml", ImportAltitude=False)  # -> Points, Metadata, UTMZone, TranslationVector; disabled
importosm_3 = ImportOSMFeatures(OSMPathOrURL=path_2, OSMFeatureType="street", Format="xml", ImportAltitude=False)  # -> Points, Metadata, UTMZone, TranslationVector; disabled
meta = CreateMetadata()  # disabled
draw_map = DrawMap()  # disabled
panel_3 = Panel(project_setting)
import_osm_file_2 = ImportOSMFile(OsmFilePath=path_3, OsmFeatures=osm_feature_query_4, Terrain=False, Run=True)  # -> Polylines, Polygons, Points, CoordinateReference, Boundary; disabled
geographic_boundary_2 = GeographicBoundary()  # -> Boundary, CoordinateReference; disabled
deconstruct_project_setting = DeconstructProjectSetting(ProjectSetting=project_setting)  # -> Directory, Boundary, Granularity, DataLayers, DataFiles, CoordinateReference
projbound = ProjectGeographicBoundary()  # -> Boundary, Geometry, CoordinateReference; disabled
panel_4 = Panel("Height")  # disabled
pline = PolyLine(Vertices=importosm.Points, Closed=invert(False))  # disabled
pline_2 = PolyLine(Vertices=importosm_3.Points, Closed=False)  # disabled
street_metadata = StreetMetadata(CanWalk=True, CanBike=True, CanDrive=True)  # disabled
search_metadata = SearchMetadata()  # disabled
lookup = LookupMetadata(MetadataGeometry=import_osm_file.Polygons, SearchKey=panel_4)  # disabled
bldg = CreateBuilding(BuildingCurve=pline, Metadata=importosm.Metadata)  # disabled
deconstruct_boundary = DeconstructBoundary(Boundary=deconstruct_project_setting.Boundary, CoordinateReference=deconstruct_project_setting.CoordinateReference)  # -> Geometry, Left, Top, Right, Bottom, CoordinateReference
streetnet = CreateStreetNetwork(
    StreetCurves=flatten(pline_2),
    Metadata=flatten(importosm_3.Metadata),
    SplitStreetCurves=True,
    UTMZone=importosm_3.UTMZone,
    TranslationVector=importosm_3.TranslationVector)  # -> StreetNetwork, StreetSegmentCurves, UTMZone, TranslationVector; disabled
swatch = ColourSwatch(SwatchColor=RGB(215, 222, 220))  # disabled
panel_5 = Panel(deconstruct_project_setting.Boundary)
panel_6 = Panel(lookup)  # disabled
# Replace with your
# project setting
text = Text(project_setting)
previewlw = CustomPreviewLineweights(Geometry=import_osm_file_2.Polylines, Shader=swatch, Absolute=False)  # disabled
model = BuildUrbanoModel(Buildings=flatten(bldg), StreetNetwork=streetnet.StreetNetwork, BuildToggle=True)  # -> UrbanoModel, BuildingCurves, Activities; disabled
midpt = CurveMiddle(Curve=streetnet.StreetSegmentCurves)  # disabled
index = ItemIndex(List=streetnet.StreetSegmentCurves, Item=streetnet.StreetSegmentCurves)  # disabled
pt = Point(Point(596.3598875, 767.5411646, 0))  # disabled
pt_2 = Point(Point(1504.957871, 1141.907495, 0))  # disabled

# ---- group: New router gets more than one optimal route
number_slider = Slider(5, range=1..20)  # disabled
panel_7 = Panel("10.0")  # disabled
n_shortest_routes = Python3Script(Lines=import_osm_file_2.Polylines, StartPt=pt, EndPt=pt_2, Penalty=panel_7, K=number_slider)  # -> out, Routes, RouteIndices; inputs Lines: list of Curve, StartPt: Point3d, EndPt: Point3d, Penalty: Double, K: Int32; disabled
#   port Lines: Lines to convert to network.
#   port StartPt: Origin point.
#   port EndPt: Destination point.
#   port Penalty: Edge penalization to control how drastically the routes are forced to diverge. This, at the same time, forces the algorithm to give distinctive, alternative routes. A good starting point is 10.0
#   port Routes: Generated n routes.
#   port RouteIndices: Indices for line segments within routes.
# ---------- n_shortest_routes: Python ----------
#! python 3
# r: networkx

import rhinoscriptsyntax as rs
import Rhino.Geometry as rg
import networkx as nx

# NEW: Import Grasshopper's native Data Tree modules
import Grasshopper
from Grasshopper.Kernel.Data import GH_Path
import System

def get_distinct_paths_with_indices(curves, start_pt, end_pt, k, penalty_factor):
    if isinstance(curves, rg.Curve):
        curves = [curves]
        
    G = nx.Graph()
    
    def pt_to_key(pt):
        return (round(pt.X, 3), round(pt.Y, 3), round(pt.Z, 3))
        
    edge_geometries = {}
    edge_indices = {} 
    
    print("1. Building graph...")
    for original_idx, crv in enumerate(curves):
        if not crv: continue
        
        segments_to_process = []
        if crv.IsPolyline():
            success, polyline = crv.TryGetPolyline()
            if success:
                for seg in polyline.GetSegments():
                    segments_to_process.append(rg.LineCurve(seg))
        else:
            segments_to_process.append(crv)
            
        for seg_crv in segments_to_process:
            p1 = seg_crv.PointAtStart
            p2 = seg_crv.PointAtEnd
            
            k1 = pt_to_key(p1)
            k2 = pt_to_key(p2)
            
            length = seg_crv.GetLength()
            
            G.add_edge(k1, k2, weight=length)
            
            edge_geometries[(k1, k2)] = seg_crv
            edge_geometries[(k2, k1)] = seg_crv 
            edge_indices[(k1, k2)] = original_idx
            edge_indices[(k2, k1)] = original_idx
            
    if len(G.nodes) == 0:
        print("Error: No valid lines were provided.")
        return [], []

    def find_closest_node(graph, target_pt):
        closest_node = None
        min_dist = float('inf')
        for node in graph.nodes:
            node_pt = rg.Point3d(node[0], node[1], node[2])
            dist = target_pt.DistanceTo(node_pt)
            if dist < min_dist:
                min_dist = dist
                closest_node = node
        return closest_node

    start_key = find_closest_node(G, start_pt)
    end_key = find_closest_node(G, end_pt)
    
    k_paths_curves = []
    k_paths_indices = [] 
    
    print("2. Calculating distinctly penalized paths...")
    for i in range(k):
        try:
            path = nx.shortest_path(G, source=start_key, target=end_key, weight='weight')
            
            path_curves = []
            raw_path_indices = []
            
            for j in range(len(path) - 1):
                node_a = path[j]
                node_b = path[j+1]
                
                path_curves.append(edge_geometries[(node_a, node_b)])
                raw_path_indices.append(edge_indices[(node_a, node_b)])
                
                current_weight = G[node_a][node_b]['weight']
                G[node_a][node_b]['weight'] = current_weight * penalty_factor
                
            joined_curves = rg.Curve.JoinCurves(path_curves)
            if joined_curves:
                k_paths_curves.append(joined_curves[0])
                
                clean_indices = []
                for idx in raw_path_indices:
                    if not clean_indices or clean_indices[-1] != idx:
                        clean_indices.append(idx)
                
                k_paths_indices.append(clean_indices)
                
        except nx.NetworkXNoPath:
            print(f"Stopped early at {i} routes: No more valid alternative paths exist.")
            break
        except Exception as e:
            print("An error occurred: " + str(e))
            break
            
    print(f"Success: Found {len(k_paths_curves)} distinct routes.")
    
    # NEW: Convert the nested Python list into a strict Grasshopper Data Tree
    gh_tree = Grasshopper.DataTree[System.Object]()
    for branch_index, indices_list in enumerate(k_paths_indices):
        path = GH_Path(branch_index)
        for index_val in indices_list:
            gh_tree.Add(index_val, path)
            
    return k_paths_curves, gh_tree

if Lines and StartPt and EndPt and K and Penalty:
    Routes, RouteIndices = get_distinct_paths_with_indices(Lines, StartPt, EndPt, K, Penalty)
# ---------- end n_shortest_routes ----------
number_slider_2 = Slider(0, range=0..4)  # disabled
item = ListItem(List=n_shortest_routes.Routes, Index=number_slider_2, Wrap=invert(True))  # disabled
panel_8 = Panel(n_shortest_routes.RouteIndices)  # disabled

# ----
create_street_network = CreateStreetNetwork(
    StreetPolylines=import_osm_file_2.Polylines,
    CoordinateReference=import_osm_file_2.CoordinateReference,
    CleanStreets=True)  # -> StreetNetwork, CoordinateReference; disabled
tag = TextTag(Location=midpt, Text=index)  # disabled
import_streets = ImportStreets(ProjectSetting=text, DataSource="osm", Terrain=False)
lng = ListLength(List=n_shortest_routes.Routes)  # disabled
index_2 = ItemIndex(List=n_shortest_routes.Routes, Item=n_shortest_routes.Routes)  # disabled
import_buildings_2 = ImportBuildings(ProjectSetting=text, DataSource="osm", Terrain=True)  # -> _2DFootprints, _3DMeshes
swatch_2 = ColourSwatch(SwatchColor=RGB(255, 0, 129))  # disabled
import_green_spaces = ImportGreenSpaces(ProjectSetting=text, DataSource="osm", Terrain=False)  # -> GreenSpaces, Trees
gradient = Gradient(
    LowerLimit=0,
    UpperLimit=lng,
    Parameter=index_2,
    stops=[0: RGB(243, 57, 0), 0.1: RGB(236, 27, 60), 0.2: RGB(210, 0, 118), 0.3: RGB(103, 0, 120), 0.4: RGB(39, 72, 161), 0.5: RGB(1, 192, 229), 0.6: RGB(18, 178, 90), 0.7: RGB(79, 186, 8), 0.8: RGB(220, 237, 32), 0.9: RGB(247, 159, 20), 1: RGB(243, 57, 0)])  # disabled
viewer = ParamViewer(n_shortest_routes.RouteIndices)  # disabled
splitstr = SplitStreetCurves(SplitStreetCurves=flatten(import_streets), IntersectionTolerance=1e-12)  # -> ProcessedStreetCurves, Metadata

# ---- group: destination
pt_3 = Point(Point(5034.232252, 2606.704757, 0))  # disabled

# ---- group: origin
pt_4 = Point(Point(2486.27064, 2269.662603, 0))  # disabled

# ----
number_slider_3 = Slider(3, range=0..10)  # disabled
preview = CustomPreview(Geometry=import_buildings_2._3DMeshes, Material=ColourSwatch(SwatchColor=RGBA(2, 124, 153, 177)))
panel_9 = Panel(n_shortest_routes.out)  # disabled
crv = Curve(import_green_spaces.GreenSpaces)
betwcent = BetweennessCentrality(StreetNetwork=create_street_network.StreetNetwork)  # -> StreetSegments, BetweennessCentrality; disabled
previewlw_2 = CustomPreviewLineweights(Geometry=import_streets, Shader=ColourSwatch(SwatchColor=RGB(2, 74, 117)), Absolute=False)
router = Router(
    Origin=pt,
    Destination=pt_2,
    TravelMode="(0): Walk",
    StreetNetwork=create_street_network.StreetNetwork,
    CoordinateReference=create_street_network.CoordinateReference,
    RoutingMetric="Comprehensive (Default)")  # -> Route, TravelTime, TravelDistance, CoordinateReference; disabled
disc = Discontinuity(Curve=crv, Level=1)  # -> Points, Parameters
explode = Explode(Curve=splitstr.ProcessedStreetCurves, Recursive=True)  # -> flatten(Segments), Vertices

# ---- group: Original Urbano router
router_2 = Router(RouterUrbanoModelOrStreetNetwork=model.UrbanoModel, Origin=pt_4, Destination=pt_3, TravelMode="car", TimeLimit=-1)  # -> Trip, Route, Time, Distance; disabled
crv_2 = Curve(router_2.Route)  # disabled

# ---- group: New router gets more than one optimal route
number_slider_4 = Slider(5, range=1..20)  # disabled
panel_10 = Panel("10.0")  # disabled
n_shortest_routes_2 = Python3Script(Lines=streetnet.StreetSegmentCurves, StartPt=pt_4, EndPt=pt_3, Penalty=panel_10, K=number_slider_4)  # -> out, Routes, RouteIndices; inputs Lines: list of Curve, StartPt: Point3d, EndPt: Point3d, Penalty: Double, K: Int32; disabled; same code as n_shortest_routes
number_slider_5 = Slider(1, range=0..4)  # disabled
item_2 = ListItem(List=n_shortest_routes_2.Routes, Index=number_slider_5, Wrap=invert(True))  # disabled
panel_11 = Panel(n_shortest_routes_2.RouteIndices)  # disabled

# ----
previewlw_3 = CustomPreviewLineweights(Geometry=n_shortest_routes.Routes, Shader=gradient, Thickness=number_slider_3, Absolute=False)  # disabled
pline_3 = PolyLine(Vertices=disc.Points, Closed=invert(False))
explode_2 = Explode(Curve=item, Recursive=True)  # -> Segments, Vertices; disabled
pt_5 = Point(Point(162.4924354, 340.4718807, 0))
dot = AnnotationDot(Location=pt_5, PrimaryText="Origen", TextHeight=Slider(12, range=0..100))  # -> AnnotationDot, Location, PrimaryText, SecondaryText, TextHeight, Font
pt_6 = Point(Point(991.4064171, 930.7081798, 0))
dot_2 = AnnotationDot(AnnotationDot=dot.AnnotationDot, Location=pt_6, PrimaryText="Destino")  # -> AnnotationDot, Location, PrimaryText, SecondaryText, TextHeight, Font
midpt_2 = CurveMiddle(Curve=explode_2.Segments)  # disabled
srf = Surface(pline_3)
swatch_3 = ColourSwatch(SwatchColor=RGB(2, 205, 153))
dots = DotDisplay(Point=[pt_5, pt_6], Colour=ColourSwatch(SwatchColor=RGB(2, 205, 153)), Size=Slider(14, range=0..100))
midpt_3 = CurveMiddle(Curve=explode.Segments)
preview_2 = CustomPreview(Geometry=srf, Material=ColourSwatch(SwatchColor=RGBA(78, 206, 153, 198)))

# ---- group: select one branch
number_slider_6 = Slider(0, range=0..4)  # disabled
branch = BranchByIndex(Tree=n_shortest_routes_2.RouteIndices, Branch=number_slider_6)  # disabled
item_3 = ListItem(List=streetnet.StreetSegmentCurves, Index=branch, Wrap=True)  # disabled
midpt_4 = CurveMiddle(Curve=item_3)  # disabled
tag_2 = TextTag(Location=midpt_4, Text=branch)  # disabled

# ----
viewer_2 = ParamViewer(n_shortest_routes_2.RouteIndices)  # disabled
set_slider = SetSliderProperties()
point_to_lat_lon = Python3Script(Point=midpt_3)  # -> LAT, LON; inputs Point: Point3d
# ---------- point_to_lat_lon: Python ----------
import math
import Rhino

# 1. Fetch the origin coordinates from the Rhino Document's Earth Anchor Point
eap = Rhino.RhinoDoc.ActiveDoc.EarthAnchorPoint
lat_origin = eap.EarthBasepointLatitude
lon_origin = eap.EarthBasepointLongitude

# Constants for Earth's geometry (in meters)
M_PER_DEG_LAT = 111111.0
M_PER_DEG_LON_EQ = 111320.0

# 2. Calculate the change in Latitude (using the Y coordinate in meters)
delta_lat = Point.Y / M_PER_DEG_LAT
LAT = lat_origin + delta_lat

# 3. Calculate the change in Longitude (using the X coordinate in meters)
# We must convert the origin latitude to radians to use math.cos()
lat_rad = math.radians(lat_origin)
delta_lon = Point.X / (M_PER_DEG_LON_EQ * math.cos(lat_rad))
LON = lon_origin + delta_lon
# ---------- end point_to_lat_lon ----------

# ---- group: select one branch
item_4 = ListItem(List=streetnet.StreetSegmentCurves, Index=n_shortest_routes_2.RouteIndices, Wrap=True)  # disabled
midpt_5 = CurveMiddle(Curve=item_4)  # disabled
tag_3 = TextTag(Location=midpt_5, Text=n_shortest_routes_2.RouteIndices)  # disabled

# ----
swatch_4 = ColourSwatch(SwatchColor=RGB(255, 0, 129))
panel_12 = Panel(point_to_lat_lon.LAT)
panel_13 = Panel(point_to_lat_lon.LON)

# ---- group: New router gets more than one optimal route / Sensations - options
myslider = Slider(4, range=0..4)

# ---- group: New router gets more than one optimal route
n_shortest_routes_3 = Python3Script(Lines=explode.Segments, StartPt=pt_5, EndPt=pt_6, Penalty="10.0", K=Slider(5, range=1..20))  # -> out, Routes, RouteIndices; inputs Lines: list of Curve, StartPt: Point3d, EndPt: Point3d, Penalty: Double, K: Int32; same code as n_shortest_routes
item_5 = ListItem(List=n_shortest_routes_3.Routes, Index=myslider, Wrap=invert(True))
panel_14 = Panel(n_shortest_routes_3.RouteIndices)

# ----
lng_2 = ListLength(List=n_shortest_routes_3.Routes)
index_3 = ItemIndex(List=n_shortest_routes_3.Routes, Item=n_shortest_routes_3.Routes)
viewer_3 = ParamViewer(n_shortest_routes_3.RouteIndices)
gradient_2 = Gradient(
    LowerLimit=0,
    UpperLimit=lng_2,
    Parameter=index_3,
    stops=[0: RGB(243, 57, 0), 0.1: RGB(236, 27, 60), 0.2: RGB(210, 0, 118), 0.3: RGB(103, 0, 120), 0.4: RGB(39, 72, 161), 0.5: RGB(1, 192, 229), 0.6: RGB(18, 178, 90), 0.7: RGB(79, 186, 8), 0.8: RGB(220, 237, 32), 0.9: RGB(247, 159, 20), 1: RGB(243, 57, 0)])
explode_3 = Explode(Curve=item_2, Recursive=True)  # -> Segments, Vertices; disabled
midpt_6 = CurveMiddle(Curve=explode_3.Segments)  # disabled
panel_15 = Panel(n_shortest_routes_3.out)
previewlw_4 = CustomPreviewLineweights(Geometry=n_shortest_routes_3.Routes, Shader=gradient_2, Thickness="5", Absolute=False)
len = Length(Curve=item_5)

divide = DivideCurve(Curve=item_5, Count=Slider(7, range=0..10), Kinks=False)  # -> Points, Tangents, Parameters

explode_4 = Explode(Curve=item_5, Recursive=True)  # -> Segments, Vertices
midpt_7 = CurveMiddle(Curve=explode_4.Segments)
reduce = RandomReduce(List=midpt_7, Reduction=Slider(41, range=0..100), Seed=Slider(12, range=0..100))

item_6 = ListItem(List=gradient_2, Index=myslider, Wrap=True)
Z = UnitZ(Factor=1)
line = LineSDL(Start=divide.Points, Direction=Z, Length=Slider(50, range=0..100))
Z_2 = UnitZ(Factor=Slider(12, range=0..100))
argb = SplitARGB(Colour=item_6, IntegerChannels=True)  # -> Alpha, Red, Green, Blue
end = EndPoints(Curve=line)  # -> Start, End
rgb = ColourRGB(Alpha=Slider(124, range=0..255), Red=argb.Red, Green=argb.Green, Blue=argb.Blue)
cir = Circle(Plane=end.End, Radius=Slider(70, range=0..100))
Z_3 = UnitZ(Factor=Slider(40, range=0..100))
extr = Extrude(Base=cir, Direction=Z_3)
preview_3 = CustomPreview(Geometry=extr, Material=rgb)
previewlw_5 = CustomPreviewLineweights(Geometry=line, Shader=item_6, Thickness="3", Absolute=False)
path_distance = Panel(len)

# ----
# Visualize streets by type (based on OSM tags)
panel_16 = Panel("highway")  # disabled
lookup_metadata = LookupMetadata(MetadataGeometry=import_streets, SearchKey=panel_16)  # disabled
button = Button()  # disabled
urbano_gradient = UrbanoGradient(
    Reverse=button,
    stops=[0: RGB(243, 57, 0), 0.1: RGB(236, 27, 60), 0.2: RGB(210, 0, 118), 0.3: RGB(103, 0, 120), 0.4: RGB(39, 72, 161), 0.5: RGB(1, 192, 229), 0.6: RGB(18, 178, 90), 0.7: RGB(79, 186, 8), 0.8: RGB(220, 237, 32), 0.9: RGB(247, 159, 20), 1: RGB(243, 57, 0)])  # disabled
panel_17 = Panel("OSM Street Tag")  # disabled
panel_18 = Panel("0.5 to 5")  # disabled
map_settings = MapSettings(Gradient=urbano_gradient, Legend=False, LegendTitle=panel_17, Label=False, LinewidthRange=panel_18)  # disabled
draw_map_2 = DrawMap(Geometries=import_streets, Values=lookup_metadata, MapSettings=map_settings)  # disabled

# ----
# Visualize building by type (based on OSM tags)
panel_19 = Panel("building")  # disabled
lookup_metadata_2 = LookupMetadata(MetadataGeometry=import_buildings_2._3DMeshes, SearchKey=panel_19)  # disabled
button_2 = Button()  # disabled
urbano_gradient_2 = UrbanoGradient(
    Reverse=button_2,
    stops=[0: RGB(243, 57, 0), 0.1: RGB(247, 159, 20), 0.2: RGB(220, 237, 32), 0.3: RGB(79, 186, 8), 0.4: RGB(18, 178, 90), 0.5: RGB(1, 192, 229), 0.6: RGB(39, 72, 161), 0.7: RGB(103, 0, 120), 0.8: RGB(210, 0, 118), 0.9: RGB(236, 27, 60), 1: RGB(243, 57, 0)])  # disabled
panel_20 = Panel("OSM Building Tag")  # disabled
map_settings_2 = MapSettings(Gradient=urbano_gradient_2, Legend=True, LegendTitle=panel_20, Label=False)  # disabled
draw_map_3 = DrawMap(Geometries=import_buildings_2._3DMeshes, Values=lookup_metadata_2, MapSettings=map_settings_2)  # disabled

divide_2 = DivideCurve(Curve=item_5, Count=Slider(202, range=0..1000), Kinks=False)  # -> Points, Tangents, Parameters
lng_3 = ListLength(List=divide_2.Points)
pdecon = Deconstruct(Point=divide_2.Points)  # -> XComponent, YComponent, ZComponent
dom = ConstructDomain(DomainStart=Slider(0, range=0..100), DomainEnd=Slider(50, range=0..100))
random = Random(Range=dom, Number=lng_3, Seed=Slider(59, range=0..100))
pt_7 = ConstructPoint(XCoordinate=pdecon.XComponent, YCoordinate=pdecon.YComponent, ZCoordinate=random)

intcrv = Interpolate(Vertices=pt_7, Degree=Slider(1, range=1..3), Periodic=False, KnotStyle=1)  # -> Curve, Length, Domain

previewlw_6 = CustomPreviewLineweights(Geometry=intcrv.Curve, Shader=item_6, Absolute=False)

# ---- group: Fake percentage of use
Z_4 = UnitZ(Factor=1)
line_2 = LineSDL(Start=midpt_7, Direction=Z_4, Length=Slider(69, range=0..100))
ccx = CurveCurve(CurveA=line_2, CurveB=intcrv.Curve)  # -> flatten(Points), ParamsA, ParamsB
pdecon_2 = Deconstruct(Point=ccx.Points)  # -> XComponent, YComponent, ZComponent
bnd = Bounds(Numbers=pdecon_2.ZComponent)
remap = RemapNumbers(Value=pdecon_2.ZComponent, Source=bnd, Target="0 to 100")  # -> Mapped, Clipped
round = Round(Number=remap.Mapped)  # -> Nearest, Floor, Ceiling

# ----
move = Move(Geometry=ccx.Points, Motion=Z_2)  # -> Geometry, Transform
panel_21 = Panel(remap.Mapped)

# ---- group: Fake percentage of use (continued)
tag_4 = TextTag(Location=move.Geometry, Text=round.Nearest, Colour=item_6)

# ----
dots_2 = DotDisplay(Point=ccx.Points, Colour=item_6, Size=Slider(5, range=0..10))
tag_5 = TextTag3D(Location=ccx.Points, Text=round.Nearest, Size=Slider(23, range=0..100), Colour=item_6, Justification=7)
